# Dynamo graph Context from CAD_R23.dyn "Context from CAD_R23-script" (Dynamo 2.19.3.6394)
# packages: spring nodes 210.1.1, Data-Shapes 2022.2.103, bimorphNodes 4.2.4, Crumple 2022.5.27, SvN Packages 0.0.1

boolean = BoolSelector(true)
ꟿ_collect_currentselection = Custom[ꟿ Collect.CurrentSelection](refresh=boolean)  # package spring nodes; Gets the currently selected elements. Connect a boolean switch to refresh the selection.
svn_logo = Custom[SvN - Logo]()  # package SvN Packages; Black and White Logo
string = StringInput("Confirm Layer")
string_2 = StringInput("Select the layer")
layerNames = Revit.ImportInstance.LayerNames(importInstance=ꟿ_collect_currentselection)
radiobuttons_data = Custom[RadioButtons Data](InputName=string_2, Keys=layerNames, Values=layerNames)  # package Data-Shapes; Create radio buttons input for UI.MultipleInputForm ++ .
code_block = CodeBlock()
# ---------- code_block.designscript (2 lines) ----------
["Random Height(Seed)",
"Random Height Max"];
# ----------------------------------------
code_block_2 = CodeBlock()
# ---------- code_block_2.designscript (2 lines) ----------
["4000",
"6000"];
# ----------------------------------------
boolean_2 = BoolSelector(true)
textbox_data = Custom[TextBox Data](InputName=code_block, DefaultText=code_block_2, IsNumberEntry=boolean_2)  # package Data-Shapes; Create Data for TextBox input in UI.MultipleInputForm ++ . Check out www.data-shapes.net for more informations
list_create = List.Create(item0=radiobuttons_data, item1=textbox_data)
code_block_3 = CodeBlock { 600; 500; }
multipleinputform = Custom[MultipleInputForm ++](Logo_optional=svn_logo, ButtonText_optional=string, Inputs=list_create, Toggle=boolean_2, MaxHeight_optional=code_block_3.out0, Width_optional=code_block_3.out1)  # package Data-Shapes; Create a form with multiple inputs. see www.data-shapes.net for tutorials and infos!
code_block_4 = CodeBlock { 0; }
getItemAtIndex = List.GetItemAtIndex(list=multipleinputform.User_Inputs, index=code_block_4)
curvesFromCADLayers = CAD.CurvesFromCADLayers(importInstance=ꟿ_collect_currentselection, layerNames=getItemAtIndex)
firstItem = List.FirstItem(list=curvesFromCADLayers.Curve)
python_script = Python(IN[0]=firstItem)  # IronPython2
# ---------- python_script.python (35 lines) ----------
#Copyright(c) 2015, Konrad Sobon
# @arch_laboratory, http://archi-lab.net

import clr
clr.AddReference('ProtoGeometry')
from Autodesk.DesignScript.Geometry import *

#The inputs to this node will be stored as a list in the IN variable.
dataEnteringNode = IN

inputCurves = IN[0]

#join/group curves function
def groupCurves(Line_List): 
	ignore_distance = 0.1 # Assume points this close or closer to each other are touching 
	Grouped_Lines = [] 
	Queue = set() 
	while Line_List: 
		Shape = [] 
		Queue.add(Line_List.pop()) # Move a line from the Line_List to our queue 
		while Queue: 
			Current_Line = Queue.pop() 
			Shape.append(Current_Line) 
			for Potential_Match in Line_List: 
				Points = (Potential_Match.StartPoint, Potential_Match.EndPoint)
				for P1 in Points: 
					for P2 in (Current_Line.StartPoint, Current_Line.EndPoint): 
						distance = P1.DistanceTo(P2) 
						if distance <= ignore_distance: 
							Queue.add(Potential_Match) 
			Line_List = [item for item in Line_List if item not in Queue]
		Grouped_Lines.append(Shape) 
	return Grouped_Lines

OUT = groupCurves(inputCurves)
# ----------------------------------------
byJoinedCurves = PolyCurve.ByJoinedCurves(curves=python_script)
ZAxis = Vector.ZAxis()
count = List.Count(list=firstItem)
code_block_5 = CodeBlock { 1; }
getItemAtIndex_2 = List.GetItemAtIndex(list=multipleinputform.User_Inputs, index=code_block_5)
code_block_6 = CodeBlock { 0; }
getItemAtIndex_3 = List.GetItemAtIndex(list=getItemAtIndex_2, index=code_block_6)
code_block_7 = CodeBlock { 1; }
getItemAtIndex_4 = List.GetItemAtIndex(list=getItemAtIndex_2, index=code_block_7)
math_randomnumbers = Custom[© Math.RandomNumbers](count=count, seed=getItemAtIndex_3, min=getItemAtIndex_3, max=getItemAtIndex_4)  # package Crumple; Generates a list of random numbers between a minimum and maximum value.
extrudeAsSolid = Curve.ExtrudeAsSolid(curve=byJoinedCurves, direction=ZAxis, distance=math_randomnumbers)
ꟿ_form_bygeometry = Custom[ꟿ Form.ByGeometry](geometry=extrudeAsSolid)  # package spring nodes; Convert the input geometry to a Revit Form object. Forms can exist only in the family environment. You can convert complicated solids or surfaces directly into forms. A form can act as a void. Provide either one true boolean value to convert a form into a void. The node's lacing is set to longest by default.
