# Dynamo graph osm-script.dyn (Dynamo 2.3.2.15696)
# packages: Elk 1.1.0, Crumple 2022.2.13, spring nodes 210.1.1

osm_file = Filename("C:\Users\jtian\Desktop\test\map (1).osm")  # graph input
location = Elk.OSM.Location(filePath=osm_file)
features = Elk.OSM.Features()
code_block = CodeBlock { 5; 9; "*"; [14,15,16,40,41,21,22,28,29,36,37,43,25]; 10; }
getItemAtIndex = List.GetItemAtIndex(list=features, index=code_block.out1)
subFeatures = Elk.OSM.SubFeatures(feature=getItemAtIndex, subIndexes=code_block.out3)
# note: Get Street/Roads
OSMData = Elk.OSM.OSMData(OSM=location.OSM@L2, File=location.XML, featureType=getItemAtIndex, subTypes=subFeatures.selected)  # frozen
# note: OSM Geometry
byPoints = PolyCurve.ByPoints(points=OSMData.Points)
flatten = List.Flatten(list=byPoints)  # frozen
string = StringInput(",")
# note: Cleanup OSM data
join = String.Join(separator=string, string0=OSMData.Keys)
flatten_2 = List.Flatten(list=join)

# group: Make Road
code_block_2 = CodeBlock { 10; 0.2; }
extrudeAsSolid = Curve.ExtrudeAsSolid(distance=code_block_2.out1)  # frozen; unwired: curve
code_block_3 = CodeBlock { 1; ","; }
string_2 = StringInput("est_width:")
contains = String.Contains(str=flatten_2, searchFor=string_2)
filterByBoolMask = List.FilterByBoolMask(list=flatten, mask=contains)
filterByBoolMask_2 = List.FilterByBoolMask(list=flatten_2, mask=contains)
string_3 = StringInput("est_width:")
split = String.Split(str=filterByBoolMask_2.in, separator0=string_3)
lastItem = List.LastItem(list=split@L2)
code_block_4 = CodeBlock { 1; ","; }
split_2 = String.Split(str=lastItem, separator0=code_block_4.out1)
firstItem = List.FirstItem(list=split_2@L2)
toNumber = String.ToNumber(str=firstItem)
normal = Curve.Normal(curve=filterByBoolMask.out)

byThickeningCurve = PolyCurve.ByThickeningCurve(curve=filterByBoolMask.in, thickness=toNumber)  # unwired: nor

# group (continued): Make Road
extrudeAsSolid_2 = Curve.ExtrudeAsSolid(curve=byThickeningCurve, distance=code_block_2.out1)  # frozen

byThickeningCurve_2 = PolyCurve.ByThickeningCurve(curve=filterByBoolMask.out, thickness=code_block_2.out0)  # unwired: nor
getItemAtIndex_2 = List.GetItemAtIndex(list=features, index=code_block.out0)
# note: Get Building
OSMData_2 = Elk.OSM.OSMData(OSM=location.OSM, File=location.XML, featureType=getItemAtIndex_2, subTypes=code_block.out2)
byPoints_2 = Polygon.ByPoints(points=OSMData_2.Points)
flatten_3 = List.Flatten(list=byPoints_2)
join_2 = String.Join(separator=string, string0=OSMData_2.Keys)
firstItem_2 = List.FirstItem(list=join_2)

# group: Create Building with Height
string_4 = StringInput("height:")
contains_2 = String.Contains(str=firstItem_2, searchFor=string_4)
filterByBoolMask_3 = List.FilterByBoolMask(list=flatten_3, mask=contains_2)
ZAxis = Vector.ZAxis()
filterByBoolMask_4 = List.FilterByBoolMask(list=firstItem_2, mask=contains_2)
string_5 = StringInput("height:")
split_3 = String.Split(str=filterByBoolMask_4.in, separator0=string_5)
code_block_5 = CodeBlock { 1; ","; }
getItemAtIndex_3 = List.GetItemAtIndex(list=split_3@L2, index=code_block_5.out0)
code_block_6 = CodeBlock { 1; ","; }
split_4 = String.Split(str=getItemAtIndex_3, separator0=code_block_6.out1)
firstItem_3 = List.FirstItem(list=split_4@L2)
toNumber_2 = String.ToNumber(str=firstItem_3)
convert_to_mm = CodeBlock(num=toNumber_2) { num*1000; }
extrudeAsSolid_3 = Curve.ExtrudeAsSolid(curve=filterByBoolMask_3.in, direction=ZAxis, distance=convert_to_mm)

file_path = Filename("C:\ProgramData\Autodesk\RVT 2020\Family Templates\English\Metric Generic Model.rft")

# group: If there is no Height, check Levels
string_6 = StringInput("levels:")
contains_3 = String.Contains(str=filterByBoolMask_4.out, searchFor=string_6)
filterByBoolMask_5 = List.FilterByBoolMask(list=filterByBoolMask_3.out, mask=contains_3)
filterByBoolMask_6 = List.FilterByBoolMask(list=filterByBoolMask_4.out, mask=contains_3)
string_7 = StringInput("levels:")
split_5 = String.Split(str=filterByBoolMask_6.in, separator0=string_7)
code_block_7 = CodeBlock { 1; ","; }
getItemAtIndex_4 = List.GetItemAtIndex(list=split_5@L2, index=code_block_7.out0)
split_6 = String.Split(str=getItemAtIndex_4, separator0=code_block_7.out1)
firstItem_4 = List.FirstItem(list=split_6@L2)
toNumber_3 = String.ToNumber(str=firstItem_4)
code_block_8 = CodeBlock(levels=toNumber_3) { h=(levels-1)*2950+3250; }
count = List.Count(list=filterByBoolMask_5.out)

# group: Create Random Height
lowest_average_height = DoubleInput(4000)  # graph input
tallest_building = DoubleInput(12000)  # graph input
randomnumbers = Custom[© RandomNumbers](count=count, seed=lowest_average_height, min=lowest_average_height, max=tallest_building)  # package Crumple; Generates a list of random numbers between a minimum and maximum value.

# group: If there is no Levels, make flat 4 meters high
ZAxis_2 = Vector.ZAxis()
extrudeAsSolid_4 = Curve.ExtrudeAsSolid(curve=filterByBoolMask_5.out, direction=ZAxis_2, distance=randomnumbers)

# group (continued): If there is no Height, check Levels
extrudeAsSolid_5 = Curve.ExtrudeAsSolid(curve=filterByBoolMask_5.in, direction=ZAxis_2, distance=code_block_8)

list_create = List.Create(item0=extrudeAsSolid_3, item1=extrudeAsSolid_5, item2=extrudeAsSolid_4)
flatten_4 = List.Flatten(list=list_create)
count_2 = List.Count(list=flatten_4)
code_block_9 = CodeBlock(x=count_2) { 1..x; }
code_block_10 = CodeBlock(num=code_block_9) { "CONTEXT - BUILDINGS"+num; "Mass"; "CONTEXT - BUILDINGS"; }
ꟿ_familyinstance_bygeometry = Custom[ꟿ FamilyInstance.ByGeometry](geometry=flatten_4, familyTemplatePath=file_path, familyName=code_block_10.out0, category=code_block_10.out1, materialName=code_block_10.out2)  # package spring nodes; You must provide a valid family template path that will be used for all input geometry objects. The project units(and not the templates) will be used to determine the size of the output geometry. The provided category will be used only if the family template supports it. If not, the default template category will be used instead. Likewise, the family material(provided as a string) will be set only if a material with that name exists in the template. If not, the default material will be used instead ("By Category"). For void cuts, the material settings will be ignored. The Subcategory name is an optional input. If you'd like to skip assigning a Subcategory to any new instance, simply use null. The node expects a unique family name for each geometry object. The rest of the input lists will be processed as if the node lacing is set to longest.
