# Dynamo graph SetMasstoFloor-BETA.dyn (Dynamo 2.19.3.6394)

# group: Get Data From Mass Floor
categories = Categories("OST_MassFloor")
all_elements_of_category = ElementsOfCategory(Category=categories)
string = StringInput("Mass: Family")
getParameterValueByName = Element.GetParameterValueByName(element=all_elements_of_category, parameterName=string)

# group: Get Data From Mass
categories_2 = Categories("OST_Mass")
all_elements_of_category_2 = ElementsOfCategory(Category=categories_2)
string_2 = StringInput("BLOCK")
getParameterValueByName_2 = Element.GetParameterValueByName(element=all_elements_of_category_2, parameterName=string_2)
string_3 = StringInput("Family")

code_block = CodeBlock { ""; }
ne = getParameterValueByName_2 != code_block
filterByBoolMask = List.FilterByBoolMask(list=all_elements_of_category_2, mask=ne)
filterByBoolMask_2 = List.FilterByBoolMask(list=getParameterValueByName_2, mask=ne)

# group: Get Area from Area Plan
string_4 = StringInput("BLOCK_AREA")
categories_3 = Categories("OST_SiteProperty")
all_elements_of_category_3 = ElementsOfCategory(Category=categories_3)
string_5 = StringInput("Area")
getParameterValueByName_3 = Element.GetParameterValueByName(element=all_elements_of_category_3, parameterName=string_5)
code_block_2 = CodeBlock { ""; }
eq = getParameterValueByName_3 == code_block_2
filterByBoolMask_3 = List.FilterByBoolMask(list=all_elements_of_category_3, mask=eq)
getParameterValueByName_4 = Element.GetParameterValueByName(element=filterByBoolMask_3.out, parameterName=string_2)
indexOf = List.IndexOf(list=getParameterValueByName_4, element=filterByBoolMask_2.in)
getItemAtIndex = List.GetItemAtIndex(list=filterByBoolMask_3.out, index=indexOf)
string_6 = StringInput("Area")
getParameterValueByName_5 = Element.GetParameterValueByName(element=getItemAtIndex, parameterName=string_6, lacing=Longest)
setParameterByName = Element.SetParameterByName(element=filterByBoolMask.in, parameterName=string_4, value=getParameterValueByName_5)
string_7 = StringInput("NET SITE AREA")
code_block_3 = CodeBlock { "NET SITE AREA"; }
string_8 = StringInput("Name")
getParameterValueByName_6 = Element.GetParameterValueByName(element=filterByBoolMask_3.out, parameterName=string_8)
eq_2 = code_block_3 == getParameterValueByName_6
filterByBoolMask_4 = List.FilterByBoolMask(list=filterByBoolMask_3.out, mask=eq_2)
getParameterValueByName_7 = Element.GetParameterValueByName(element=filterByBoolMask_4.in, parameterName=string_6, lacing=Longest)
python_script = Python(IN[0]=getParameterValueByName_7)  # CPython3
# ---------- python_script.python (21 lines) ----------
# Load the Python Standard and DesignScript Libraries
import sys
import clr
clr.AddReference('ProtoGeometry')
from Autodesk.DesignScript.Geometry import *

# The inputs to this node will be stored as a list in the IN variables.
dataEnteringNode = IN

# Place your code below this line
list1=IN[0]
b=[]
for i in list1:
    if i== "" or i == 0:
        print("pass")
    else:
        b.append(i)
sumlist=sum(b)
        
# Assign your output to the OUT variable.
OUT = sumlist
# ----------------------------------------
setParameterByName_2 = Element.SetParameterByName(element=filterByBoolMask.in, parameterName=string_7, value=python_script, lacing=Longest)

# note: Clockwork
code_block_4 = CodeBlock(passthrough=filterByBoolMask.in, waitfor=setParameterByName) { [passthrough,waitfor][0]; }

# group (continued): Get Data From Mass
getParameterValueByName_8 = Element.GetParameterValueByName(element=filterByBoolMask.in, parameterName=string_3)
family = FamilyType.Family(familyType=getParameterValueByName_8)
name = Element.Name(element=family)

indexOf_2 = List.IndexOf(list=name, element=getParameterValueByName)
# note: Here is to figure out which Mass it is from the Mass Floor list.
getItemAtIndex_2 = List.GetItemAtIndex(list=code_block_4, index=indexOf_2)

# group: Get Data From the Hosted Mass
string_9 = StringInput("PHASE")
getParameterValueByName_9 = Element.GetParameterValueByName(element=getItemAtIndex_2, parameterName=string_9)
string_10 = StringInput("BLOCK")
getParameterValueByName_10 = Element.GetParameterValueByName(element=getItemAtIndex_2, parameterName=string_10)
string_11 = StringInput("BUILDING ID")
getParameterValueByName_11 = Element.GetParameterValueByName(element=getItemAtIndex_2, parameterName=string_11)
string_12 = StringInput("Mass ID")
getParameterValueByName_12 = Element.GetParameterValueByName(element=getItemAtIndex_2, parameterName=string_12)
string_13 = StringInput("PROGRAM")
getParameterValueByName_13 = Element.GetParameterValueByName(element=getItemAtIndex_2, parameterName=string_13)
string_14 = StringInput("BLOCK_AREA")
getParameterValueByName_14 = Element.GetParameterValueByName(element=getItemAtIndex_2, parameterName=string_14)
string_15 = StringInput("SvN_Unit Count")
getParameterValueByName_15 = Element.GetParameterValueByName(element=getItemAtIndex_2, parameterName=string_15)

setParameterByName_3 = Element.SetParameterByName(element=all_elements_of_category, parameterName=string_7, value=python_script, lacing=Longest)
string_16 = StringInput("SvN_Count")
code_block_5 = CodeBlock { 1; }

# group: Pour Data to the Mass Floors
setParameterByName_4 = Element.SetParameterByName(element=all_elements_of_category, parameterName=string_9, value=getParameterValueByName_9)
setParameterByName_5 = Element.SetParameterByName(element=all_elements_of_category, parameterName=string_10, value=getParameterValueByName_10)
setParameterByName_6 = Element.SetParameterByName(element=all_elements_of_category, parameterName=string_11, value=getParameterValueByName_11)
setParameterByName_7 = Element.SetParameterByName(element=all_elements_of_category, parameterName=string_12, value=getParameterValueByName_12)
setParameterByName_8 = Element.SetParameterByName(element=all_elements_of_category, parameterName=string_13, value=getParameterValueByName_13)
setParameterByName_9 = Element.SetParameterByName(element=all_elements_of_category, parameterName=string_14, value=getParameterValueByName_14)
setParameterByName_10 = Element.SetParameterByName(element=all_elements_of_category, parameterName=string_15, value=getParameterValueByName_15)
setParameterByName_11 = Element.SetParameterByName(element=all_elements_of_category, parameterName=string_16, value=code_block_5)
