# Dynamo graph SetMasstoFloor2020-script.dyn "SetMasstoFloor-script" (Dynamo 2.16.1.2727)

# group: Get Data From Mass Floor
categories = Categories("OST_MassFloor")
string = StringInput("Mass: Family")

all_elements_of_category = ElementsOfCategory(Category=categories)

# group: Get Data From Mass
categories_2 = Categories("OST_Mass")
all_elements_of_category_2 = ElementsOfCategory(Category=categories_2)
string_2 = StringInput("BLOCK")
getParameterValueByName = Element.GetParameterValueByName(element=all_elements_of_category_2, parameterName=string_2)
string_3 = StringInput("Family")
getParameterValueByName_2 = Element.GetParameterValueByName(element=all_elements_of_category_2, parameterName=string_3)
family = FamilyType.Family(familyType=getParameterValueByName_2)
name = Element.Name(element=family)

# group: Get Area from Area Plan
string_4 = StringInput("BLOCK_AREA")
categories_3 = Categories("OST_Areas")
all_elements_of_category_3 = ElementsOfCategory(Category=categories_3)
getParameterValueByName_3 = Element.GetParameterValueByName(element=all_elements_of_category_3, parameterName=string_2)
indexOf = List.IndexOf(list=getParameterValueByName_3, element=getParameterValueByName)
getItemAtIndex = List.GetItemAtIndex(list=all_elements_of_category_3, index=indexOf)
string_5 = StringInput("Area")
getParameterValueByName_4 = Element.GetParameterValueByName(element=getItemAtIndex, parameterName=string_5, lacing=Longest)
setParameterByName = Element.SetParameterByName(element=all_elements_of_category_2, parameterName=string_4, value=getParameterValueByName_4)
string_6 = StringInput("NET SITE AREA")
code_block = CodeBlock { "NET SITE AREA"; }
string_7 = StringInput("Name")
getParameterValueByName_5 = Element.GetParameterValueByName(element=all_elements_of_category_3, parameterName=string_7)
eq = code_block == getParameterValueByName_5
filterByBoolMask = List.FilterByBoolMask(list=all_elements_of_category_3, mask=eq)
getParameterValueByName_6 = Element.GetParameterValueByName(element=filterByBoolMask.in, parameterName=string_5, lacing=Longest)
python_script = Python(IN[0]=getParameterValueByName_6)  # IronPython2
# ---------- python_script.python (21 lines) ----------
# Load the Python Standard and DesignScript Libraries
import sys
import clr
clr.AddReference('ProtoGeometry')
from Autodesk.DesignScript.Geometry import *

# The inputs to this node will be stored as a list in the IN variables.
dataEnteringNode = IN

# Place your code below this line
list1=IN[0]
b=[]
for i in list1:
    if i== "" or i == 0:
        print("pass")
    else:
        b.append(i)
sumlist=sum(b)
        
# Assign your output to the OUT variable.
OUT = sumlist
# ----------------------------------------
setParameterByName_2 = Element.SetParameterByName(element=all_elements_of_category_2, parameterName=string_6, value=python_script, lacing=Longest)

code_block_2 = CodeBlock(passthrough=all_elements_of_category_2, waitfor=setParameterByName) { [passthrough,waitfor][0]; }

# group (continued): Get Data From Mass Floor
getParameterValueByName_7 = Element.GetParameterValueByName(element=all_elements_of_category, parameterName=string)

# note: Clockwork
indexOf_2 = List.IndexOf(list=name, element=getParameterValueByName_7)
# note: Here is to figure out which Mass it is from the Mass Floor list.
getItemAtIndex_2 = List.GetItemAtIndex(list=code_block_2, index=indexOf_2)

# group: Get Data From the Hosted Mass
string_8 = StringInput("PHASE")
getParameterValueByName_8 = Element.GetParameterValueByName(element=getItemAtIndex_2, parameterName=string_8)
string_9 = StringInput("BLOCK")
getParameterValueByName_9 = Element.GetParameterValueByName(element=getItemAtIndex_2, parameterName=string_9)
string_10 = StringInput("BUILDING ID")
getParameterValueByName_10 = Element.GetParameterValueByName(element=getItemAtIndex_2, parameterName=string_10)
string_11 = StringInput("Mass ID")
getParameterValueByName_11 = Element.GetParameterValueByName(element=getItemAtIndex_2, parameterName=string_11)
string_12 = StringInput("PROGRAM")
getParameterValueByName_12 = Element.GetParameterValueByName(element=getItemAtIndex_2, parameterName=string_12)
string_13 = StringInput("BLOCK_AREA")
getParameterValueByName_13 = Element.GetParameterValueByName(element=getItemAtIndex_2, parameterName=string_13)
string_14 = StringInput("Count for Levels")  # frozen
getParameterValueByName_14 = Element.GetParameterValueByName(element=getItemAtIndex_2, parameterName=string_14)  # frozen

# group: Pour Data to the Mass Floors
setParameterByName_3 = Element.SetParameterByName(element=all_elements_of_category, parameterName=string_8, value=getParameterValueByName_8)
setParameterByName_4 = Element.SetParameterByName(element=all_elements_of_category, parameterName=string_9, value=getParameterValueByName_9)
setParameterByName_5 = Element.SetParameterByName(element=all_elements_of_category, parameterName=string_10, value=getParameterValueByName_10)
setParameterByName_6 = Element.SetParameterByName(element=all_elements_of_category, parameterName=string_11, value=getParameterValueByName_11)
setParameterByName_7 = Element.SetParameterByName(element=all_elements_of_category, parameterName=string_12, value=getParameterValueByName_12)
setParameterByName_8 = Element.SetParameterByName(element=all_elements_of_category, parameterName=string_13, value=getParameterValueByName_13)
setParameterByName_9 = Element.SetParameterByName(element=all_elements_of_category, parameterName=string_14, value=getParameterValueByName_14)  # frozen

setParameterByName_10 = Element.SetParameterByName(element=all_elements_of_category, parameterName=string_6, value=python_script, lacing=Longest)
