# Dynamo graph RandomTrees-script.dyn (Dynamo 2.19.3.6394)
# packages: Data-Shapes 2022.2.106, SvN Packages 0.0.1, spring nodes 210.1.1

boolean = BoolSelector(false)

# group: Random Data
ꟿ_collect_currentselection = Custom[ꟿ Collect.CurrentSelection](refresh=boolean)  # package spring nodes; Gets the currently selected elements. Connect a boolean switch to refresh the selection.
code_block = CodeBlock { ""; }
code_block_2 = CodeBlock { "DIM_PlantDiameter"; }
getParameterValueByName = Element.GetParameterValueByName(element=ꟿ_collect_currentselection, parameterName=code_block_2)
eq = code_block == getParameterValueByName
filterByBoolMask = List.FilterByBoolMask(list=ꟿ_collect_currentselection, mask=eq)
getParameterValueByName_2 = Element.GetParameterValueByName(element=filterByBoolMask.out, parameterName=code_block_2)
size_slider = DoubleSlider(30, range=0..100 step 5)
python_script = Python(IN[0]=getParameterValueByName_2, IN[1]=size_slider)  # IronPython2
# ---------- python_script.python (46 lines) ----------
import random

# Function to check if a value is numeric
def is_numeric(value):
    try:
        float(value)
        return True
    except ValueError:
        return False

# Check if IN[0] is empty or contains non-numeric values
if isinstance(IN[0], list):
    # Convert IN[0] to a list of numbers
    numbers = [float(num) if is_numeric(num) else None for num in IN[0]]
elif is_numeric(IN[0]):
    # Treat single input as a single number
    numbers = [float(IN[0])]
else:
    numbers = []

# Set your percentage value (slider value)
percentage = (IN[1] / 100)  # Convert percentage to decimal and add 1 to set the range to between 100% to 200%

# Function to generate a random offset based on percentage
def generate_random_offset(percentage, number):
    return random.uniform(0, percentage * number)

# Round a number to the nearest 5
def round_to_nearest_5(number):
    return round(number / 5) * 5

# Initialize an empty list to store the results
results = []

# Generate a random offset for each number in the list and store the rounded results in a list
for number in numbers:
    if number is not None:
        random_offset = generate_random_offset(percentage, number)
        result = round_to_nearest_5(number + random_offset)
        results.append(result)
    else:
        # Keep None values as is
        results.append(None)

# Output the final list of results
OUT = results
# ----------------------------------------
python_script_2 = Python(IN[0]=ꟿ_collect_currentselection)  # IronPython2
# ---------- python_script_2.python (19 lines) ----------
import clr
clr.AddReference('ProtoGeometry')
from Autodesk.DesignScript.Geometry import *

# Get the input list
input_list = IN[0]

# Get the count of items in the input list
count = len(input_list)

# Generate a random number list with the same count of items as the input list, in increments of 5
import random
random_numbers = [random.randint(0, 359/5) * 5 for _ in range(count)]

# Rotate the random number list
rotated_random_list = [random_numbers[i % count] for i in range(count)]

# Output the rotated random list
OUT = rotated_random_list
# ----------------------------------------

# group: Inputs
svn_logo = Custom[SvN - Logo]()  # package SvN Packages; Black and White Logo
code_block_3 = CodeBlock { ["Random Rotation","Random Size"]; }
code_block_4 = CodeBlock { true; }
boolean_input = Custom[Boolean input](InputName=code_block_3, DefaultValue=code_block_4)  # package Data-Shapes; Creates a boolean input for UI.MultipleInputForm ++ . Check out www.data-shapes.net for more infos!
boolean_2 = BoolSelector(true)
multipleinputform = Custom[MultipleInputForm ++](Logo_optional=svn_logo, Inputs=boolean_input, Toggle=boolean_2)  # package Data-Shapes; Create a form with multiple inputs. see www.data-shapes.net for tutorials and infos!

code_block_5 = CodeBlock(l=multipleinputform.User_Inputs) { l[0]; l[1]; }
if_ = RefactoredIf(test=code_block_5.out1, true=python_script, false=getParameterValueByName_2)
setParameterByName = Element.SetParameterByName(element=filterByBoolMask.out, parameterName=code_block_2, value=if_)
code_block_6 = CodeBlock { 0; }
if_2 = RefactoredIf(test=code_block_5.out0, true=python_script_2, false=code_block_6)
setRotation = FamilyInstance.SetRotation(familyInstance=ꟿ_collect_currentselection, degree=if_2)
