# Dynamo graph DetailLinefromCAD-script.dyn (Dynamo 2.19.3.6394)
# packages: Data-Shapes 2022.2.105, Crumple 2022.5.27, bimorphNodes 4.2.4, Clockwork for Dynamo 2.x 2.4.0, SvN Packages 0.0.1, bimorphNodes 5.1.3, spring nodes 210.1.1

boolean = BoolSelector(true)
revit_currentview = Custom[© Revit.CurrentView](refresh=boolean)  # package Crumple; Given the current document, return the active view.
ꟿ_collect_currentselection = Custom[ꟿ Collect.CurrentSelection]()  # package spring nodes; Gets the currently selected elements. Connect a boolean switch to refresh the selection.
firstItem = List.FirstItem(list=ꟿ_collect_currentselection)
svn_logo = Custom[SvN - Logo]()  # package SvN Packages; Black and White Logo
string = StringInput("Confirm Layer")
string_2 = StringInput("Select the layer")
layerNames = Revit.ImportInstance.LayerNames(importInstance=firstItem)
code_block = CodeBlock { 800; }
listview_data = Custom[Listview Data](InputName=string_2, Keys=layerNames, Values=layerNames, Height_optionnal=code_block)  # package Data-Shapes; Create data for ListView input in UI.MultiInputForm ++ . Check out www.data-shapes.net for more infos.
boolean_2 = BoolSelector(true)
code_block_2 = CodeBlock { 1000; 800; 300; "CANCEL"; }
multipleinputform = Custom[MultipleInputForm ++](Logo_optional=svn_logo, ButtonText_optional=string, Inputs=listview_data, Toggle=boolean_2, CancelButtonText_optional=code_block_2.out3, MaxHeight_optional=code_block_2.out0, Width_optional=code_block_2.out1, LabelWidth_optional=code_block_2.out2)  # package Data-Shapes; Create a form with multiple inputs. see www.data-shapes.net for tutorials and infos!
code_block_3 = CodeBlock { "n/a"; }
if_ = If(test=multipleinputform.Was_Cancelled, true=code_block_3, false=multipleinputform.User_Inputs)
firstItem_2 = List.FirstItem(list=if_)
curvesFromCADLayers = CAD.CurvesFromCADLayers(importInstance=firstItem, layerNames=firstItem_2)
byCurve = DetailCurve.ByCurve(view=revit_currentview, curve=curvesFromCADLayers.Curve)
code_block_4 = CodeBlock(n=curvesFromCADLayers.layerKeys) { "DetailGrp_"+n; }
fromElements = Custom[Group.FromElements](elements=byCurve, groupName=code_block_4, lacing=Shortest)  # package Clockwork for Dynamo 2.x; Creates a group from a list of Revit elements. Unlike the OOTB node, it supports naming the created group directly and also indicates which of the input elements (if any) could not be grouped.
getCategory = Element.GetCategory(element=firstItem)
