# Dynamo graph ProjectUpdat-script2.dyn "ProjectUpdat-script" (Dynamo 2.3.2.15696)
# packages: SvN Packages 0.0.1, bimorphNodes 4.2.4, Crumple 2022.5.27

element_types = ElementTypes("ProjectInfo")
all_elements_of_type = ElementsOfType(element_type=element_types)
code_block = CodeBlock { ["Stat Path","Schedule List"]; }
getParameterValueByName = Element.GetParameterValueByName(element=all_elements_of_type, parameterName=code_block, lacing=Longest)
code_block_2 = CodeBlock(l=getParameterValueByName) { l[0]; l[1]; }
code_block_3 = CodeBlock(filepath=code_block_2.out0)
# ---------- code_block_3.designscript (2 lines) ----------
"Are you sure you closed the file under\n"
+filepath;
# ----------------------------------------
svn_popup_w_buttons = Custom[SvN - Popup w/ Buttons](content=code_block_3)  # package SvN Packages; Pop - up Dialog for boolean
code_block_4 = CodeBlock { ""; }
if_ = If(test=svn_popup_w_buttons, true=code_block_2.out0, false=code_block_4)
# note: Custom Node: Crumple v.2021.5.27
schedulesbytype = Custom[© SchedulesByType]()  # package Crumple; Returns all schedules in a document, separated into key and non-key schedules.
name = Element.Name(element=schedulesbytype.schedules)
svn_string_to_list = Custom[SvN - String to List](str=code_block_2.out1)  # package SvN Packages; Make string list elements to list of strings
indexOf = List.IndexOf(list=name, element=svn_string_to_list)
getItemAtIndex = List.GetItemAtIndex(list=schedulesbytype.schedules, index=indexOf)
name_2 = Element.Name(element=getItemAtIndex)
# note: Custom Node: BimorphNodes v.3.0.3
code_block_5 = CodeBlock { 0; }
code_block_6 = CodeBlock { false; }
getData = Revit.Schedule.GetData(scheduleView=getItemAtIndex, refresh=code_block_6)
boolean = BoolSelector(true)
exportExcel = Data.ExportExcel(filePath=if_, sheetName=name_2, startRow=code_block_5, startCol=code_block_5, data=getData, overWrite=boolean, lacing=Longest)
