# Dynamo graph CreateMarketingPlanDict-script new2.dyn (Dynamo 2.6.2.15705)
# packages: Crumple 2022.2.13, Rhythm 2022.1.5, Data-Shapes 2022.2.103, archi-lab.net 2022.212.2722

file_path = Filename("No file selected.")
string = StringInput("Confirm")
code_block = CodeBlock { ["Select Suite Template","Select Keyplan Template"]; }
viewtemplates = Custom[© ViewTemplates]()  # package Crumple; Returns all view templates in a document. Due to API/Dynamo limitations, 3D view templates are excluded from the list.
name = Element.Name(element=viewtemplates)
code_block_2 = CodeBlock { "14"; }
contains = String.Contains(str=name, searchFor=code_block_2)
filterByBoolMask = List.FilterByBoolMask(list=viewtemplates, mask=contains)
name_2 = Element.Name(element=filterByBoolMask.in)
dropdown_data = Custom[DropDown Data](InputName=code_block, Keys=name_2, Values=filterByBoolMask.in)  # package Data-Shapes; Create data for DropDown input in UI.MultiInputForm ++ . Check out www.data-shapes.net for more infos.
string_2 = StringInput("Choose Filled Region")
element_types = ElementTypes("FilledRegionType")
all_elements_of_type = ElementsOfType(element_type=element_types)
name_3 = Element.Name(element=all_elements_of_type)
dropdown_data_2 = Custom[DropDown Data](InputName=string_2, Keys=name_3, Values=all_elements_of_type)
string_3 = StringInput("Choose the Area you want to Create Sheets")

# group: Active View
categories = Categories("OST_Areas")
boolean = BoolSelector(true)
currentview = Custom[© CurrentView](refresh=boolean)  # package Crumple; Given the current document, return the active view.
all_elements_of_category_in_view = ElementsOfCategoryInView(Category=categories, View=currentview)
level_name = Element.Name(element=currentview)

name_4 = Element.Name(element=all_elements_of_category_in_view)
listview_data = Custom[Listview Data](InputName=string_3, Keys=name_4, Values=all_elements_of_category_in_view)  # package Data-Shapes; Create data for ListView input in UI.MultiInputForm ++ . Check out www.data-shapes.net for more infos.
list_create = List.Create(item0=dropdown_data, item1=dropdown_data_2, item2=listview_data)
inputgroup_data = Custom[InputGroup Data](Inputs=list_create)  # package Data-Shapes; Creates a group of inputs for UI.MultipleInputForm ++ . Check out www.data-shapes.net for more infos !
boolean_2 = BoolSelector(true)
string_4 = StringInput("Cancel")
multipleinputform = Custom[MultipleInputForm ++](Logo_optional=file_path, ButtonText_optional=string, Inputs=inputgroup_data, Toggle=boolean_2, CancelButtonText_optional=string_4)  # package Data-Shapes; Create a form with multiple inputs. see www.data-shapes.net for tutorials and infos!
code_block_3 = CodeBlock(l=multipleinputform.User_Inputs) { a=l[0]; b=l[1]; c=l[2]; d=l[3]; }
string_5 = StringInput("Areas: Municipal Number")
getParameterValueByName = Element.GetParameterValueByName(element=code_block_3.d, parameterName=string_5)

# group: Make Dictionary
groupByKey = List.GroupByKey(list=code_block_3.d, keys=getParameterValueByName)
string_6 = StringInput("Name")
getParameterValueByName_2 = Element.GetParameterValueByName(element=groupByKey.groups, parameterName=string_6)
string_7 = StringInput("Area")
getParameterValueByName_3 = Element.GetParameterValueByName(element=groupByKey.groups, parameterName=string_7)
id = Element.Id(element=groupByKey.groups)
list_create_2 = List.Create(item0=groupByKey.unique_keys, item1=getParameterValueByName_2, item2=getParameterValueByName_3, item3=id)
transpose = List.Transpose(lists=list_create_2)
python_script = Python(IN[0]=transpose)
# ---------- python_script.python (31 lines) ----------
# Load the Python Standard and DesignScript Libraries
import sys
import clr
clr.AddReference('ProtoGeometry')
from Autodesk.DesignScript.Geometry import *

# The inputs to this node will be stored as a list in the IN variables.
dataEnteringNode = IN
unitList=IN[0]
resultList=[]

# Place your code below this line
for i in unitList:
	dictUnit={}
	dictUnit["MunicipalNumber"]=i[0]
	
	for (x,y,z) in zip(i[1],i[2],i[3]):
		
		if x == "Balcony" or x == "Terrace":
			dictUnit["OutsideArea"]=y
			dictUnit["OutsideID"]=z
			dictUnit["OutsideType"]=x
		else:
			dictUnit["SuiteArea"]=y
			dictUnit["SuiteID"]=z
			dictUnit["SuiteType"]=x
	resultList.append(dictUnit)


# Assign your output to the OUT variable.
OUT = resultList
# ----------------------------------------

string_8 = StringInput("14-")
string_9 = StringInput("MunicipalNumber")

# group: Decode the Dictionary
string_10 = StringInput("OutsideID")
valueAtKey = DesignScript.Builtin.Dictionary.ValueAtKey(dictionary=python_script, key=string_10)
string_11 = StringInput("OutsideArea")
valueAtKey_2 = DesignScript.Builtin.Dictionary.ValueAtKey(dictionary=python_script, key=string_11)
string_12 = StringInput("OutsideType")
valueAtKey_3 = DesignScript.Builtin.Dictionary.ValueAtKey(dictionary=python_script, key=string_12)
python_script_2 = Python(IN[0]=valueAtKey, IN[1]=valueAtKey_2, IN[2]=valueAtKey_3)
# ---------- python_script_2.python (27 lines) ----------
# Load the Python Standard and DesignScript Libraries
import sys
import clr
clr.AddReference('ProtoGeometry')
from Autodesk.DesignScript.Geometry import *

# The inputs to this node will be stored as a list in the IN variables.
dataEnteringNode = IN
listD1=IN[0]
listD2=IN[1]
listD3=IN[2]
organizedL3=[]
organizedL1=[]
organizedL2=[]
# Place your code below this line
for (x,y,z) in zip(listD1,listD2,listD3):
	if x == None:
		x=""
	organizedL1.append(x)
	if y == None:
		y=""
	organizedL2.append(y)
	if z == None:
		z=""
	organizedL3.append(y)
# Assign your output to the OUT variable.
OUT = [organizedL3,organizedL1,organizedL2]
# ----------------------------------------
outsideArea = List.FirstItem(list=python_script_2)
outsideName = List.FirstItem(list=python_script_2)
valueAtKey_4 = DesignScript.Builtin.Dictionary.ValueAtKey(dictionary=python_script, key=string_9)
string_13 = StringInput("SuiteType")
valueAtKey_5 = DesignScript.Builtin.Dictionary.ValueAtKey(dictionary=python_script, key=string_13)
string_14 = StringInput("SuiteID")
valueAtKey_6 = DesignScript.Builtin.Dictionary.ValueAtKey(dictionary=python_script, key=string_14)
select_the_suite_area_element = ElementById(Id=valueAtKey_6)
outsideID = CodeBlock(lista=python_script_2) { i=lista[1]; }
select_the_outside_area_element = ElementById(Id=outsideID)
string_15 = StringInput("SuiteArea")
suite_area_metric = DesignScript.Builtin.Dictionary.ValueAtKey(dictionary=python_script, key=string_15)

# group: Modify Views
create_view_name = CodeBlock(preFix=string_8, level=level_name, munNumber=valueAtKey_4, viewName=valueAtKey_5)
# ---------- create_view_name.designscript (10 lines) ----------
nameSales=preFix+
" - "+level+
" - Suite "
+munNumber+
" ("+viewName+")";
namePurchaser=preFix+
" - "+level+
" - Suite "
+munNumber+
" ("+viewName+") - Purchaser";
# ----------------------------------------
string_16 = StringInput("Duplicate")
views_sales = archilab.Revit.Views.Views.Duplicate(view=currentview, name=create_view_name.nameSales, options=string_16)
setViewTemplate = archilab.Revit.Views.Views.SetViewTemplate(view=views_sales, viewTemplate=code_block_3.a)
string_17 = StringInput("Schedule C1")
code_block_4 = CodeBlock(viewNumber=valueAtKey_4, viewName=valueAtKey_5)
# ---------- code_block_4.designscript (4 lines) ----------
numS="Suite "+viewNumber+
" ("+viewName+") Sales";
numP="Suite "+viewNumber+
" ("+viewName+") Purchaser";
# ----------------------------------------
family_types = FamilyTypes("KAP-Titleblock-Marketing-Schedule A-8.5x14*:Marketing Schedule A")
views_purchaser = archilab.Revit.Views.Views.Duplicate(view=currentview, name=create_view_name.namePurchaser, options=string_16)
setViewTemplate_2 = archilab.Revit.Views.Views.SetViewTemplate(view=views_purchaser, viewTemplate=code_block_3.a)

# group: Get Boundary to crop views
ʳʰʸᵗʰᵐ_areas_suite = Rhythm.Revit.Elements.Areas.OuterBoundary(area=select_the_suite_area_element)
ʳʰʸᵗʰᵐ_areas_balcony_terrace = Rhythm.Revit.Elements.Areas.OuterBoundary(area=select_the_outside_area_element)
list_create_3 = List.Create(item0=ʳʰʸᵗʰᵐ_areas_suite, item1=ʳʰʸᵗʰᵐ_areas_balcony_terrace)
transpose_2 = List.Transpose(lists=list_create_3)
firstItem = List.FirstItem(list=transpose_2@L2)
byPatch = Surface.ByPatch(closedCurve=firstItem)
lastItem = List.LastItem(list=transpose_2@L2)
byPatch_2 = Surface.ByPatch(closedCurve=lastItem)
list_create_4 = List.Create(item0=byPatch, item1=byPatch_2)
transpose_3 = List.Transpose(lists=list_create_4)
simplify_list_for_null = Python(IN[0]=transpose_3)
# ---------- simplify_list_for_null.python (21 lines) ----------
# Load the Python Standard and DesignScript Libraries
import sys
import clr
clr.AddReference('ProtoGeometry')
from Autodesk.DesignScript.Geometry import *

# The inputs to this node will be stored as a list in the IN variables.
dataEnteringNode = IN
list1=IN[0]
items=[]
# Place your code below this line

for listx in list1:
	result=[]
	for i in listx:
		if i != None:
			result.append(i)
	items.append(result)

# Assign your output to the OUT variable.
OUT = items
# ----------------------------------------
byUnion = Surface.ByUnion(surfaces=simplify_list_for_null)
perimeterCurves = Surface.PerimeterCurves(surface=byUnion)

setCropRegion = Custom[SetCropRegion](view=setViewTemplate, CurvesAsList=perimeterCurves)  # package Data-Shapes; Sets the crop region of a view to a closed polycurve.

# group: Create Keyplan and Dependent Views
string_18 = StringInput("14-KeyPlan")
create_view_name_2 = CodeBlock(preFix=string_18, munNumber=valueAtKey_4, viewName=valueAtKey_5)
# ---------- create_view_name_2.designscript (4 lines) ----------
nameSales=preFix+
" - Suite "
+munNumber+
" ("+viewName+")";
# ----------------------------------------
string_19 = StringInput("Duplicate")
views_sales_2 = archilab.Revit.Views.Views.Duplicate(view=currentview, name=create_view_name_2, options=string_19)
code_block_5 = CodeBlock(name=create_view_name_2) { nameS=name+" Sales"; nameP=name+" Purchaser"; }
string_20 = StringInput("AsDependent")
views_sales_3 = archilab.Revit.Views.Views.Duplicate(view=views_sales_2, name=code_block_5.nameS, options=string_20)
views_purchaser_2 = archilab.Revit.Views.Views.Duplicate(view=views_sales_2, name=code_block_5.nameP, options=string_20)
setViewTemplate_3 = archilab.Revit.Views.Views.SetViewTemplate(view=views_sales_2, viewTemplate=code_block_3.b)

list_create_5 = List.Create(item0=setViewTemplate, item1=views_sales_3)
transpose_4 = List.Transpose(lists=list_create_5)
byNameNumberTitleBlockAndViews = Sheet.ByNameNumberTitleBlockAndViews(sheetName=string_17, sheetNumber=code_block_4.numS, titleBlockFamilyType=family_types, views=transpose_4)
list_create_6 = List.Create(item0=setViewTemplate_2, item1=views_purchaser_2)
transpose_5 = List.Transpose(lists=list_create_6)
byNameNumberTitleBlockAndViews_2 = Sheet.ByNameNumberTitleBlockAndViews(sheetName=string_17, sheetNumber=code_block_4.numP, titleBlockFamilyType=family_types, views=transpose_5)

# group: Area of Suite/Outside
areas_matric = List.Create(item0=suite_area_metric, item1=valueAtKey_2)
python_script_3 = Python(IN[0]=areas_matric)
# ---------- python_script_3.python (24 lines) ----------
# Load the Python Standard and DesignScript Libraries
import sys
import clr
clr.AddReference('ProtoGeometry')
from Autodesk.DesignScript.Geometry import *

# The inputs to this node will be stored as a list in the IN variables.
dataEnteringNode = IN
list1=IN[0]
resultList=[]

# Place your code below this line
for lists in list1:
	results=[]
	for i in lists:
		if i == None:
			result=0
		else:
			result=i
		results.append(result)
	resultList.append(results)
# Assign your output to the OUT variable.

OUT = resultList
# ----------------------------------------
transpose_6 = List.Transpose(lists=python_script_3)
code_block_6 = CodeBlock(area=transpose_6)
# ---------- code_block_6.designscript (4 lines) ----------
areaImp=Math.Ceiling
(area*10.7639);
areaMat=Math.Ceiling
(area);
# ----------------------------------------
suit_area_matric = List.FirstItem(list=code_block_6.areaMat@L2)
imperial_area = FromObject(obj=code_block_6.areaImp)
metric_area = FromObject(obj=code_block_6.areaImp)
suite_area = List.FirstItem(list=code_block_6.areaImp@L2)
code_block_7 = CodeBlock(a=suite_area, b=suit_area_matric) { suiteArea= a + " SQft/" +b+" SQM"; }
terrace_area_metric = List.LastItem(list=code_block_6.areaMat@L2)
terrace_area = List.LastItem(list=code_block_6.areaImp@L2)
code_block_8 = CodeBlock(a=terrace_area, b=terrace_area_metric) { outsideArea= a + " SQft/" +b+" SQM"; }

# group: Set Sheet Parameters
list_create_7 = List.Create(item0=byNameNumberTitleBlockAndViews, item1=byNameNumberTitleBlockAndViews_2)
code_block_9 = CodeBlock { "Sheets: Category"; "14 MARKETING"; "Sheets: Subcategory"; "C1 Sales"; "C1 Purchaser"; }
ʳʰʸᵗʰᵐ_sheets_category = Rhythm.Revit.Elements.Elements.SetParameterByNameTypeOrInstance(element=list_create_7@L2, parameterName=code_block_9.out0, value=code_block_9.out1)
ʳʰʸᵗʰᵐ_sheets_subcategory_sales = Rhythm.Revit.Elements.Elements.SetParameterByNameTypeOrInstance(element=byNameNumberTitleBlockAndViews@L2, parameterName=code_block_9.out2, value=code_block_9.out3)
ʳʰʸᵗʰᵐ_sheets_subcategory = Rhythm.Revit.Elements.Elements.SetParameterByNameTypeOrInstance(element=byNameNumberTitleBlockAndViews_2@L2, parameterName=code_block_9.out2, value=code_block_9.out4)  # "ʳʰʸᵗʰᵐ|Sheets SubCategory - Purchaser"
list_create_8 = List.Create(item0=byNameNumberTitleBlockAndViews, item1=byNameNumberTitleBlockAndViews_2)
string_21 = StringInput("Sheets: Marketing Suite Name")
list_create_9 = List.Create(item0=valueAtKey_4, item1=valueAtKey_4)
marketing_suite_name_mun_number = Rhythm.Revit.Elements.Elements.SetParameterByNameTypeOrInstance(element=list_create_8@L2, parameterName=string_21, value=list_create_9@L2)
list_create_10 = List.Create(item0=byNameNumberTitleBlockAndViews, item1=byNameNumberTitleBlockAndViews_2)
string_22 = StringInput("Sheets: Type of Suite")
list_create_11 = List.Create(item0=valueAtKey_5, item1=valueAtKey_5)
ʳʰʸᵗʰᵐ_suite_type = Rhythm.Revit.Elements.Elements.SetParameterByNameTypeOrInstance(element=list_create_10@L2, parameterName=string_22, value=list_create_11@L2)
sales_purchaser_list = List.Create(item0=byNameNumberTitleBlockAndViews, item1=byNameNumberTitleBlockAndViews_2)
string_23 = StringInput("Sheets: Suite Area")
list_create_12 = List.Create(item0=suit_area_matric, item1=suit_area_matric)
ʳʰʸᵗʰᵐ_sheets_area_suite = Rhythm.Revit.Elements.Elements.SetParameterByNameTypeOrInstance(element=sales_purchaser_list@L2, parameterName=string_23, value=list_create_12@L2)
sales_purchaser_list_2 = List.Create(item0=byNameNumberTitleBlockAndViews, item1=byNameNumberTitleBlockAndViews_2)
string_24 = StringInput("Sheets: Terrace Area")
list_create_13 = List.Create(item0=terrace_area_metric, item1=terrace_area_metric)
ʳʰʸᵗʰᵐ_sheets_area_outside = Rhythm.Revit.Elements.Elements.SetParameterByNameTypeOrInstance(element=sales_purchaser_list_2@L2, parameterName=string_24, value=list_create_13@L2)

setCropRegion_2 = Custom[SetCropRegion](view=setViewTemplate_2, CurvesAsList=perimeterCurves)
byCurves = FilledRegion.ByCurves(view=views_sales_3, boundary=perimeterCurves, regionType=code_block_3.c)
byCurves_2 = FilledRegion.ByCurves(view=views_purchaser_2, boundary=perimeterCurves, regionType=code_block_3.c)
