# Dynamo graph createviews-script.dyn (Dynamo 2.3.2.15696)
# packages: Data-Shapes 2022.2.105, SvN Packages 0.0.1, Clockwork for Dynamo 2.x 2.4.0

svn_logo = Custom[SvN - Logo]()  # package SvN Packages; Black and White Logo
code_block = CodeBlock { "Choose an AreaScheme"; 100; }
element_types = ElementTypes("AreaScheme")
all_elements_of_type = ElementsOfType(element_type=element_types)
code_block_2 = CodeBlock(i=all_elements_of_type) { i.Name; }
listview_data = Custom[Listview Data](InputName=code_block.out0, Keys=code_block_2, Values=all_elements_of_type, Height_optionnal=code_block.out1)  # package Data-Shapes; Create data for ListView input in UI.MultiInputForm ++ . Check out www.data-shapes.net for more infos.
code_block_3 = CodeBlock()
# ---------- code_block_3.designscript (2 lines) ----------
["RCP",
"Floor Plan"];
# ----------------------------------------
boolean_input = Custom[Boolean input](InputName=code_block_3)  # package Data-Shapes; Creates a boolean input for UI.MultipleInputForm ++ . Check out www.data-shapes.net for more infos!
code_block_4 = CodeBlock { "Choose an level"; 300; }
categories = Categories("OST_Levels")
all_elements_of_category = ElementsOfCategory(Category=categories)
name = Level.Name(level=all_elements_of_category)
listview_data_2 = Custom[Listview Data](InputName=code_block_4.out0, Keys=name, Values=all_elements_of_category, Height_optionnal=code_block_4.out1)
list_create = List.Create(item0=listview_data, item1=boolean_input, item2=listview_data_2)
boolean = BoolSelector(true)
code_block_5 = CodeBlock { 800; 600; 150; }
multipleinputform = Custom[MultipleInputForm ++](Logo_optional=svn_logo, Inputs=list_create, Toggle=boolean, MaxHeight_optional=code_block_5.out0, Width_optional=code_block_5.out1, LabelWidth_optional=code_block_5.out2)  # package Data-Shapes; Create a form with multiple inputs. see www.data-shapes.net for tutorials and infos!
code_block_6 = CodeBlock(l=multipleinputform.User_Inputs) { areascheme=l[0]; levels=l[2]; masks=l[1]; }
code_block_7 = CodeBlock(l=code_block_6.masks) { l[0]; l[1]; }
filterByBoolMask = List.FilterByBoolMask(list=code_block_6.levels, mask=code_block_7.out0)
firstItem = List.FirstItem(list=filterByBoolMask.in)
byLevel = CeilingPlanView.ByLevel(level=firstItem, lacing=Longest)
filterByBoolMask_2 = List.FilterByBoolMask(list=code_block_6.levels, mask=code_block_7.out1)
firstItem_2 = List.FirstItem(list=filterByBoolMask_2.in)
byLevel_2 = FloorPlanView.ByLevel(level=firstItem_2, lacing=Longest)
isNotEmpty = Custom[List.IsNotEmpty](seq=code_block_6.areascheme)  # package Clockwork for Dynamo 2.x; Just the inversion of the built-in Is Empty List node.
filterByBoolMask_3 = List.FilterByBoolMask(list=code_block_6.levels, mask=isNotEmpty)
firstItem_3 = List.FirstItem(list=filterByBoolMask_3.in)
firstItem_4 = List.FirstItem(list=code_block_6.areascheme)
byLevelAndAreaScheme = AreaPlanView.ByLevelAndAreaScheme(level=firstItem_3, areaScheme=firstItem_4, lacing=Longest)
code_block_8 = CodeBlock(l=code_block_6.areascheme) { "View Category"; "View Subcategory"; "05 Area"; l[0].Name; }
code_block_9 = CodeBlock { "Type"; }
getParameterValueByName = Element.GetParameterValueByName(element=byLevelAndAreaScheme, parameterName=code_block_9)
name_2 = Element.Name(element=getParameterValueByName)
setParameterByName = Element.SetParameterByName(element=byLevelAndAreaScheme, parameterName=code_block_8.out1, value=name_2)
setParameterByName_2 = Element.SetParameterByName(element=byLevelAndAreaScheme, parameterName=code_block_8.out0, value=code_block_8.out2)
