# Dynamo graph ExportSchedules-script.dyn (Dynamo 2.19.3.6394)
# packages: Data-Shapes 2021.2.94, Crumple 2021.5.27, bimorphNodes 3.0.3, spring nodes 210.1.1, SvN Packages 0.0.1

code_block = CodeBlock { "EXPORT SCHEDULE"; "EXPORT"; "CANCEL"; 900; 600; 200; }
svn_logo = Custom[SvN - Logo]()  # package SvN Packages; Black and White Logo
code_block_2 = CodeBlock { "SCHEDULES"; 400; true; false; }
# note: Custom Node: Crumple v.2021.5.27
schedulesbytype = Custom[© SchedulesByType]()  # package Crumple; Returns all schedules in a document, separated into key and non-key schedules.
name = Element.Name(element=schedulesbytype.schedules)
listview_data = Custom[Listview Data](InputName=code_block_2.out0, Keys=name, Values=schedulesbytype.schedules, Height_optionnal=code_block_2.out1, HilightInView_optionnal=code_block_2.out3, DisplayModeOnly_optionnal=code_block_2.out3, ShowElementCount_optionnal=code_block_2.out3, SortItems_optionnal=code_block_2.out2, ShowId_optionnal=code_block_2.out3)  # package Data-Shapes; Create data for ListView input in UI.MultiInputForm ++ . Check out www.data-shapes.net for more infos.
code_block_3 = CodeBlock { "FILE PATH"; "Select a file..."; }
ꟿ_document_centralpath = Custom[ꟿ Document.CentralPath]()  # package spring nodes; If the document is workshared, the node returns the path to the central document as a string. Otherwise a null value will be returned.
# note: Custom Node: Data-Shapes v.2021.2.94
filepath_data = Custom[FilePath Data](InputName=code_block_3.out0, DefaulPath=ꟿ_document_centralpath, ButtonText=code_block_3.out1)  # package Data-Shapes; Create filepath input for UI.MultipleInputForm ++ . Check out www.data-shapes.net for more infos !
list_create = List.Create(item0=listview_data, item1=filepath_data)
boolean = BoolSelector(true)
multipleinputform = Custom[MultipleInputForm ++](Description_optional=code_block.out0, Logo_optional=svn_logo, ButtonText_optional=code_block.out1, Inputs=list_create, Toggle=boolean, CancelButtonText_optional=code_block.out2, MaxHeight_optional=code_block.out3, Width_optional=code_block.out4, LabelWidth_optional=code_block.out5)  # package Data-Shapes; Create a form with multiple inputs. see www.data-shapes.net for tutorials and infos!
code_block_4 = CodeBlock(out=multipleinputform.User_Inputs) { sched = out[0]; path  = out[1]; }
name_2 = Element.Name(element=code_block_4.sched)
code_block_5 = CodeBlock { false; }
# note: Custom Node: BimorphNodes v.3.0.3
getData = Revit.Schedule.GetData(scheduleView=code_block_4.sched, refresh=code_block_5)
code_block_6 = CodeBlock { 0; }
boolean_2 = BoolSelector(true)
openXMLExportExcel = Data.OpenXMLExportExcel(filePath=code_block_4.path, sheetName=name_2, data=getData, startRow=code_block_6, startColumn=code_block_6, overWrite=boolean_2)
