# Dynamo graph SetName-script.dyn (Dynamo 2.3.2.15696)
# packages: Data-Shapes 2022.2.103, Crumple 2022.5.27, SvN Packages 0.0.1, Clockwork for Dynamo 2.x 2.4.0

current_element = Python()  # unwired: IN[0]
# ---------- current_element.python (41 lines) ----------
import clr

clr.AddReference('RevitAPI')
import Autodesk
from Autodesk.Revit.DB import *

clr.AddReference('RevitServices')
import RevitServices
from RevitServices.Persistence import DocumentManager

doc = DocumentManager.Instance.CurrentDBDocument
uiapp = DocumentManager.Instance.CurrentUIApplication
app = uiapp.Application
uidoc = uiapp.ActiveUIDocument

clr.AddReference('RevitNodes')
import Revit
clr.ImportExtensions(Revit.Elements)

ueWrapper = None
wrappers = clr.GetClrType(Revit.Elements.ElementWrapper).GetMethods()
for w in wrappers:
	if w.ToString().startswith("Revit.Elements.UnknownElement"):
		ueWrapper = w
		break
		
out = []
selectElemId = uidoc.Selection.GetElementIds()
selectElem = [doc.GetElement(xId) for xId in selectElemId]

for i in selectElem:
	try:
		check = Revit.Elements.ElementWrapper.Wrap(i, True)
	except: check = None

	if check is None:
		out.append(ueWrapper.Invoke(None, (i, False)))
	else:
		out.append(i) 

OUT = out
# ----------------------------------------
name = Element.Name(element=current_element)
code_block = CodeBlock { "Replace String"; }
svn_logo = Custom[SvN - Logo]()  # package SvN Packages; Black and White Logo
code_block_2 = CodeBlock { [["Find Text","Replace with"],["Prefix","Suffix"]]; }
textbox_data = Custom[TextBox Data](InputName=code_block_2)  # package Data-Shapes; Create Data for TextBox input in UI.MultipleInputForm ++ . Check out www.data-shapes.net for more informations
code_block_3 = CodeBlock { "Please Select at least ONE element"; }
svn_popupdialog = Custom[SvN - PopupDialog](list=current_element, content=code_block_3)  # package SvN Packages; Dialog box for information
multipleinputform = Custom[MultipleInputForm ++](Description_optional=code_block, Logo_optional=svn_logo, Inputs=textbox_data, Toggle=svn_popupdialog)  # package Data-Shapes; Create a form with multiple inputs. see www.data-shapes.net for tutorials and infos!
code_block_4 = CodeBlock(l=multipleinputform.User_Inputs) { l[0]; l[1]; }
code_block_5 = CodeBlock(l=code_block_4.out0, n=code_block_4.out1) { l[0]; l[1]; n[0]; n[1]; }
replace = String.Replace(str=name, searchFor=code_block_5.out0, replaceWith=code_block_5.out1)
flow_waitfor = Custom[© Flow.WaitFor](data=current_element, waitFor=replace)  # package Crumple; Tells the first input to wait for the second input to arrive, then passes on the first input. Really useful for scripts which have branching paths that rely on their outputs to carry each other forward. Quite a few custom packages have a 'passthrough' or 'waitfor' node. I use these all the time, so find it useful to have them contained in this package also.
setName = Custom[Element.SetName](element=flow_waitfor, name=replace)  # package Clockwork for Dynamo 2.x; Gets the name of a given Revit element
code_block_6 = CodeBlock { "View Name"; }
code_block_7 = CodeBlock(pre=code_block_5.out2, name=replace, suf=code_block_5.out3) { pre+name+suf; }
setParameterByName = Element.SetParameterByName(element=setName.element, parameterName=code_block_6, value=code_block_7)
