# Dynamo graph DeleteSheet-script.dyn (Dynamo 2.16.2.5624)
# packages: archi-lab.net 2022.212.2722, Data-Shapes 2022.2.103, Genius Loci 2021.11.10, archi-lab.net 2023.213.1722, Crumple 2022.5.27, SvN Packages 0.0.1

string = StringInput("Select the sheets to Delete")
# note: Data-shape
svn_logo = Custom[SvN - Logo]()  # package SvN Packages; Black and White Logo
string_2 = StringInput("Confirm Selected")
# note: Crumple
collector_of_views = Custom[Collector of Views]()  # package Genius Loci; Collects all views in the active or given document.
sheetNumber = Sheet.SheetNumber(sheet=collector_of_views.Sheet)
name = Element.Name(element=collector_of_views.Sheet)
code_block = CodeBlock(sNum=sheetNumber, sName=name) { sNum+"-"+sName; }
listview_data = Custom[Listview Data](Keys=code_block, Values=collector_of_views.Sheet)  # package Data-Shapes; Create data for ListView input in UI.MultiInputForm ++ . Check out www.data-shapes.net for more infos.
boolean = BoolSelector(true)
string_3 = StringInput("Cancel")
multipleinputform = Custom[MultipleInputForm ++](Description_optional=string, Logo_optional=svn_logo, ButtonText_optional=string_2, Inputs=listview_data, Toggle=boolean, CancelButtonText_optional=string_3)  # package Data-Shapes; Create a form with multiple inputs. see www.data-shapes.net for tutorials and infos!
code_block_2 = CodeBlock { null; }
if_ = If(test=multipleinputform.Was_Cancelled, true=code_block_2, false=multipleinputform.User_Inputs)
views = Sheet.Views(sheet=if_)
delete = archilab.Revit.Elements.Elements.Delete(element=views)
flow_waitfor = Custom[© Flow.WaitFor](data=if_, waitFor=delete)  # package Crumple; Tells the first input to wait for the second input to arrive, then passes on the first input. Really useful for scripts which have branching paths that rely on their outputs to carry each other forward. Quite a few custom packages have a 'passthrough' or 'waitfor' node. I use these all the time, so find it useful to have them contained in this package also.
delete_2 = archilab.Revit.Elements.Elements.Delete(element=flow_waitfor)
