# Dynamo graph osm-script.dyn (Dynamo 2.18.1.5096)
# packages: Elk 1.1.0, Crumple 2022.5.27, Data-Shapes 2022.2.105, spring nodes 210.1.1, Synthetic 2.0.200209, WWP Packages 0.0.1

# group: Interface
wwp_logo = Custom[WWP - Logo]()  # package WWP Packages; Black and White Logo
code_block = CodeBlock { "Choose the \nOSM File"; }
osm_file = Filename("C:\Users\jtian\Desktop\test\map (1).osm")  # graph input
filepath_data = Custom[FilePath Data](InputName=code_block, DefaulPath=osm_file)  # package Data-Shapes; Create filepath input for UI.MultipleInputForm ++ . Check out www.data-shapes.net for more infos !
code_block_2 = CodeBlock { "Minimum Height(m)"; "4"; "Maximum Height(m)"; "6"; }
boolean = BoolSelector(true)
textbox_data = Custom[TextBox Data](InputName=code_block_2.out0, DefaultText=code_block_2.out1, IsNumberEntry=boolean)  # package Data-Shapes; Create Data for TextBox input in UI.MultipleInputForm ++ . Check out www.data-shapes.net for more informations
textbox_data_2 = Custom[TextBox Data](InputName=code_block_2.out2, DefaultText=code_block_2.out3, IsNumberEntry=boolean)
code_block_3 = CodeBlock { "Choose your Unit"; ["m","mm"]; ["1","1000"]; 1; }
radiobuttons_data = Custom[RadioButtons Data](InputName=code_block_3.out0, Keys=code_block_3.out1, Values=code_block_3.out2, DefaultValueIndex=code_block_3.out3)  # package Data-Shapes; Create radio buttons input for UI.MultipleInputForm ++ .
code_block_4 = CodeBlock { "Revit2022+"; }
boolean_input = Custom[Boolean input](InputName=code_block_4)  # package Data-Shapes; Creates a boolean input for UI.MultipleInputForm ++ . Check out www.data-shapes.net for more infos!
list_create = List.Create(item0=filepath_data, item1=textbox_data, item2=textbox_data_2, item3=radiobuttons_data, item4=boolean_input)
boolean_2 = BoolSelector(true)
multipleinputform = Custom[MultipleInputForm ++](Logo_optional=wwp_logo, Inputs=list_create, Toggle=boolean_2)  # package Data-Shapes; Create a form with multiple inputs. see www.data-shapes.net for tutorials and infos!

# group: Audit User Data
code_block_5 = CodeBlock(l=multipleinputform.User_Inputs) { unit=l[3]; min=l[1]; max=l[2]; }
toNumber = String.ToNumber(string=code_block_5.unit)
code_block_6 = CodeBlock(seed=code_block_5.min, unit1=toNumber, min=code_block_5.min, max=code_block_5.max) { seed*unit1; min*unit1; max*unit1; }

# group: Process OSM Data
code_block_7 = CodeBlock(l=multipleinputform.User_Inputs) { bools=l[4]; }
code_block_8 = CodeBlock(l=multipleinputform.User_Inputs) { l[0]; }
location = Elk.OSM.Location(filePath=code_block_8)
features = Elk.OSM.Features()
code_block_9 = CodeBlock { 5; 9; "*"; }
getItemAtIndex = List.GetItemAtIndex(list=features, index=code_block_9.out0)
# note: Get Building
OSMData = Elk.OSM.OSMData(OSM=location.OSM, File=location.XML, featureType=getItemAtIndex, subTypes=code_block_9.out2)
# note: OSM Geometry
scale = Geometry.Scale(geometry=OSMData.Points, amount=toNumber)
string = StringInput(",")
# note: Cleanup OSM data
join = String.Join(separator=string, string0=OSMData.Keys)
firstItem = List.FirstItem(list=join)

if_ = If(test=code_block_7, true=scale, false=OSMData.Points)

# group (continued): Process OSM Data
byPoints = Polygon.ByPoints(points=if_)
flatten = List.Flatten(list=byPoints)

# group: Create Building with Height
string_2 = StringInput("height:")
contains = String.Contains(string=firstItem, searchFor=string_2)
filterByBoolMask = List.FilterByBoolMask(list=flatten, mask=contains)
ZAxis = Vector.ZAxis()
filterByBoolMask_2 = List.FilterByBoolMask(list=firstItem, mask=contains)
string_3 = StringInput("height:")
split = String.Split(string=filterByBoolMask_2.in, separator0=string_3)
code_block_10 = CodeBlock { 1; ","; }
getItemAtIndex_2 = List.GetItemAtIndex(list=split@L2, index=code_block_10.out0)
code_block_11 = CodeBlock { 1; ","; }
split_2 = String.Split(string=getItemAtIndex_2, separator0=code_block_11.out1)
firstItem_2 = List.FirstItem(list=split_2@L2)
toNumber_2 = String.ToNumber(string=firstItem_2)
convert_to_mm = CodeBlock(num=toNumber_2, unit1=toNumber) { num*unit1; }
extrudeAsSolid = Curve.ExtrudeAsSolid(curve=filterByBoolMask.in, direction=ZAxis, distance=convert_to_mm)

# group: If there is no Height, check Levels
string_4 = StringInput("levels:")
contains_2 = String.Contains(string=filterByBoolMask_2.out, searchFor=string_4)
filterByBoolMask_3 = List.FilterByBoolMask(list=filterByBoolMask.out, mask=contains_2)
ZAxis_2 = Vector.ZAxis()
filterByBoolMask_4 = List.FilterByBoolMask(list=filterByBoolMask_2.out, mask=contains_2)
string_5 = StringInput("levels:")
split_3 = String.Split(string=filterByBoolMask_4.in, separator0=string_5)
code_block_12 = CodeBlock { 1; ","; }
getItemAtIndex_3 = List.GetItemAtIndex(list=split_3@L2, index=code_block_12.out0)
split_4 = String.Split(string=getItemAtIndex_3, separator0=code_block_12.out1)
firstItem_3 = List.FirstItem(list=split_4@L2)
toNumber_3 = String.ToNumber(string=firstItem_3)
code_block_13 = CodeBlock(levels=toNumber_3, unit1=toNumber) { h=((levels-1)*2.95+3.25)*unit1; }
extrudeAsSolid_2 = Curve.ExtrudeAsSolid(curve=filterByBoolMask_3.in, direction=ZAxis_2, distance=code_block_13)
count = List.Count(list=filterByBoolMask_3.out)

math_randomnumbers = Custom[© Math.RandomNumbers](count=count, seed=code_block_6.out0, min=code_block_6.out1, max=code_block_6.out2)  # package Crumple; Generates a list of random numbers between a minimum and maximum value.
extrudeAsSolid_3 = Curve.ExtrudeAsSolid(curve=filterByBoolMask_3.out, direction=ZAxis_2, distance=math_randomnumbers)
list_create_2 = List.Create(item0=extrudeAsSolid, item1=extrudeAsSolid_2, item2=extrudeAsSolid_3)
flatten_2 = List.Flatten(list=list_create_2)
ꟿ_form_bygeometry = Custom[ꟿ Form.ByGeometry](geometry=flatten_2)  # package spring nodes; Convert the input geometry to a Revit Form object. Forms can exist only in the family environment. You can convert complicated solids or surfaces directly into forms. A form can act as a void. Provide either one true boolean value to convert a form into a void. The node's lacing is set to longest by default.
code_block_14 = CodeBlock { Material; }  # unwired: Material
select_material = SelectMaterial("Default Form")
setParameterByName = Element.SetParameterByName(element=ꟿ_form_bygeometry, parameterName=code_block_14, value=select_material.out6)
