# Dynamo graph DuplicateView-script.dyn (Dynamo 2.3.2.15696)
# packages: WWP Packages 0.0.1, Data-Shapes 2022.2.105, archi-lab.net 2020.23.13, spring nodes 210.1.1

boolean = BoolSelector(true)
ꟿ_collect_currentselection = Custom[ꟿ Collect.CurrentSelection](refresh=boolean)  # package spring nodes; Gets the currently selected elements. Connect a boolean switch to refresh the selection.
code_block = CodeBlock { "Replace String"; }
wwp_logo = Custom[WWP - Logo]()  # package WWP Packages; Black and White Logo
code_block_2 = CodeBlock { ["Prefix","Suffix"]; ["","-copy"]; }
textbox_data = Custom[TextBox Data](InputName=code_block_2.out0, DefaultText=code_block_2.out1)  # package Data-Shapes; Create Data for TextBox input in UI.MultipleInputForm ++ . Check out www.data-shapes.net for more informations
code_block_3 = CodeBlock()
# ---------- code_block_3.designscript (8 lines) ----------
"Duplicate Option";
["Duplicate View",
"Duplicate as Dependent",
"Duplicate with Details"];
["Duplicate",
"AsDependent",
"WithDetailing"];
2;
# ----------------------------------------
radiobuttons_data = Custom[RadioButtons Data](InputName=code_block_3.out0, Keys=code_block_3.out1, Values=code_block_3.out2, DefaultValueIndex=code_block_3.out3)  # package Data-Shapes; Create radio buttons input for UI.MultipleInputForm ++ .
list_create = List.Create(item0=textbox_data, item1=radiobuttons_data)
multipleinputform = Custom[MultipleInputForm ++](Description_optional=code_block, Logo_optional=wwp_logo, Inputs=list_create, Toggle=boolean)  # package Data-Shapes; Create a form with multiple inputs. see www.data-shapes.net for tutorials and infos!
code_block_4 = CodeBlock(l=multipleinputform.User_Inputs) { l[0]; l[1]; }
code_block_5 = CodeBlock(l=code_block_4.out0) { l[0]; l[1]; }
name = Element.Name(element=ꟿ_collect_currentselection)
code_block_6 = CodeBlock { "{"; ""; }
replace = String.Replace(str=name, searchFor=code_block_6.out0, replaceWith=code_block_6.out1)
code_block_7 = CodeBlock { "}"; ""; }
replace_2 = String.Replace(str=replace, searchFor=code_block_7.out0, replaceWith=code_block_7.out1)
code_block_8 = CodeBlock(pre=code_block_5.out0, name=replace_2, suff=code_block_5.out1) { pre+name+suff; }
firstItem = List.FirstItem(list=code_block_4.out1)
count = List.Count(list=ꟿ_collect_currentselection)
ofRepeatedItem = List.OfRepeatedItem(item=firstItem, amount=count)
duplicate = archilab.Revit.Views.Views.Duplicate(view=ꟿ_collect_currentselection, name=code_block_8, options=ofRepeatedItem)
removeViewTemplate = archilab.Revit.Views.Views.RemoveViewTemplate(view=duplicate)
code_block_9 = CodeBlock { "View Subcategory"; }
getParameterValueByName = Element.GetParameterValueByName(element=duplicate, parameterName=code_block_9)
code_block_10 = CodeBlock(n=getParameterValueByName, suff=code_block_5.out1) { n+suff; }
setParameterByName = Element.SetParameterByName(element=removeViewTemplate, parameterName=code_block_9, value=code_block_10)
