# Dynamo graph changeparameter-script.dyn (Dynamo 2.3.2.15696)
# packages: spring nodes 210.1.1, Data-Shapes 2022.2.105, SvN Packages 0.0.1

boolean = BoolSelector(true)
ꟿ_collect_currentselection = Custom[ꟿ Collect.CurrentSelection](refresh=boolean)  # package spring nodes; Gets the currently selected elements. Connect a boolean switch to refresh the selection.
svn_logo = Custom[SvN - Logo]()  # package SvN Packages; Black and White Logo
code_block = CodeBlock { [["Source Parameter","Target Parameter"],["Find","Replace"]]; }
code_block_2 = CodeBlock { [["View Name","Title on Sheet"],["",""]]; }
textbox_data = Custom[TextBox Data](InputName=code_block, DefaultText=code_block_2)  # package Data-Shapes; Create Data for TextBox input in UI.MultipleInputForm ++ . Check out www.data-shapes.net for more informations
multipleinputform = Custom[MultipleInputForm ++](Logo_optional=svn_logo, Inputs=textbox_data, Toggle=boolean)  # package Data-Shapes; Create a form with multiple inputs. see www.data-shapes.net for tutorials and infos!
code_block_3 = CodeBlock(l=multipleinputform.User_Inputs) { l[0]; l[1]; }
code_block_4 = CodeBlock(l=code_block_3.out0) { l[0]; l[1]; }
getParameterValueByName = Element.GetParameterValueByName(element=ꟿ_collect_currentselection, parameterName=code_block_4.out0)
code_block_5 = CodeBlock(l=code_block_3.out1) { l[0]; l[1]; }
replace = String.Replace(str=getParameterValueByName, searchFor=code_block_5.out0, replaceWith=code_block_5.out1)
setParameterByName = Element.SetParameterByName(element=ꟿ_collect_currentselection, parameterName=code_block_4.out1, value=replace)
