# Dynamo graph FRRWall-script.dyn (Dynamo 2.19.3.6394)
# packages: Genius Loci 2023.1.23, Crumple 2024.4.3

categories = Categories("OST_Doors")
all_elements_of_category = ElementsOfCategory(Category=categories)
elements_group = Custom[© Elements.Group](elements=all_elements_of_category)  # package Crumple; Returns if an element belongs to a group, and the group itself if it has one.
filterByBoolMask = List.FilterByBoolMask(list=all_elements_of_category, mask=elements_group.isInGroup)
code_block = CodeBlock { "FRR Walls"; }
element_host = Custom[Element Host](element=filterByBoolMask.out)  # package Genius Loci; Gets the host of the element. Unlike the OOTB node FamilyInstance.GetHost, it also works for elements hosted by a linked document, wall sweeps, foundations, railings and builing pads. Based on a Clockwork's node
frr_wall_parameter_prompt = Python()  # CPython3; unwired: IN[0]
# ---------- frr_wall_parameter_prompt.python (50 lines) ----------
import clr
clr.AddReference('System.Windows.Forms')
from System.Windows.Forms import Form, Label, TextBox, Button, DialogResult

# Create a custom input dialog box
class InputDialog(Form):
    def __init__(self, prompt="Enter value:", default_value="FRR Walls"):
        self.Text = "User Input"
        self.Width = 300
        self.Height = 150
        self.StartPosition = 1  # Center the form

        self.label = Label()
        self.label.Text = prompt
        self.label.Top = 10
        self.label.Left = 10
        self.label.Width = 260
        self.Controls.Add(self.label)

        self.textBox = TextBox()
        self.textBox.Text = default_value
        self.textBox.Top = 40
        self.textBox.Left = 10
        self.textBox.Width = 260
        self.Controls.Add(self.textBox)

        self.okButton = Button()
        self.okButton.Text = "OK"
        self.okButton.DialogResult = DialogResult.OK
        self.okButton.Top = 70
        self.okButton.Left = 100
        self.Controls.Add(self.okButton)

        self.AcceptButton = self.okButton  # Pressing Enter will confirm the input

    def get_value(self):
        return self.textBox.Text

# Run the dialog and get user input
dialog = InputDialog("What is the name of the Instance Parameter associated with your walls?")
result = dialog.ShowDialog()

# Output the value if OK was clicked
if result == DialogResult.OK:
    output = dialog.get_value()
else:
    output = None  # If the user cancels, return None

# Dynamo Output
OUT = output
# ----------------------------------------
getParameterValueByName = Element.GetParameterValueByName(element=element_host, parameterName=frr_wall_parameter_prompt)
setParameterByName = Element.SetParameterByName(element=filterByBoolMask.out, parameterName=code_block, value=getParameterValueByName)
code_block_2 = CodeBlock { "STC Walls"; }
getParameterValueByName_2 = Element.GetParameterValueByName(element=element_host, parameterName=code_block_2)
setParameterByName_2 = Element.SetParameterByName(element=filterByBoolMask.out, parameterName=code_block_2, value=getParameterValueByName_2)
