# Dynamo graph CreateMarketingPlan(tranditional)-script.dyn "CreateMarketingPlan-script" (Dynamo 2.6.2.15705)
# packages: Crumple 2022.2.13, Rhythm 2022.1.5, archi-lab.net 2022.212.2722, Data-Shapes 2022.2.103, spring nodes 210.1.1

boolean = BoolSelector(true)
currentview = Custom[© CurrentView](refresh=boolean)  # package Crumple; Given the current document, return the active view.

# group: Apply Template
viewtemplates = Custom[© ViewTemplates]()  # package Crumple; Returns all view templates in a document. Due to API/Dynamo limitations, 3D view templates are excluded from the list.
name = Element.Name(element=viewtemplates)
code_block = CodeBlock { "Marketing"; }
contains = String.Contains(str=name, searchFor=code_block)
filterByBoolMask = List.FilterByBoolMask(list=viewtemplates, mask=contains)
ꟿ_list_dropdown = Custom[ꟿ List.DropDown](list=filterByBoolMask.in)  # package spring nodes; Selects one list item by a drop-down combo box. The optional names input will override the object representation.

currentselection = Custom[© CurrentSelection](refresh=boolean)  # package Crumple; Returns all elements currently selected by the user in the active document when this node ran.
string = StringInput("Name")
getParameterValueByName = Element.GetParameterValueByName(element=currentselection, parameterName=string)
code_block_2 = CodeBlock { ["Terrace","Balcony"]; }
python_script = Python(IN[0]=getParameterValueByName, IN[1]=code_block_2)
# ---------- python_script.python (22 lines) ----------
# Load the Python Standard and DesignScript Libraries
import sys
import clr
clr.AddReference('ProtoGeometry')
from Autodesk.DesignScript.Geometry import *

# The inputs to this node will be stored as a list in the IN variables.
dataEnteringNode = IN
listArea=IN[0]
filter=IN[1]
result=[]

for i in listArea:
	if i in filter:
		ans=False
	else:
		ans=True
	result.append(ans)
# Place your code below this line

# Assign your output to the OUT variable.
OUT = result
# ----------------------------------------
filterByBoolMask_2 = List.FilterByBoolMask(list=currentselection, mask=python_script)
string_2 = StringInput("Areas: Municipal Number")
getParameterValueByName_2 = Element.GetParameterValueByName(element=filterByBoolMask_2.in, parameterName=string_2)
string_3 = StringInput("Name")

# group: Duplicate Views
name_2 = Element.Name(element=ꟿ_list_dropdown)
level_name = Element.Name(element=currentview)
getParameterValueByName_3 = Element.GetParameterValueByName(element=filterByBoolMask_2.in, parameterName=string_3)
code_block_3 = CodeBlock(preFix=name_2, level=level_name, viewNumber=getParameterValueByName_2, viewName=getParameterValueByName_3)
# ---------- code_block_3.designscript (10 lines) ----------
nameSales=preFix+
" - "+level+
" - Suite "
+viewNumber+
" ("+viewName+")";
namePurchaser=preFix+
" - "+level+
" - Suite "
+viewNumber+
" ("+viewName+") - Purchaser";
# ----------------------------------------
string_4 = StringInput("Duplicate")
duplicate = archilab.Revit.Views.Views.Duplicate(view=currentview, name=code_block_3.nameSales, options=string_4)
boolean_2 = BoolSelector(true)
cropView = archilab.Revit.Views.Views.CropView(view=duplicate, crop=boolean_2)

setViewTemplate = archilab.Revit.Views.Views.SetViewTemplate(view=cropView, viewTemplate=ꟿ_list_dropdown)
ʳʰʸᵗʰᵐ_areas_outerboundary = Rhythm.Revit.Elements.Areas.OuterBoundary(area=filterByBoolMask_2.in)
curves = PolyCurve.Curves(polyCurve=ʳʰʸᵗʰᵐ_areas_outerboundary)
setCropRegion = Custom[SetCropRegion](view=setViewTemplate, CurvesAsList=curves)  # package Data-Shapes; Sets the crop region of a view to a closed polycurve.
string_5 = StringInput("Schedule C1")
code_block_4 = CodeBlock(viewNumber=getParameterValueByName_2, viewName=getParameterValueByName_3)
# ---------- code_block_4.designscript (4 lines) ----------
nameSales="Suite "+viewNumber+
" ("+viewName+")";
namePurchaser="Suite "+viewNumber+
" ("+viewName+") Purchaser";
# ----------------------------------------
family_types = FamilyTypes("KAP-Titleblock-Marketing-Schedule A-8.5x14*:Marketing Schedule A")
byNameNumberTitleBlockAndView = Sheet.ByNameNumberTitleBlockAndView(sheetName=string_5, sheetNumber=code_block_4.nameSales, titleBlockFamilyType=family_types, view=setViewTemplate)
duplicate_2 = archilab.Revit.Views.Views.Duplicate(view=currentview, name=code_block_3.namePurchaser, options=string_4)
cropView_2 = archilab.Revit.Views.Views.CropView(view=duplicate_2, crop=boolean_2)
setViewTemplate_2 = archilab.Revit.Views.Views.SetViewTemplate(view=cropView_2, viewTemplate=ꟿ_list_dropdown)
byNameNumberTitleBlockAndView_2 = Sheet.ByNameNumberTitleBlockAndView(sheetName=string_5, sheetNumber=code_block_4.namePurchaser, titleBlockFamilyType=family_types, view=setViewTemplate_2)
list_create = List.Create(item0=byNameNumberTitleBlockAndView, item1=byNameNumberTitleBlockAndView_2)
code_block_5 = CodeBlock { "Sheets: Category"; "14 MARKETING"; "Sheets: Subcategory"; "C1 Sales"; "C1 Purchaser"; }
ʳʰʸᵗʰᵐ_elements = Rhythm.Revit.Elements.Elements.SetParameterByNameTypeOrInstance(element=list_create, parameterName=code_block_5.out0, value=code_block_5.out1)
ʳʰʸᵗʰᵐ_elements_2 = Rhythm.Revit.Elements.Elements.SetParameterByNameTypeOrInstance(element=byNameNumberTitleBlockAndView, parameterName=code_block_5.out2, value=code_block_5.out3)
ʳʰʸᵗʰᵐ_elements_3 = Rhythm.Revit.Elements.Elements.SetParameterByNameTypeOrInstance(element=byNameNumberTitleBlockAndView_2, parameterName=code_block_5.out2, value=code_block_5.out4)
setCropRegion_2 = Custom[SetCropRegion](view=setViewTemplate_2, CurvesAsList=curves)
string_6 = StringInput("Sheets: Marketing Suite Name")
ʳʰʸᵗʰᵐ_elements_4 = Rhythm.Revit.Elements.Elements.SetParameterByNameTypeOrInstance(element=byNameNumberTitleBlockAndView_2, parameterName=string_6, value=getParameterValueByName_2)
string_7 = StringInput("Sheets: Type of Suite")
ʳʰʸᵗʰᵐ_elements_5 = Rhythm.Revit.Elements.Elements.SetParameterByNameTypeOrInstance(element=byNameNumberTitleBlockAndView_2, parameterName=string_7, value=getParameterValueByName_3)
ʳʰʸᵗʰᵐ_elements_6 = Rhythm.Revit.Elements.Elements.SetParameterByNameTypeOrInstance(element=byNameNumberTitleBlockAndView, parameterName=string_6, value=getParameterValueByName_2)
ʳʰʸᵗʰᵐ_elements_7 = Rhythm.Revit.Elements.Elements.SetParameterByNameTypeOrInstance(element=byNameNumberTitleBlockAndView, parameterName=string_7, value=getParameterValueByName_3)
ʳʰʸᵗʰᵐ_elements_8 = Rhythm.Revit.Elements.Elements.SetParameterByNameTypeOrInstance(element=byNameNumberTitleBlockAndView, parameterName=string_7, value=getParameterValueByName_3)
string_8 = StringInput("Sheets: Client Area")
string_9 = StringInput("Area")
getParameterValueByName_4 = Element.GetParameterValueByName(element=filterByBoolMask_2.in, parameterName=string_9)
code_block_6 = CodeBlock(areaMet=getParameterValueByName_4) { areaImp=areaMet*10.7639; }
string_from_object = FromObject(obj=code_block_6)
ʳʰʸᵗʰᵐ_elements_9 = Rhythm.Revit.Elements.Elements.SetParameterByNameTypeOrInstance(element=byNameNumberTitleBlockAndView_2, parameterName=string_8, value=string_from_object)
