# Dynamo graph Marketing-script_purchaser.dyn (Dynamo 2.6.2.15705)
# packages: Crumple 2022.2.13, Rhythm 2022.1.5, archi-lab.net 2022.212.2722, Data-Shapes 2022.2.103, Clockwork for Dynamo 2.x 2.3.0

categories = Categories("OST_Areas")

# group: Current Level and Views
boolean = BoolSelector(false)
currentview = Custom[© CurrentView](refresh=boolean)  # package Crumple; Given the current document, return the active view.
level_name = Element.Name(element=currentview)

all_elements_of_category_in_view = ElementsOfCategoryInView(Category=categories, View=currentview)
string = StringInput("Areas: Municipal Number")
getParameterValueByName = Element.GetParameterValueByName(element=all_elements_of_category_in_view, parameterName=string)

# group: Make Dictionary
groupByKey = List.GroupByKey(list=all_elements_of_category_in_view, keys=getParameterValueByName)
string_2 = StringInput("Name")
getParameterValueByName_2 = Element.GetParameterValueByName(element=groupByKey.groups, parameterName=string_2)
string_3 = StringInput("Area")
getParameterValueByName_3 = Element.GetParameterValueByName(element=groupByKey.groups, parameterName=string_3)
id = Element.Id(element=groupByKey.groups)
list_create = List.Create(item0=groupByKey.unique_keys, item1=getParameterValueByName_2, item2=getParameterValueByName_3, item3=id)
transpose = List.Transpose(lists=list_create)
python_script = Python(IN[0]=transpose)
# ---------- python_script.python (31 lines) ----------
# Load the Python Standard and DesignScript Libraries
import sys
import clr
clr.AddReference('ProtoGeometry')
from Autodesk.DesignScript.Geometry import *

# The inputs to this node will be stored as a list in the IN variables.
dataEnteringNode = IN
unitList=IN[0]
resultList=[]

# Place your code below this line
for i in unitList:
	dictUnit={}
	dictUnit["MunicipalNumber"]=i[0]
	
	for (x,y,z) in zip(i[1],i[2],i[3]):
		
		if x == "Balcony" or x == "Terrace":
			dictUnit["OutsideArea"]=y
			dictUnit["OutsideID"]=z
			dictUnit["OutsideType"]=x
		else:
			dictUnit["SuiteArea"]=y
			dictUnit["SuiteID"]=z
			dictUnit["SuiteType"]=x
	resultList.append(dictUnit)


# Assign your output to the OUT variable.
OUT = resultList
# ----------------------------------------

string_4 = StringInput("Schedule C1")
string_5 = StringInput("MunicipalNumber")

# group: Decode the Dictionary
string_6 = StringInput("OutsideID")
outside_id = DesignScript.Builtin.Dictionary.ValueAtKey(dictionary=python_script, key=string_6)
string_7 = StringInput("OutsideArea")
outside_area = DesignScript.Builtin.Dictionary.ValueAtKey(dictionary=python_script, key=string_7)
string_8 = StringInput("OutsideType")
outside_area_type = DesignScript.Builtin.Dictionary.ValueAtKey(dictionary=python_script, key=string_8)
python_script_2 = Python(IN[0]=outside_id, IN[1]=outside_area, IN[2]=outside_area_type)
# ---------- python_script_2.python (27 lines) ----------
# Load the Python Standard and DesignScript Libraries
import sys
import clr
clr.AddReference('ProtoGeometry')
from Autodesk.DesignScript.Geometry import *

# The inputs to this node will be stored as a list in the IN variables.
dataEnteringNode = IN
listD1=IN[0]
listD2=IN[1]
listD3=IN[2]
organizedL3=[]
organizedL1=[]
organizedL2=[]
# Place your code below this line
for (x,y,z) in zip(listD1,listD2,listD3):
	if x == None:
		x=""
	organizedL1.append(x)
	if y == None:
		y=""
	organizedL2.append(y)
	if z == None:
		z=""
	organizedL3.append(y)
# Assign your output to the OUT variable.
OUT = [organizedL3,organizedL1,organizedL2]
# ----------------------------------------
outsideArea = List.FirstItem(list=python_script_2)
outsideName = List.FirstItem(list=python_script_2)
municipal_number = DesignScript.Builtin.Dictionary.ValueAtKey(dictionary=python_script, key=string_5)
string_9 = StringInput("SuiteType")
suite_types = DesignScript.Builtin.Dictionary.ValueAtKey(dictionary=python_script, key=string_9)
string_10 = StringInput("SuiteArea")
suite_area_metric = DesignScript.Builtin.Dictionary.ValueAtKey(dictionary=python_script, key=string_10)
string_11 = StringInput("SuiteID")
valueAtKey = DesignScript.Builtin.Dictionary.ValueAtKey(dictionary=python_script, key=string_11)
select_the_suite_area_element = ElementById(Id=valueAtKey)
outsideID = CodeBlock(lista=python_script_2) { i=lista[1]; }
select_the_outside_area_element = ElementById(Id=outsideID)

code_block = CodeBlock(viewNumber=municipal_number, viewName=suite_types)
# ---------- code_block.designscript (2 lines) ----------
numP="Suite "+viewNumber+
" ("+viewName+") Purchaser";
# ----------------------------------------
file_path = Filename("R:\Graphics\Logos\New Kirkor Logo\Images\New Logo-01.png")
code_block_2 = CodeBlock { "Confirm"; "Cancel"; }
code_block_3 = CodeBlock { "Choose Suite Template"; }
viewtemplates = Custom[© ViewTemplates]()  # package Crumple; Returns all view templates in a document. Due to API/Dynamo limitations, 3D view templates are excluded from the list.
name = Element.Name(element=viewtemplates)
code_block_4 = CodeBlock { "14"; }
contains = String.Contains(str=name, searchFor=code_block_4)
filterByBoolMask = List.FilterByBoolMask(list=viewtemplates, mask=contains)
name_2 = Element.Name(element=filterByBoolMask.in)
dropdown_data = Custom[DropDown Data](InputName=code_block_3, Keys=name_2, Values=filterByBoolMask.in)  # package Data-Shapes; Create data for DropDown input in UI.MultiInputForm ++ . Check out www.data-shapes.net for more infos.
code_block_5 = CodeBlock { "Choose Keyplan Template"; }
viewtemplates_2 = Custom[© ViewTemplates]()
name_3 = Element.Name(element=viewtemplates_2)
code_block_6 = CodeBlock { "Key Plan"; }
contains_2 = String.Contains(str=name_3, searchFor=code_block_6)
filterByBoolMask_2 = List.FilterByBoolMask(list=viewtemplates_2, mask=contains_2)
name_4 = Element.Name(element=filterByBoolMask_2.in)
dropdown_data_2 = Custom[DropDown Data](InputName=code_block_5, Keys=name_4, Values=filterByBoolMask_2.in)
code_block_7 = CodeBlock { "Choose Titleblock"; }
categories_2 = Categories("OST_TitleBlocks")
all_family_types_of_category = Custom[All Family Types Of Category](category=categories_2)  # package Clockwork for Dynamo 2.x; Gets all family types/symbols of a given category in the model.
name_5 = Element.Name(element=all_family_types_of_category)
code_block_8 = CodeBlock { "C1"; }
contains_3 = String.Contains(str=name_5, searchFor=code_block_8)
filterByBoolMask_3 = List.FilterByBoolMask(list=all_family_types_of_category, mask=contains_3)
name_6 = Element.Name(element=filterByBoolMask_3.in)
dropdown_data_3 = Custom[DropDown Data](InputName=code_block_7, Keys=name_6, Values=filterByBoolMask_3.in)
list_create_2 = List.Create(item0=dropdown_data, item1=dropdown_data_2, item2=dropdown_data_3)
boolean_2 = BoolSelector(true)
multipleinputform = Custom[MultipleInputForm ++](Logo_optional=file_path, ButtonText_optional=code_block_2.out0, Inputs=list_create_2, Toggle=boolean_2, CancelButtonText_optional=code_block_2.out1)  # package Data-Shapes; Create a form with multiple inputs. see www.data-shapes.net for tutorials and infos!
code_block_9 = CodeBlock(l=multipleinputform.User_Inputs) { a=l[0]; b=l[1]; c=l[2]; }
byNameNumberTitleBlock = Sheet.ByNameNumberTitleBlock(sheetName=string_4, sheetNumber=code_block, titleBlockFamilyType=code_block_9.c)

# group: Area of Suite/Outside
areas_matric = List.Create(item0=suite_area_metric, item1=outside_area)
python_script_3 = Python(IN[0]=areas_matric)
# ---------- python_script_3.python (24 lines) ----------
# Load the Python Standard and DesignScript Libraries
import sys
import clr
clr.AddReference('ProtoGeometry')
from Autodesk.DesignScript.Geometry import *

# The inputs to this node will be stored as a list in the IN variables.
dataEnteringNode = IN
list1=IN[0]
resultList=[]

# Place your code below this line
for lists in list1:
	results=[]
	for i in lists:
		if i == None:
			result=0
		else:
			result=i
		results.append(result)
	resultList.append(results)
# Assign your output to the OUT variable.

OUT = resultList
# ----------------------------------------
transpose_2 = List.Transpose(lists=python_script_3)
code_block_10 = CodeBlock(area=transpose_2)
# ---------- code_block_10.designscript (4 lines) ----------
areaImp=Math.Ceiling
(area*10.7639);
areaMat=Math.Ceiling
(area);
# ----------------------------------------
suit_area_matric = List.FirstItem(list=code_block_10.areaMat@L2)
suite_area = List.FirstItem(list=code_block_10.areaImp@L2)
code_block_11 = CodeBlock(a=suite_area, b=suit_area_matric) { suiteArea= a + " SQft/" +b+" SQM"; }
terrace_area_metric = List.LastItem(list=code_block_10.areaMat@L2)
terrace_area = List.LastItem(list=code_block_10.areaImp@L2)
code_block_12 = CodeBlock(a=terrace_area, b=terrace_area_metric) { outsideArea= a + " SQft/" +b+" SQM"; }

# group: Set Sheet Parameters
code_block_13 = CodeBlock { "Sheets: Category"; "14 MARKETING"; "Sheets: Subcategory"; "C1 Sales"; "C1 Purchaser"; }
ʳʰʸᵗʰᵐ_sheets_category = Rhythm.Revit.Elements.Elements.SetParameterByNameTypeOrInstance(element=byNameNumberTitleBlock@L2, parameterName=code_block_13.out0, value=code_block_13.out1)
ʳʰʸᵗʰᵐ_sheets_subcategory = Rhythm.Revit.Elements.Elements.SetParameterByNameTypeOrInstance(element=byNameNumberTitleBlock@L2, parameterName=code_block_13.out2, value=code_block_13.out4)  # "ʳʰʸᵗʰᵐ|Sheets SubCategory - Purchaser"
string_12 = StringInput("Sheets: Marketing Suite Name")
marketing_suite_name_mun_number = Rhythm.Revit.Elements.Elements.SetParameterByNameTypeOrInstance(element=byNameNumberTitleBlock@L2, parameterName=string_12, value=municipal_number@L2)
string_13 = StringInput("Sheets: Type of Suite")
ʳʰʸᵗʰᵐ_suite_type = Rhythm.Revit.Elements.Elements.SetParameterByNameTypeOrInstance(element=byNameNumberTitleBlock@L2, parameterName=string_13, value=suite_types@L2)
string_14 = StringInput("Sheets: Suite Area")
ʳʰʸᵗʰᵐ_sheets_area_suite = Rhythm.Revit.Elements.Elements.SetParameterByNameTypeOrInstance(element=byNameNumberTitleBlock@L2, parameterName=string_14, value=suit_area_matric@L2)
string_15 = StringInput("Sheets: Terrace Area")
ʳʰʸᵗʰᵐ_sheets_area_outside = Rhythm.Revit.Elements.Elements.SetParameterByNameTypeOrInstance(element=byNameNumberTitleBlock@L2, parameterName=string_15, value=terrace_area_metric@L2)

create_view_name = CodeBlock(level=level_name, munNumber=municipal_number, viewName=suite_types)
# ---------- create_view_name.designscript (4 lines) ----------
namePurchaser=level+
" - Suite "
+munNumber+
" ("+viewName+") - Purchaser";
# ----------------------------------------
string_16 = StringInput("Duplicate")
views_purchaser = archilab.Revit.Views.Views.Duplicate(view=currentview, name=create_view_name, options=string_16)
setViewTemplate = archilab.Revit.Views.Views.SetViewTemplate(view=views_purchaser, viewTemplate=code_block_9.a)

# group: Get Boundary to crop views
ʳʰʸᵗʰᵐ_areas_suite = Rhythm.Revit.Elements.Areas.OuterBoundary(area=select_the_suite_area_element)
ʳʰʸᵗʰᵐ_areas_balcony_terrace = Rhythm.Revit.Elements.Areas.OuterBoundary(area=select_the_outside_area_element)
list_create_3 = List.Create(item0=ʳʰʸᵗʰᵐ_areas_suite, item1=ʳʰʸᵗʰᵐ_areas_balcony_terrace)
transpose_3 = List.Transpose(lists=list_create_3)
firstItem = List.FirstItem(list=transpose_3@L2)
byPatch = Surface.ByPatch(closedCurve=firstItem)
lastItem = List.LastItem(list=transpose_3@L2)
byPatch_2 = Surface.ByPatch(closedCurve=lastItem)
list_create_4 = List.Create(item0=byPatch, item1=byPatch_2)
transpose_4 = List.Transpose(lists=list_create_4)
simplify_list_for_null = Python(IN[0]=transpose_4)
# ---------- simplify_list_for_null.python (21 lines) ----------
# Load the Python Standard and DesignScript Libraries
import sys
import clr
clr.AddReference('ProtoGeometry')
from Autodesk.DesignScript.Geometry import *

# The inputs to this node will be stored as a list in the IN variables.
dataEnteringNode = IN
list1=IN[0]
items=[]
# Place your code below this line

for listx in list1:
	result=[]
	for i in listx:
		if i != None:
			result.append(i)
	items.append(result)

# Assign your output to the OUT variable.
OUT = items
# ----------------------------------------
byUnion = Surface.ByUnion(surfaces=simplify_list_for_null)
perimeterCurves = Surface.PerimeterCurves(surface=byUnion)

setCropRegion = Custom[SetCropRegion](view=setViewTemplate, CurvesAsList=perimeterCurves)  # package Data-Shapes; Sets the crop region of a view to a closed polycurve.

# group: Create Keyplan and Dependent Views
create_view_name_2 = CodeBlock(munNumber=municipal_number, viewName=suite_types) { nameSales="14-KeyPlan-Suite "+ munNumber +" ("+viewName+")"; }
string_17 = StringInput("Duplicate")
views_purchaser_2 = archilab.Revit.Views.Views.Duplicate(view=currentview, name=create_view_name_2, options=string_17)
setViewTemplate_2 = archilab.Revit.Views.Views.SetViewTemplate(view=views_purchaser_2, viewTemplate=code_block_9.b)

# group: Filled Region for Keyplans
element_types = ElementTypes("FilledRegionType")
all_elements_of_type = ElementsOfType(element_type=element_types)
name_7 = Element.Name(element=all_elements_of_type)
string_18 = StringInput("Solid Grey 1")
eq = name_7 == string_18
filterByBoolMask_4 = List.FilterByBoolMask(list=all_elements_of_type, mask=eq)
firstItem_2 = List.FirstItem(list=filterByBoolMask_4.in)
byCurves = FilledRegion.ByCurves(view=views_purchaser_2, boundary=perimeterCurves, regionType=firstItem_2)

list_create_5 = List.Create(item0=setViewTemplate, item1=views_purchaser_2)
transpose_5 = List.Transpose(lists=list_create_5)
code_block_14 = CodeBlock { 108; 255; 0; }
view_location = Point.ByCoordinates(x=code_block_14.out0, y=code_block_14.out1, z=code_block_14.out2)
code_block_15 = CodeBlock { 53; 105; 0; }
byCoordinates = Point.ByCoordinates(x=code_block_15.out0, y=code_block_15.out1, z=code_block_15.out2)
list_create_6 = List.Create(item0=view_location, item1=byCoordinates)
set_sheet_with_views_and = Python(IN[0]=byNameNumberTitleBlock, IN[1]=transpose_5, IN[2]=list_create_6)  # "Set Sheet with Views and location"
# ---------- set_sheet_with_views_and.python (51 lines) ----------
#python nodes in dynamo 1.2
#edited by Jason Tian

import clr
clr.AddReference('ProtoGeometry')
from Autodesk.DesignScript.Geometry import *
# Import ToDSType(bool) extension method
clr.AddReference("RevitNodes")
import Revit
clr.ImportExtensions(Revit.Elements)
# Import geometry conversion extension methods
clr.ImportExtensions(Revit.GeometryConversion)
# Import DocumentManager and TransactionManager
clr.AddReference("RevitServices")
import RevitServices
from RevitServices.Persistence import DocumentManager
from RevitServices.Transactions import TransactionManager
from System.Collections.Generic import *
# Import RevitAPI
clr.AddReference("RevitAPI")
import Autodesk
from Autodesk.Revit.DB import *

doc = DocumentManager.Instance.CurrentDBDocument
uiapp = DocumentManager.Instance.CurrentUIApplication
app = uiapp.Application
uidoc=DocumentManager.Instance.CurrentUIApplication.ActiveUIDocument

sheets = []
for i in IN[0]:
	sheets.append(UnwrapElement(i))
views=[]	
for i in IN[1]:
	views.append(UnwrapElement(i))
points=IN[2]

# Start Transaction
TransactionManager.Instance.EnsureInTransaction(doc)
viewport=[]

for (s,view) in zip(sheets,views):
    results=[]
    for (v,p) in zip(view,points):
	    result=Viewport.Create(doc, s.Id, v.Id, p.ToXyz())
	    results.append(result)
    viewport.append(results)

# End Transaction
TransactionManager.Instance.TransactionTaskDone()

OUT=viewport
# ----------------------------------------
