# Dynamo graph Oneunit-script.dyn (Dynamo 2.19.3.6394)
# packages: Rhythm 2022.1.5, archi-lab.net 2022.212.2722, spring nodes 210.1.1, Genius Loci 2021.11.10, Crumple 2022.2.13, Data-Shapes 2022.2.103, Clockwork for Dynamo 2.x 2.3.0, archi-lab.net 2023.213.1722, Crumple 2022.5.27, SvN Packages 0.0.1

boolean = BoolSelector(true)
ꟿ_collect_currentselection = Custom[ꟿ Collect.CurrentSelection](refresh=boolean)  # package spring nodes; Gets the currently selected elements. Connect a boolean switch to refresh the selection.
getCategory = Element.GetCategory(element=ꟿ_collect_currentselection)
string_from_object = FromObject(obj=getCategory)
code_block = CodeBlock { "Areas"; "Doors"; }
eq = string_from_object == code_block.out0
filterByBoolMask = List.FilterByBoolMask(list=ꟿ_collect_currentselection, mask=eq)
check_if_empty = Python(IN[0]=filterByBoolMask.in)  # IronPython2
# ---------- check_if_empty.python (11 lines) ----------
import clr
clr.AddReference('RevitAPIUI')
from Autodesk.Revit.UI import TaskDialog, TaskDialogCommonButtons, TaskDialogResult, TaskDialogCommandLinkId

list1=IN[0]

if list1 == []:
	TaskDialog.Show("Warning","Please pick areas first.")
	OUT = False
else:
	OUT = True
# ----------------------------------------
eq_2 = string_from_object == code_block.out1
filterByBoolMask_2 = List.FilterByBoolMask(list=ꟿ_collect_currentselection, mask=eq_2)
check_if_empty_2 = Python(IN[0]=filterByBoolMask_2.in)  # IronPython2
# ---------- check_if_empty_2.python (11 lines) ----------
import clr
clr.AddReference('RevitAPIUI')
from Autodesk.Revit.UI import TaskDialog, TaskDialogCommonButtons, TaskDialogResult, TaskDialogCommandLinkId

list1=IN[0]

if list1 == []:
	TaskDialog.Show("Warning","Please pick a door for the angle.")
	OUT = False
else:
	OUT = True
# ----------------------------------------
on_off_switch = And(bool0=check_if_empty, bool1=check_if_empty_2)

# group: Current View and Level
boolean_2 = BoolSelector(false)
currentview = Custom[© CurrentView](refresh=boolean_2)  # package Crumple; Given the current document, return the active view.
removeViewTemplate = archilab.Revit.Views.Views.RemoveViewTemplate(view=currentview)
string = StringInput("Associated Level")
getParameterValueByName = Element.GetParameterValueByName(element=removeViewTemplate, parameterName=string)
view_level = Custom[View Level](view=removeViewTemplate)  # package Genius Loci; Returns the level to which a view is associated.
name = Level.Name(level=view_level)

string_2 = StringInput("Unit Type")
getParameterValueByName_2 = Element.GetParameterValueByName(element=filterByBoolMask.in, parameterName=string_2)
area_of_balcony_terrace_patio = Python(IN[0]=getParameterValueByName_2)  # IronPython2
# ---------- area_of_balcony_terrace_patio.python (22 lines) ----------
# Load the Python Standard and DesignScript Libraries
import sys
import clr
clr.AddReference('ProtoGeometry')
from Autodesk.DesignScript.Geometry import *

# The inputs to this node will be stored as a list in the IN variables.
dataEnteringNode = IN
names=IN[0]
resultList=[]

if isinstance(names, list):
	for n in names:
		if n == "Terrace" or n == "TERRACE" or n == "Balcony" or n == "BALCONY" or n == "Patio" or n == "PATIO":
			result=False
		else:
			result=True
		resultList.append(result)
else:
	resultList.append(True)
	
OUT = resultList
# ----------------------------------------
filterByBoolMask_3 = List.FilterByBoolMask(list=filterByBoolMask.in, mask=area_of_balcony_terrace_patio)

# group: Suite
string_3 = StringInput("Unit Type")
getParameterValueByName_3 = Element.GetParameterValueByName(element=filterByBoolMask_3.in, parameterName=string_3)
string_4 = StringInput("Area")
suite_area = Element.GetParameterValueByName(element=filterByBoolMask_3.in, parameterName=string_4)
string_5 = StringInput("SvN_Area Parameter")
getParameterValueByName_4 = Element.GetParameterValueByName(element=filterByBoolMask_3.in, parameterName=string_5)
string_6 = StringInput("Name")
suite_name = Element.GetParameterValueByName(element=filterByBoolMask_3.in, parameterName=string_6)

string_7 = StringInput("Number")
getParameterValueByName_5 = Element.GetParameterValueByName(element=filterByBoolMask_3.in, parameterName=string_7)
create_view_name_suite = CodeBlock(level=getParameterValueByName, areaUse=getParameterValueByName_3, mulNum=getParameterValueByName_5)
# ---------- create_view_name_suite.designscript (2 lines) ----------
"10-dyn-"+level
+"-Suite("+areaUse+")-"+mulNum;
# ----------------------------------------
create_view_name_keyplan = CodeBlock(level=getParameterValueByName, areaUse=getParameterValueByName_3, mulNum=getParameterValueByName_5)
# ---------- create_view_name_keyplan.designscript (2 lines) ----------
"10-dyn-KeyPlan-"
+level+"Suite("+areaUse+")-"+mulNum;
# ----------------------------------------

# group: Rename Existing Views
collector_of_views = Custom[Collector of Views]()  # package Genius Loci; Collects all views in the active or given document.
name_2 = Element.Name(element=collector_of_views.View)
contains = String.Contains(string=name_2, searchFor=create_view_name_suite@L1)
flatten = List.Flatten(list=contains)
filterByBoolMask_4 = List.FilterByBoolMask(list=collector_of_views.View, mask=flatten)
string_8 = StringInput("10-dynbak")
contains_2 = String.Contains(string=name_2, searchFor=string_8@L1)
flatten_2 = List.Flatten(list=contains_2)
filterByBoolMask_5 = List.FilterByBoolMask(list=collector_of_views.View, mask=flatten_2)
string_9 = StringInput("")
if_ = RefactoredIf(test=on_off_switch, true=filterByBoolMask_5.in, false=string_9)
delete = archilab.Revit.Elements.Elements.Delete(element=if_)
waitfor = Custom[© WaitFor](data=filterByBoolMask_4.in, waitFor=delete)  # package Crumple; Tells the first input to wait for the second input to arrive, then passes on the first input. Really useful for scripts which have branching paths that rely on their outputs to carry each other forward. Quite a few custom packages have a 'passthrough' or 'waitfor' node. I use these all the time, so find it useful to have them contained in this package also.
string_10 = StringInput("View Name")
ʳʰʸᵗʰᵐ_get_view_name = Rhythm.Revit.Elements.Elements.GetParameterValueByNameTypeOrInstance(element=filterByBoolMask_4.in, parameterName=string_10)
string_11 = StringInput("10-dyn-")
string_12 = StringInput("10-dynbak-")
replace = String.Replace(string=ʳʰʸᵗʰᵐ_get_view_name, searchFor=string_11, replaceWith=string_12)
ʳʰʸᵗʰᵐ_elements = Rhythm.Revit.Elements.Elements.SetParameterByNameTypeOrInstance(element=waitfor, parameterName=string_10, value=replace)
removeViewTemplate_2 = archilab.Revit.Views.Views.RemoveViewTemplate(view=ʳʰʸᵗʰᵐ_elements)
contains_3 = String.Contains(string=name_2, searchFor=create_view_name_keyplan@L1)
flatten_3 = List.Flatten(list=contains_3)
filterByBoolMask_6 = List.FilterByBoolMask(list=collector_of_views.View, mask=flatten_3)
waitfor_2 = Custom[© WaitFor](data=filterByBoolMask_6.in, waitFor=delete)
ʳʰʸᵗʰᵐ_get_view_name_2 = Rhythm.Revit.Elements.Elements.GetParameterValueByNameTypeOrInstance(element=filterByBoolMask_6.in, parameterName=string_10)
replace_2 = String.Replace(string=ʳʰʸᵗʰᵐ_get_view_name_2, searchFor=string_11, replaceWith=string_12)
ʳʰʸᵗʰᵐ_elements_2 = Rhythm.Revit.Elements.Elements.SetParameterByNameTypeOrInstance(element=waitfor_2, parameterName=string_10, value=replace_2)
removeViewTemplate_3 = archilab.Revit.Views.Views.RemoveViewTemplate(view=ʳʰʸᵗʰᵐ_elements_2)
list_create = List.Create(item0=removeViewTemplate_2, item1=removeViewTemplate_3)
string_13 = StringInput("View Subcategory")
string_14 = StringInput("Schedule C1 backups")
ʳʰʸᵗʰᵐ_elements_3 = Rhythm.Revit.Elements.Elements.SetParameterByNameTypeOrInstance(element=list_create@L2, parameterName=string_13, value=string_14)

# group: UI
svn_logo = Custom[SvN - Logo]()  # package SvN Packages; Black and White Logo
code_block_2 = CodeBlock { "Confirm"; "Cancel"; 1000; }
code_block_3 = CodeBlock { "Choose \nSuite Template"; }
viewtemplates = Custom[© ViewTemplates]()  # package Crumple; Returns all view templates in a document. Due to API/Dynamo limitations, 3D view templates are excluded from the list.
name_3 = Element.Name(element=viewtemplates)
code_block_4 = CodeBlock { "SUITE"; }
contains_4 = String.Contains(string=name_3, searchFor=code_block_4)
filterByBoolMask_7 = List.FilterByBoolMask(list=viewtemplates, mask=contains_4)
name_4 = Element.Name(element=filterByBoolMask_7.in)
dropdown_data = Custom[DropDown Data](InputName=code_block_3, Keys=name_4, Values=filterByBoolMask_7.in)  # package Data-Shapes; Create data for DropDown input in UI.MultiInputForm ++ . Check out www.data-shapes.net for more infos.
code_block_5 = CodeBlock { "Choose \nKeyplan Template"; }
viewtemplates_2 = Custom[© ViewTemplates]()
name_5 = Element.Name(element=viewtemplates_2)
code_block_6 = CodeBlock { "KEY"; }
contains_5 = String.Contains(string=name_5, searchFor=code_block_6)
filterByBoolMask_8 = List.FilterByBoolMask(list=viewtemplates_2, mask=contains_5)
name_6 = Element.Name(element=filterByBoolMask_8.in)
dropdown_data_2 = Custom[DropDown Data](InputName=code_block_5, Keys=name_6, Values=filterByBoolMask_8.in)
code_block_7 = CodeBlock { "Choose \nTitleblock"; }
categories = Categories("OST_TitleBlocks")
all_family_types_of_category = Custom[All Family Types Of Category](category=categories)  # package Clockwork for Dynamo 2.x; Gets all family types/symbols of a given category in the model.
family = FamilyType.Family(familyType=all_family_types_of_category)
name_7 = Element.Name(element=family)
code_block_8 = CodeBlock { "titleblock"; true; }
contains_6 = String.Contains(string=name_7, searchFor=code_block_8.out0, ignoreCase=code_block_8.out1)
filterByBoolMask_9 = List.FilterByBoolMask(list=all_family_types_of_category, mask=contains_6)
family_2 = FamilyType.Family(familyType=filterByBoolMask_9.in)
family_name = Element.Name(element=family_2)
type_name = Element.Name(element=filterByBoolMask_9.in)
code_block_9 = CodeBlock(familyName=family_name, typeName=type_name) { familyName+":("+typeName+")"; }
string_15 = StringInput("Family Type:")
code_block_10 = CodeBlock { ""; }
replace_3 = String.Replace(string=code_block_9, searchFor=string_15, replaceWith=code_block_10)
dropdown_data_3 = Custom[DropDown Data](InputName=code_block_7, Keys=replace_3, Values=filterByBoolMask_9.in)
list_create_2 = List.Create(item0=dropdown_data, item1=dropdown_data_2, item2=dropdown_data_3)
multipleinputform = Custom[MultipleInputForm ++](Logo_optional=svn_logo, ButtonText_optional=code_block_2.out0, Inputs=list_create_2, Toggle=on_off_switch, CancelButtonText_optional=code_block_2.out1, Width_optional=code_block_2.out2)  # package Data-Shapes; Create a form with multiple inputs. see www.data-shapes.net for tutorials and infos!
code_block_11 = CodeBlock(l=multipleinputform.User_Inputs) { a=l[0]; b=l[1]; c=l[2]; }

ʳʰʸᵗʰᵐ_areas_suite = Rhythm.Revit.Elements.Areas.OuterBoundary(area=filterByBoolMask_3.in)

# group: Terrace/Balcony/Patio
string_16 = StringInput("Terrace")
boolean_3 = BoolSelector(true)
contains_7 = String.Contains(string=getParameterValueByName_2, searchFor=string_16, ignoreCase=boolean_3)
filterByBoolMask_10 = List.FilterByBoolMask(list=filterByBoolMask.in, mask=contains_7)
string_17 = StringInput("Balcony")
contains_8 = String.Contains(string=getParameterValueByName_2, searchFor=string_17, ignoreCase=boolean_3)
filterByBoolMask_11 = List.FilterByBoolMask(list=filterByBoolMask.in, mask=contains_8)
string_18 = StringInput("Patio")
contains_9 = String.Contains(string=getParameterValueByName_2, searchFor=string_18, ignoreCase=boolean_3)
filterByBoolMask_12 = List.FilterByBoolMask(list=filterByBoolMask.in, mask=contains_9)
string_19 = StringInput("Area")
terrace_area = Element.GetParameterValueByName(element=filterByBoolMask_10.in, parameterName=string_19)
balcony_area = Element.GetParameterValueByName(element=filterByBoolMask_11.in, parameterName=string_19)
patio_area = Element.GetParameterValueByName(element=filterByBoolMask_12.in, parameterName=string_19)

ʳʰʸᵗʰᵐ_areas_terrace = Rhythm.Revit.Elements.Areas.OuterBoundary(area=filterByBoolMask_10.in)
ʳʰʸᵗʰᵐ_areas_balcony = Rhythm.Revit.Elements.Areas.OuterBoundary(area=filterByBoolMask_11.in)
ʳʰʸᵗʰᵐ_areas_patio = Rhythm.Revit.Elements.Areas.OuterBoundary(area=filterByBoolMask_12.in)
list_of_suite_areas = List.Create(item0=ʳʰʸᵗʰᵐ_areas_suite, item1=ʳʰʸᵗʰᵐ_areas_terrace, item2=ʳʰʸᵗʰᵐ_areas_balcony, item3=ʳʰʸᵗʰᵐ_areas_patio)
byPatch = Surface.ByPatch(closedCurve=list_of_suite_areas)
flatten_4 = List.Flatten(list=byPatch)
byUnion = Surface.ByUnion(surfaces=flatten_4)
perimeterCurves = Surface.PerimeterCurves(surface=byUnion)
code_block_12 = CodeBlock(mulNumber=getParameterValueByName_5, areaUse=getParameterValueByName_3)
# ---------- code_block_12.designscript (2 lines) ----------
numP="Suite "+mulNumber+
" ("+areaUse+")";
# ----------------------------------------
string_20 = StringInput("Unit Exterior Area")

# group: Value of Area
areas_matric = List.Create(item0=terrace_area, item1=balcony_area, item2=patio_area)
python_script = Python(IN[0]=areas_matric)  # IronPython2
# ---------- python_script.python (24 lines) ----------
# Load the Python Standard and DesignScript Libraries
import sys
import clr
clr.AddReference('ProtoGeometry')
from Autodesk.DesignScript.Geometry import *

# The inputs to this node will be stored as a list in the IN variables.
dataEnteringNode = IN
list1=IN[0]
resultList=[]

# Place your code below this line
for lists in list1:
	results=[]
	for i in lists:
		if i == None:
			result=0
		else:
			result=i
		results.append(result)
	resultList.append(results)
# Assign your output to the OUT variable.

OUT = resultList
# ----------------------------------------
transpose = List.Transpose(lists=python_script)
terrace = List.FirstItem(list=transpose@L2)
code_block_13 = CodeBlock { 1; }
balcony = List.GetItemAtIndex(list=transpose@L2, index=code_block_13)
patio = List.LastItem(list=transpose@L2)  # frozen

string_21 = StringInput("Unit Area")
string_22 = StringInput("Unit Type")
string_23 = StringInput("SvN_EXTERIOR TYPE")
string_24 = StringInput("Unit Type")
patio_name = Element.GetParameterValueByName(element=filterByBoolMask_3.out, parameterName=string_24)
code_block_14 = CodeBlock { "Print Set"; "MT-MARKETING"; "Sheet Category"; "Suite Area"; }
string_25 = StringInput("Sheets: Floor Number")  # frozen
string_26 = StringInput("Unit Exterior Area")
string_27 = StringInput("Sheets: Patio Area")  # frozen
YAxis = Vector.YAxis()
facingOrientation = FamilyInstance.FacingOrientation(familyInstance=filterByBoolMask_2.in)
ZAxis = Vector.ZAxis()
angleAboutAxis = Vector.AngleAboutAxis(vector=YAxis, otherVector=facingOrientation, rotationAxis=ZAxis)

# group: Make Marketing View/Key Plan
code_block_15 = CodeBlock { null; }
if_2 = RefactoredIf(test=on_off_switch, true=removeViewTemplate, false=code_block_15)
waitfor_3 = Custom[© WaitFor](data=create_view_name_suite, waitFor=ʳʰʸᵗʰᵐ_elements_3)
string_28 = StringInput("Duplicate")
views_suite = archilab.Revit.Views.Views.Duplicate(view=if_2, name=waitfor_3, options=string_28)
waitfor_4 = Custom[© WaitFor](data=create_view_name_keyplan, waitFor=ʳʰʸᵗʰᵐ_elements_3)
views_keyplan = archilab.Revit.Views.Views.Duplicate(view=if_2, name=waitfor_4, options=string_28)
setViewTemplate = archilab.Revit.Views.Views.SetViewTemplate(view=views_keyplan, viewTemplate=code_block_11.b)
angle_from_vector = List.FirstItem(list=angleAboutAxis)
code_block_16 = CodeBlock { "Type"; }
getParameterValueByName_6 = Element.GetParameterValueByName(element=views_suite, parameterName=code_block_16)

# group: Remove Scopebox
string_29 = StringInput("Scope Box")
code_block_17 = CodeBlock { None; }  # unwired: None
setParameterByName = Element.SetParameterByName(element=views_suite, parameterName=string_29, value=code_block_17)

# group (continued): Make Marketing View/Key Plan
flow_waitfor = Custom[© Flow.WaitFor](data=views_suite, waitFor=setParameterByName)  # package Crumple; Tells the first input to wait for the second input to arrive, then passes on the first input. Really useful for scripts which have branching paths that rely on their outputs to carry each other forward. Quite a few custom packages have a 'passthrough' or 'waitfor' node. I use these all the time, so find it useful to have them contained in this package also.
setViewTemplate_2 = archilab.Revit.Views.Views.SetViewTemplate(view=flow_waitfor, viewTemplate=code_block_11.a)
ʳʰʸᵗʰᵐ_view_getcropregionelement = Rhythm.Revit.Views.View.GetCropRegionElement(view=flow_waitfor)
element_setrotation = Custom[Element SetRotation](element=ʳʰʸᵗʰᵐ_view_getcropregionelement, degree=angle_from_vector)  # package Genius Loci; Set the angle of the element around its local Z-axis. (Same as the Rotate command in Revit)

# group: Filled Region for Keyplans
element_types = ElementTypes("FilledRegionType")
all_elements_of_type = ElementsOfType(element_type=element_types)
name_8 = Element.Name(element=all_elements_of_type)
string_30 = StringInput("Solid - Light Grey")
eq_3 = name_8 == string_30
filterByBoolMask_13 = List.FilterByBoolMask(list=all_elements_of_type, mask=eq_3)
firstItem = List.FirstItem(list=filterByBoolMask_13.in)
byCurves = FilledRegion.ByCurves(view=views_keyplan, boundary=perimeterCurves, regionType=firstItem)

list_create_3 = List.Create(item0=perimeterCurves)

# group: Create Sheet if not Existing
string_31 = StringInput("Suite Plan")
byNameNumberTitleBlock = Sheet.ByNameNumberTitleBlock(sheetName=string_31, sheetNumber=code_block_12, titleBlockFamilyType=code_block_11.c)
viewports = archilab.Revit.Views.Sheets.Viewports(sheet=byNameNumberTitleBlock)  # frozen
delete_2 = archilab.Revit.Elements.Elements.Delete(element=viewports)  # frozen
waitfor_5 = Custom[© WaitFor](data=views_suite, waitFor=element_setrotation)
setCropRegion = Custom[SetCropRegion](view=waitfor_5, CurvesAsList=list_create_3)  # package Data-Shapes; Sets the crop region of a view to a closed polycurve.

# group: Assign views to sheet
waitfor_6 = Custom[© WaitFor](data=byNameNumberTitleBlock, waitFor=delete_2)
list_create_4 = List.Create(item0=flow_waitfor, item1=views_keyplan)
transpose_2 = List.Transpose(lists=list_create_4)
code_block_18 = CodeBlock { 0; 0; 0; }
view_location = Point.ByCoordinates(x=code_block_18.out0, y=code_block_18.out1, z=code_block_18.out2)
code_block_19 = CodeBlock { 0; 0; 0; }
keyplan_location = Point.ByCoordinates(x=code_block_19.out0, y=code_block_19.out1, z=code_block_19.out2)
list_create_5 = List.Create(item0=view_location, item1=keyplan_location)
set_sheet_with_views_and = Python(IN[0]=waitfor_6, IN[1]=transpose_2, IN[2]=list_create_5)  # "Set Sheet with Views and location"; IronPython2
# ---------- set_sheet_with_views_and.python (51 lines) ----------
#python nodes in dynamo 1.2
#edited by Jason Tian

import clr
clr.AddReference('ProtoGeometry')
from Autodesk.DesignScript.Geometry import *
# Import ToDSType(bool) extension method
clr.AddReference("RevitNodes")
import Revit
clr.ImportExtensions(Revit.Elements)
# Import geometry conversion extension methods
clr.ImportExtensions(Revit.GeometryConversion)
# Import DocumentManager and TransactionManager
clr.AddReference("RevitServices")
import RevitServices
from RevitServices.Persistence import DocumentManager
from RevitServices.Transactions import TransactionManager
from System.Collections.Generic import *
# Import RevitAPI
clr.AddReference("RevitAPI")
import Autodesk
from Autodesk.Revit.DB import *

doc = DocumentManager.Instance.CurrentDBDocument
uiapp = DocumentManager.Instance.CurrentUIApplication
app = uiapp.Application
uidoc=DocumentManager.Instance.CurrentUIApplication.ActiveUIDocument

sheets = []
for i in IN[0]:
	sheets.append(UnwrapElement(i))
views=[]	
for i in IN[1]:
	views.append(UnwrapElement(i))
points=IN[2]

# Start Transaction
TransactionManager.Instance.EnsureInTransaction(doc)
viewport=[]

for (s,view) in zip(sheets,views):
    results=[]
    for (v,p) in zip(view,points):
	    result=Viewport.Create(doc, s.Id, v.Id, p.ToXyz())
	    results.append(result)
    viewport.append(results)

# End Transaction
TransactionManager.Instance.TransactionTaskDone()

OUT=viewport
# ----------------------------------------

ʳʰʸᵗʰᵐ_sheets_area_outside = Rhythm.Revit.Elements.Elements.SetParameterByNameTypeOrInstance(element=byNameNumberTitleBlock, parameterName=string_20, value=terrace)
ʳʰʸᵗʰᵐ_sheets_area_suite = Rhythm.Revit.Elements.Elements.SetParameterByNameTypeOrInstance(element=byNameNumberTitleBlock, parameterName=string_21, value=suite_area)
ʳʰʸᵗʰᵐ_suite_type = Rhythm.Revit.Elements.Elements.SetParameterByNameTypeOrInstance(element=byNameNumberTitleBlock, parameterName=string_22, value=getParameterValueByName_3)
ʳʰʸᵗʰᵐ_marketing_suite_name_mun = Rhythm.Revit.Elements.Elements.SetParameterByNameTypeOrInstance(element=byNameNumberTitleBlock, parameterName=string_23, value=patio_name)  # "ʳʰʸᵗʰᵐ|Marketing Suite Name(Mun Number)"
ʳʰʸᵗʰᵐ_sheets_subcategory = Rhythm.Revit.Elements.Elements.SetParameterByNameTypeOrInstance(element=byNameNumberTitleBlock, parameterName=code_block_14.out2, value=code_block_14.out3)  # "ʳʰʸᵗʰᵐ|Sheets SubCategory - Purchaser"
ʳʰʸᵗʰᵐ_sheets_category = Rhythm.Revit.Elements.Elements.SetParameterByNameTypeOrInstance(element=byNameNumberTitleBlock, parameterName=code_block_14.out0, value=code_block_14.out1)
ʳʰʸᵗʰᵐ_suite_type_2 = Rhythm.Revit.Elements.Elements.SetParameterByNameTypeOrInstance(element=byNameNumberTitleBlock, parameterName=string_25, value=name)
ʳʰʸᵗʰᵐ_sheets_area_outside_2 = Rhythm.Revit.Elements.Elements.SetParameterByNameTypeOrInstance(element=byNameNumberTitleBlock, parameterName=string_26, value=balcony)
ʳʰʸᵗʰᵐ_suite_type_3 = Rhythm.Revit.Elements.Elements.SetParameterByNameTypeOrInstance(element=byNameNumberTitleBlock, parameterName=string_27, value=patio)
string_32 = StringInput("Sheet Number")
getParameterValueByName_7 = Element.GetParameterValueByName(element=collector_of_views.Sheet, parameterName=string_32)
contains_10 = String.Contains(string=getParameterValueByName_7, searchFor=code_block_12, lacing=Longest)

# group: Rename Existing Sheet
flatten_5 = List.Flatten(list=contains_10)
filterByBoolMask_14 = List.FilterByBoolMask(list=collector_of_views.Sheet, mask=flatten_5)
string_33 = StringInput("Sheet Number")
sheetNumber = Sheet.SheetNumber(sheet=filterByBoolMask_14.in)
string_34 = StringInput("-bak")
code_block_20 = CodeBlock(a=sheetNumber, b=string_34) { a+b; }
setParameterByName_2 = Element.SetParameterByName(element=filterByBoolMask_14.in, parameterName=string_33, value=code_block_20, lacing=Shortest)

firstItem_2 = List.FirstItem(list=setParameterByName_2)
string_35 = StringInput("Print Set")
string_36 = StringInput("MT-MARKETING-BAK")
setParameterByName_3 = Element.SetParameterByName(element=firstItem_2, parameterName=string_35, value=string_36)
