# Dynamo graph ProjectParameters-script.dyn (Dynamo 2.19.3.6394)
# packages: Crumple 2022.5.27, archi-lab.net 2024.217.1024, Clockwork for Dynamo 2.x 2.6.0

boolean = BoolSelector(true)
current_document = Custom[Current Document]()  # package archi-lab.net; Retrieves Current Document
projectParameters = Custom[Document.ProjectParameters](toggle=boolean, docOrRevitLinkInstance=current_document)  # package Clockwork for Dynamo 2.x; Retrieves all project parameters and the categories they have been assigned to
file_path = Filename("..\..\..\..\..\..\Shared Parameters\Shared Parameters Import.xlsx")
code_block = CodeBlock { "Project Parameters"; }
excel_import = Custom[© Excel.Import](filePath=file_path, sheetName=code_block)  # package Crumple; Imports a 2D matrix of data from an existing Excel file path from a given worksheet name. If a worksheet does not exist by that name it will take the data from the first worksheet instead. Credit to Cyril Poupin for most of the Python code (details in node body).
code_block_2 = CodeBlock { 0; }
removeItemAtIndex = List.RemoveItemAtIndex(list=excel_import.dataRows, indices=code_block_2)
transpose = List.Transpose(lists=removeItemAtIndex)
code_block_3 = CodeBlock(l=transpose) { parameterName = l[0]; groupName=l[1]; type=l[3]; group=l[5]; instance=l[6]; category=l[9]; }
group_list_if_the_same = Python(IN[0]=code_block_3.parameterName, IN[1]=code_block_3.groupName, IN[2]=code_block_3.type, IN[3]=code_block_3.group, IN[4]=code_block_3.instance, IN[5]=code_block_3.category)  # IronPython2
# ---------- group_list_if_the_same.python (72 lines) ----------
# Load the Python Standard and DesignScript Libraries
import sys
import clr
clr.AddReference('ProtoGeometry')
from Autodesk.DesignScript.Geometry import *

# The inputs to this node will be stored as a list in the IN variables.
dataEnteringNode = IN

list1 = IN[0]
list2 = IN[1]
list3 = IN[2]
list4 = IN[3]
list5 = IN[4]
list6 = IN[5]

# Combine the lists into a single list of tuples
data = list(zip(list1, list2, list3, list4, list5, list6))

# Group the tuples by the first item in each tuple
groups = {}
for item in data:
    key = item[0]
    if key not in groups:
        groups[key] = []
    groups[key].append(item)

# Split the grouped data back into separate lists
sorted_list1 = []
sorted_list2 = []
sorted_list3 = []
sorted_list4 = []
sorted_list5 = []
sorted_list6 = []
for key in groups:
    sorted_list1.append(key)
    sub_list2 = []
    sub_list3 = []
    sub_list4 = []
    sub_list5 = []
    sub_list6 = []
    for item in groups[key]:
        sub_list2.append(item[1])
        sub_list3.append(item[2])
        sub_list4.append(item[3])
        sub_list5.append(item[4])
        sub_list6.append(item[5])
    sorted_list2.append(sub_list2)
    sorted_list3.append(sub_list3)
    sorted_list4.append(sub_list4)
    sorted_list5.append(sub_list5)
    sorted_list6.append(sub_list6)

my_list2=[]
for i in sorted_list2:
    if len(set(i)) == 1:
        my_list2.append(i[0])
my_list3=[]
for i in sorted_list3:
    if len(set(i)) == 1:
        my_list3.append(i[0])
my_list4=[]
for i in sorted_list4:
    if len(set(i)) == 1:
        my_list4.append(i[0])
my_list5=[]
for i in sorted_list5:
    if len(set(i)) == 1:
        my_list5.append(i[0])       

# Print the sorted lists
OUT = [sorted_list1, my_list2, my_list3, my_list4, my_list5, sorted_list6]
# ----------------------------------------
code_block_4 = CodeBlock(l=group_list_if_the_same) { parameterName = l[0]; groupName=l[1]; type=l[2]; group=l[3]; instance=l[4]; category=l[5]; }
clean_list_if_exists = Python(IN[0]=projectParameters.paramName, IN[1]=code_block_4.parameterName, IN[2]=code_block_4.groupName, IN[3]=code_block_4.type, IN[4]=code_block_4.group, IN[5]=code_block_4.instance, IN[6]=code_block_4.category)  # CPython3
# ---------- clean_list_if_exists.python (40 lines) ----------
# Load the Python Standard and DesignScript Libraries
import sys
import clr
clr.AddReference('ProtoGeometry')
from Autodesk.DesignScript.Geometry import *

# The inputs to this node will be stored as a list in the IN variables.
dataEnteringNode = IN
referencinglist1 = IN[0]  # Flat list of strings or BuiltInCategory values
list1 = IN[1]             # Nested list of categories (builtInCategories)
list2 = IN[2]
list3 = IN[3]
list4 = IN[4]
list5 = IN[5]
list6 = IN[6]

# Output lists
new_list1 = []
new_list2 = []
new_list3 = []
new_list4 = []
new_list5 = []
new_list6 = []

# Loop through each sublist in list1
for index, sublist in enumerate(list1):
    # Check if any item in sublist is in referencinglist1
    if any(item in referencinglist1 for item in sublist):
        new_list1.append("skipped")

    # Otherwise, include all corresponding data
    new_list1.append(sublist)
    new_list2.append(list2[index])
    new_list3.append(list3[index])
    new_list4.append(list4[index])
    new_list5.append(list5[index])
    new_list6.append(list6[index])

# Output the filtered lists
OUT = [new_list1, new_list2, new_list3, new_list4, new_list5, new_list6]
# ----------------------------------------
code_block_5 = CodeBlock(l=clean_list_if_exists) { parameterName = l[0]; groupName=l[1]; type=l[2]; group=l[3]; instance=l[4]; category=l[5]; }
code_block_6 = CodeBlock(param_group=code_block_5.groupName) { "BuiltInParameterGroup."+param_group; }
byName = Category.ByName(name=code_block_5.category)
createProjectParameter = Parameter.CreateProjectParameter(parameterName=code_block_5.parameterName, groupName=code_block_6, specType=code_block_5.type, groupType=code_block_5.group, instance=code_block_5.instance, categoryList=byName, lacing=Shortest)
