# Dynamo graph setLevel-script.dyn (Dynamo 2.19.3.6394)
# packages: Data-Shapes 2022.2.103, Genius Loci 2023.2.21, WWP Packages 0.0.1, Crumple 2022.5.27

categories = Categories("OST_Levels")
all_elements_of_category = ElementsOfCategory(Category=categories)
name = Level.Name(level=all_elements_of_category)
code_block = CodeBlock { "P"; }
contains = String.Contains(string=name, searchFor=code_block)
filterByBoolMask = List.FilterByBoolMask(list=all_elements_of_category, mask=contains)
wwp_logo = Custom[WWP - Logo]()  # package WWP Packages; Black and White Logo
code_block_2 = CodeBlock { "Confirm"; "Cancel"; }
code_block_3 = CodeBlock { "Building Max Levels"; }
boolean = BoolSelector(true)
textbox_data = Custom[TextBox Data](InputName=code_block_3, IsNumberEntry=boolean)  # package Data-Shapes; Create Data for TextBox input in UI.MultipleInputForm ++ . Check out www.data-shapes.net for more informations
multipleinputform = Custom[MultipleInputForm ++](Logo_optional=wwp_logo, ButtonText_optional=code_block_2.out0, Inputs=textbox_data, Toggle=boolean, CancelButtonText_optional=code_block_2.out1)  # package Data-Shapes; Create a form with multiple inputs. see www.data-shapes.net for tutorials and infos!
code_block_4 = CodeBlock(l=multipleinputform.User_Inputs) { l[0]; }
levels_within = Python(IN[0]=code_block_4, IN[1]=filterByBoolMask.out)  # IronPython2
# ---------- levels_within.python (36 lines) ----------
# Load the Python Standard and DesignScript Libraries
import sys
import clr
import re
clr.AddReference('ProtoGeometry')
from Autodesk.DesignScript.Geometry import *

# The inputs to this node will be stored as a list in the IN variables.
dataEnteringNode = IN

# Place your code below this line
desiredLevel=IN[0]
listLevel=UnwrapElement(IN[1])
result=[]
#levels=[]
#elements=[]

for l in listLevel:
	if ("P" or "p") in l.Name:
		numlevel="-"+(re.findall(r'\d+',l.Name)[0])
		result.append(False)
	#if numlevel == desiredLevel:
		#result.append("False")
	elif "1.5" in l.Name:
		numlevel="1.5"
		result.append(False)
	else:
		numlevel= int(re.findall(r'\d+',l.Name)[0])
		if numlevel > desiredLevel:
			result.append(True)
		else:
			result.append(False)
	#elements.append(l)
	#levels.append(numlevel)
# Assign your output to the OUT variable.
OUT = result
# ----------------------------------------
filterByBoolMask_2 = List.FilterByBoolMask(list=filterByBoolMask.out, mask=levels_within)
code_block_5 = CodeBlock(l=filterByBoolMask_2.in) { "are you sure to delete the following elements?"+l; }
isEmpty = List.IsEmpty(list=filterByBoolMask_2.in)
not_ = Not(x=isEmpty)
wwp_boooled_popup_w_buttons = Custom[WWP - Boooled Popup w/ Buttons](content=code_block_5, bools=not_)  # package WWP Packages; popups for boolean input and confirmed with boolean
code_block_6 = CodeBlock { None; }  # unwired: None
if_ = If(test=wwp_boooled_popup_w_buttons, true=filterByBoolMask_2.in, false=code_block_6)
delete = Element.Delete(element=if_)
elevation = Level.Elevation(level=all_elements_of_category)
code_block_7 = CodeBlock(l=filterByBoolMask_2.out) { l.Elevation; }
sortByKey = List.SortByKey(list=filterByBoolMask_2.out, keys=code_block_7)
code_block_8 = CodeBlock { None; }  # unwired: None
eq = sortByKey.sortedList == code_block_8
list_create = List.Create(item0=sortByKey.sortedList, item1=sortByKey.sortedKeys)
if_2 = If(test=eq, true=code_block_8, false=list_create)
code_block_9 = CodeBlock(l=if_2) { l[0]; l[1]; }
code_block_10 = CodeBlock(l=code_block_9.out0) { l[-1].Name; }
code_block_11 = CodeBlock { " "; }
split = String.Split(string=code_block_10, separator0=code_block_11)
code_block_12 = CodeBlock(l=split) { l[-1]; }
toNumber = String.ToNumber(string=code_block_12)
lastItem = List.LastItem(list=code_block_9.out1)
python_script = Python(IN[0]=toNumber, IN[1]=lastItem, IN[2]=code_block_4)  # IronPython2
# ---------- python_script.python (21 lines) ----------
import clr
clr.AddReference('ProtoGeometry')
from Autodesk.DesignScript.Geometry import *

# Get the input values
highest_level_number = IN[0]
highest_elevation_number = IN[1]
desired_level = int(IN[2])

# Create an empty list to store the floors and their elevations
floors_and_elevations = []

# Iterate through each level from the highest_level_number to the desired_level
for i in range(highest_level_number + 1, desired_level + 1):
    # Check if the floor exists in the dictionary
    floor_name = "FLOOR {:02d}".format(i)
    next_elevation = highest_elevation_number + (i - (highest_level_number)) * 3000
    floors_and_elevations.append([floor_name, next_elevation])

# Output the floors_and_elevations list
OUT = floors_and_elevations
# ----------------------------------------
transpose = List.Transpose(lists=python_script)
code_block_13 = CodeBlock(l=transpose) { l[0]; l[1]; }
code_block_14 = CodeBlock { ",\n"; }
string_join = Custom[© String.Join](list=code_block_13.out0, sep=code_block_14)  # package Crumple; Joins a list of strings together, inserting a separating character between each of them. Input must be a list containing a list or lists.
wwp_boooled_popup_w_buttons_2 = Custom[WWP - Boooled Popup w/ Buttons](content=string_join, bools=isEmpty)
code_block_15 = CodeBlock(l=code_block_9.out0) { l[-1]; }
code_block_16 = CodeBlock { None; }  # unwired: None
if_3 = If(test=wwp_boooled_popup_w_buttons_2, true=code_block_15, false=code_block_16)
element_duplicate = Custom[Element Duplicate](element=if_3, name=code_block_13.out0, lacing=Longest)  # package Genius Loci; Duplicates the given element (view, element type).
code_block_17 = CodeBlock { "Elevation"; }
setParameterByName = Element.SetParameterByName(element=element_duplicate, parameterName=code_block_17, value=code_block_13.out1, lacing=Longest)
