# Dynamo graph copyfilterMulti-script.legacy.dyn "copyfilterMulti-script" (Dynamo 2.18.1.5096)
# packages: Synthetic 2.0.200209, Crumple 2022.5.27, Data-Shapes 2022.2.105, WWP Packages 0.0.1

code_block = CodeBlock { "Copy filter and its graphic override\nfrom one template to anther."; 800; 400; }
wwp_logo = Custom[WWP - Logo]()  # package WWP Packages; Black and White Logo
string = StringInput("""Select Template
(Copy Filters to)""")
current = Synthetic.Revit.Document.Current()
getViewTemplates = Synthetic.Revit.ViewTemplate.GetViewTemplates(doc=current)
listview_data = Custom[Listview Data](InputName=string, Keys=getViewTemplates.template_names, Values=getViewTemplates.templates)  # package Data-Shapes
code_block_2 = CodeBlock { true; "Cancel"; }
multipleinputform = Custom[MultipleInputForm ++](Description_optional=code_block.out0, Logo_optional=wwp_logo, Inputs=listview_data, Toggle=code_block_2.out0, CancelButtonText_optional=code_block_2.out1, Width_optional=code_block.out1, LabelWidth_optional=code_block.out2)  # package Data-Shapes; Create a form with multiple inputs. see www.data-shapes.net for tutorials and infos!
revit_currentview = Custom[© Revit.CurrentView]()  # package Crumple; Given the current document, return the active view.
flow_waitfor = Custom[© Flow.WaitFor](data=revit_currentview, waitFor=multipleinputform.User_Inputs)  # package Crumple; Tells the first input to wait for the second input to arrive, then passes on the first input. Really useful for scripts which have branching paths that rely on their outputs to carry each other forward. Quite a few custom packages have a 'passthrough' or 'waitfor' node. I use these all the time, so find it useful to have them contained in this package also.
filters = View.Filters(view=flow_waitfor)
addFilter = View.AddFilter(view=multipleinputform.User_Inputs@L2, parameterFilter=filters)
filterOverrides = View.FilterOverrides(view=flow_waitfor, parameterFilter=filters)
boolean = BoolSelector(true)
setFilterOverrides = View.SetFilterOverrides(view=multipleinputform.User_Inputs@L2, parameterFilter=filters, overrides=filterOverrides, hide=boolean)
