# Dynamo graph copyfilterCurrent-script.legacy.dyn "copyfilterCurrent-script" (Dynamo 2.18.1.5096)
# packages: Data-Shapes 2022.2.103, Synthetic 2.0.200209, Crumple 2022.5.27, WWP Packages 0.0.1, archi-lab.net 2024.217.1024

revit_currentview = Custom[© Revit.CurrentView]()  # package Crumple; Given the current document, return the active view.
removeViewTemplate = archilab.Revit.Views.Views.RemoveViewTemplate(view=revit_currentview)
code_block = CodeBlock { "Copy filter and its graphic override\nfrom one template to anther."; 800; 400; }
file_path = Filename("M:\WWP\6.0_Logo\Social Media\WWP_logo_bw_square.png")
string = StringInput("""Select the Host Template
(Copy Filters from)""")
current = Synthetic.Revit.Document.Current()
getViewTemplates = Synthetic.Revit.ViewTemplate.GetViewTemplates(doc=current)
dropdown_data = Custom[DropDown Data](InputName=string, Keys=getViewTemplates.template_names, Values=getViewTemplates.templates)  # package Data-Shapes; Create data for DropDown input in UI.MultiInputForm ++ . Check out www.data-shapes.net for more infos.
string_2 = StringInput("Revit will load all filter and graphic overrides from a template, are you sure to continue?")
wwp_popup_w_buttons = Custom[WWP - Popup w/ Buttons](content=string_2)  # package WWP Packages; Pop - up Dialog for boolean
multipleinputform = Custom[MultipleInputForm ++](Description_optional=code_block.out0, Logo_optional=file_path, Inputs=dropdown_data, Toggle=wwp_popup_w_buttons, Width_optional=code_block.out1, LabelWidth_optional=code_block.out2)  # package Data-Shapes; Create a form with multiple inputs. see www.data-shapes.net for tutorials and infos!
firstItem = List.FirstItem(list=multipleinputform.User_Inputs)
filters = View.Filters(view=firstItem)
addFilter = View.AddFilter(view=removeViewTemplate, parameterFilter=filters)
filterOverrides = View.FilterOverrides(view=firstItem, parameterFilter=filters)
boolean = BoolSelector(true)
setFilterOverrides = View.SetFilterOverrides(view=addFilter, parameterFilter=filters, overrides=filterOverrides, hide=boolean)
