# Dynamo graph copyfilter-script.legacy.dyn "copyfilter-script" (Dynamo 2.19.3.6394)
# packages: Data-Shapes 2022.2.103, Synthetic 2.0.200209

code_block = CodeBlock { "Copy filter and its graphic override\nfrom one template to anther."; 800; 400; "Cancel"; "Confirm"; }
file_path = Filename("M:\WWP\6.0_Logo\Social Media\WWP_logo_bw_square.png")
string = StringInput("Select the Target Template")
current = Synthetic.Revit.Document.Current()
getViewTemplates = Synthetic.Revit.ViewTemplate.GetViewTemplates(doc=current)
dropdown_data = Custom[DropDown Data](InputName=string, Keys=getViewTemplates.template_names, Values=getViewTemplates.templates)  # package Data-Shapes; Create data for DropDown input in UI.MultiInputForm ++ . Check out www.data-shapes.net for more infos.
string_2 = StringInput("""Select the Host Template
(Copy Filters from)""")
dropdown_data_2 = Custom[DropDown Data](InputName=string_2, Keys=getViewTemplates.template_names, Values=getViewTemplates.templates)
list_create = List.Create(item0=dropdown_data, item1=dropdown_data_2)
boolean = BoolSelector(true)
multipleinputform = Custom[MultipleInputForm ++](Description_optional=code_block.out0, Logo_optional=file_path, ButtonText_optional=code_block.out4, Inputs=list_create, Toggle=boolean, CancelButtonText_optional=code_block.out3, Width_optional=code_block.out1, LabelWidth_optional=code_block.out2)  # package Data-Shapes; Create a form with multiple inputs. see www.data-shapes.net for tutorials and infos!
firstItem = List.FirstItem(list=multipleinputform.User_Inputs)
lastItem = List.LastItem(list=multipleinputform.User_Inputs)
filters = View.Filters(view=lastItem)
filterOverrides = View.FilterOverrides(view=lastItem, parameterFilter=filters)
code_block_2 = CodeBlock { true; }
setFilterOverrides = View.SetFilterOverrides(view=firstItem, parameterFilter=filters, overrides=filterOverrides, hide=code_block_2)
addFilter = View.AddFilter(view=firstItem, parameterFilter=filters)
