# Dynamo graph Push Room Numbers to Door Mark-script.dyn (Dynamo 2.19.3.6394)
# packages: Crumple 2022.5.27, WWP Packages 0.0.1

code_block = CodeBlock { "Note: This will sync all 'ToRooms' Numbers to your Door Marks. if the room is flipped, make sure your door is hosted on the exterior side of the wall"; }
wwp_popup_w_buttons = Custom[WWP - Popup w/ Buttons](content=code_block)  # package WWP Packages; Pop - up Dialog for boolean
categories = Categories("OST_Doors")
code_block_2 = CodeBlock { ""; }
if_ = RefactoredIf(test=wwp_popup_w_buttons, true=categories, false=code_block_2)
all_elements_of_category = ElementsOfCategory(Category=if_)
getFamily = FamilyInstance.GetFamily(familyInstance=all_elements_of_category)
code_block_3 = CodeBlock(e=getFamily) { e.Name; }
code_block_4 = CodeBlock { "Overhead"; }
contains = String.Contains(string=code_block_3, searchFor=code_block_4)
filterByBoolMask = List.FilterByBoolMask(list=all_elements_of_category, mask=contains)
flatten = List.Flatten(list=filterByBoolMask.out)
string = StringInput("Mark")
select_phase = RevitPhases("New Construction")
doors_tofrom = Custom[© Doors.ToFrom](door=flatten, roomPhase=select_phase)  # package Crumple; Given a door, attempts to return its to and from room properties as well as how many rooms it relates to.
number = Room.Number(room=doors_tofrom.toRoom)
python_script = Python(IN[0]=number)  # CPython3
# ---------- python_script.python (54 lines) ----------
import clr
clr.AddReference('RevitAPI')
from Autodesk.Revit.DB import *
from string import ascii_uppercase

def rename_duplicates(numbers):
    count_dict = {}
    occurrence_dict = {}
    renamed_list = []

    # First pass to count occurrences
    for number in numbers:
        if number in count_dict:
            count_dict[number] += 1
        else:
            count_dict[number] = 1

    # Second pass to rename duplicates only if needed
    for number in numbers:
        try:
            # Validate if the input number is null or not a proper value
            if number is None or number == "":
                renamed_list.append(None)  # Append None to indicate invalid input
                continue

            if count_dict[number] > 1:  # Only append suffix if more than one occurrence
                if number in occurrence_dict:
                    occurrence_dict[number] += 1
                else:
                    occurrence_dict[number] = 1

                letter = ascii_uppercase[occurrence_dict[number] - 1]
                renamed_list.append("{}{}".format(number, letter))  # Using format for Python 2.7 compatibility
            else:
                renamed_list.append(number)  # Append without suffix if only one occurrence

        except Exception as e:
            # Handle any unexpected error during processing
            renamed_list.append("Error: {}".format(str(e)))  # Using format for Python 2.7 compatibility

    return renamed_list

# Read the input from the previous node, which should be a list of numbers or identifiers
numbers = IN[0]

# Check if the input itself is not None or empty to avoid errors in the function
if numbers is None or not numbers:  # Adding check for empty list
    renamed_numbers = "No input provided"
else:
    # Apply the renaming logic to the input list
    renamed_numbers = rename_duplicates(numbers)

# Output the renamed list to the next node or for direct visualization
OUT = renamed_numbers
# ----------------------------------------
setParameterByName = Element.SetParameterByName(element=flatten, parameterName=string, value=python_script)
