# Dynamo graph SetTypeName-script.dyn (Dynamo 2.12.1.8246)
# packages: Data-Shapes 2022.2.103, Crumple 2022.5.27, WWP Packages 0.0.1, Clockwork for Dynamo 2.x 2.4.0

current_element = Python()  # IronPython2; unwired: IN[0]
# ---------- current_element.python (41 lines) ----------
import clr

clr.AddReference('RevitAPI')
import Autodesk
from Autodesk.Revit.DB import *

clr.AddReference('RevitServices')
import RevitServices
from RevitServices.Persistence import DocumentManager

doc = DocumentManager.Instance.CurrentDBDocument
uiapp = DocumentManager.Instance.CurrentUIApplication
app = uiapp.Application
uidoc = uiapp.ActiveUIDocument

clr.AddReference('RevitNodes')
import Revit
clr.ImportExtensions(Revit.Elements)

ueWrapper = None
wrappers = clr.GetClrType(Revit.Elements.ElementWrapper).GetMethods()
for w in wrappers:
	if w.ToString().startswith("Revit.Elements.UnknownElement"):
		ueWrapper = w
		break
		
out = []
selectElemId = uidoc.Selection.GetElementIds()
selectElem = [doc.GetElement(xId) for xId in selectElemId]

for i in selectElem:
	try:
		check = Revit.Elements.ElementWrapper.Wrap(i, True)
	except: check = None

	if check is None:
		out.append(ueWrapper.Invoke(None, (i, False)))
	else:
		out.append(i) 

OUT = out
# ----------------------------------------
getFamily = FamilyInstance.GetFamily(familyInstance=current_element)
groupByKey = List.GroupByKey(list=current_element, keys=getFamily)
firstItem = List.FirstItem(list=groupByKey.groups@L2)
code_block = CodeBlock(e=groupByKey.uniqueKeys) { e.Name; }
string_from_object = FromObject(object=code_block)
code_block_2 = CodeBlock { "Replace String"; }
wwp_logo = Custom[WWP - Logo]()  # package WWP Packages; Black and White Logo
code_block_3 = CodeBlock { [["Find Text","Replace with"],["Prefix","Suffix"]]; }
textbox_data = Custom[TextBox Data](InputName=code_block_3)  # package Data-Shapes; Create Data for TextBox input in UI.MultipleInputForm ++ . Check out www.data-shapes.net for more informations
code_block_4 = CodeBlock { "Please Select at least ONE element"; }
wwp_popupdialog = Custom[WWP - PopupDialog](list=current_element, content=code_block_4)  # package WWP Packages; Dialog box for information
multipleinputform = Custom[MultipleInputForm ++](Description_optional=code_block_2, Logo_optional=wwp_logo, Inputs=textbox_data, Toggle=wwp_popupdialog)  # package Data-Shapes; Create a form with multiple inputs. see www.data-shapes.net for tutorials and infos!
firstItem_2 = List.FirstItem(list=multipleinputform.User_Inputs)
code_block_5 = CodeBlock(l=firstItem_2) { l[0]; l[1]; }
replace = String.Replace(string=string_from_object, searchFor=code_block_5.out0, replaceWith=code_block_5.out1)
flow_waitfor = Custom[© Flow.WaitFor](data=firstItem, waitFor=replace)  # package Crumple; Tells the first input to wait for the second input to arrive, then passes on the first input. Really useful for scripts which have branching paths that rely on their outputs to carry each other forward. Quite a few custom packages have a 'passthrough' or 'waitfor' node. I use these all the time, so find it useful to have them contained in this package also.
getFamily_2 = FamilyInstance.GetFamily(familyInstance=flow_waitfor)
lastItem = List.LastItem(list=multipleinputform.User_Inputs)
code_block_6 = CodeBlock(l=lastItem) { l[0]; l[1]; }
code_block_7 = CodeBlock(pre=code_block_6.out0, name=replace, suf=code_block_6.out1) { pre+name+suf; }
setName = Custom[Element.SetName](element=getFamily_2, name=code_block_7)  # package Clockwork for Dynamo 2.x; Gets the name of a given Revit element
