# Dynamo graph SetTypeName-script2.dyn (Dynamo 2.19.3.6394)
# packages: Clockwork for Dynamo 2.x 2.6.0, archi-lab.net 2024.217.1024, Data-Shapes 2025.3.118, WWP Packages 0.0.1

wwp_logo = Custom[WWP - Logo]()  # package WWP Packages; Black and White Logo
categories_list = Custom[Categories list]()  # package Data-Shapes; Gives list of all Revit categories and a matching list of their names
byName = Category.ByName(name=categories_list.Category_name_s)
dropdown_data = Custom[DropDown Data](Keys=categories_list.Category_name_s, Values=byName)  # package Data-Shapes; Create data for DropDown input in UI.MultiInputForm ++ . Check out www.data-shapes.net for more infos.
code_block = CodeBlock { ["Find Text", "Replace with"]; }
textbox_data = Custom[TextBox Data](InputName=code_block)  # package Data-Shapes; Create Data for TextBox input in UI.MultipleInputForm ++ . Check out www.data-shapes.net for more informations
list_create = List.Create(item0=dropdown_data, item1=textbox_data)
boolean = BoolSelector(true)
multipleinputform = Custom[MultipleInputForm ++](Logo_optional=wwp_logo, Inputs=list_create, Toggle=boolean)  # package Data-Shapes; Create a form with multiple inputs. see www.data-shapes.net for tutorials and infos!
code_block_2 = CodeBlock(l=multipleinputform.User_Inputs) { category=l[0]; replaceText=l[1]; }
current_document = Custom[Current Document]()  # package archi-lab.net; Retrieves Current Document
all_family_types_of_category = Custom[All Family Types Of Category](category=code_block_2.category, toggle=boolean, docOrRevitLinkInstance=current_document)  # package Clockwork for Dynamo 2.x; Gets all family types/symbols of a given category in the model.
start = Revit.Transaction.Transaction.Start(input=all_family_types_of_category)  # frozen
code_block_3 = CodeBlock(e=start) { e.Name; }
code_block_4 = CodeBlock(l=code_block_2.replaceText) { searchText=l[0]; replaceText=l[1]; }
replace = String.Replace(string=code_block_3, searchFor=code_block_4.searchText, replaceWith=code_block_4.replaceText)
setName = Custom[Element.SetName](element=start, name=replace)  # package Clockwork for Dynamo 2.x; Gets the name of a given Revit element
end = Revit.Transaction.Transaction.End(input=setName.success)
watch = Watch(code_block_2.category)
