# Dynamo graph ProjectSetup-script2.dyn "ProjectSetup-script" (Dynamo 2.3.2.15696)
# packages: Data-Shapes 2021.2.94, Crumple 2021.5.27, bimorphNodes 3.0.3, WWP Packages 0.0.1, spring nodes 210.1.1

categories = Categories("OST_ProjectInformation")
all_elements_of_category = ElementsOfCategory(Category=categories)
code_block = CodeBlock { ["Stat Path","Schedule List"]; }
code_block_2 = CodeBlock { "EXPORT SCHEDULE"; "EXPORT"; "CANCEL"; 900; 600; 300; }
wwp_logo = Custom[WWP - Logo]()  # package WWP Packages; Black and White Logo
code_block_3 = CodeBlock { "SCHEDULES"; 400; true; false; }
# note: Custom Node: Crumple v.2021.5.27
schedulesbytype = Custom[© SchedulesByType]()  # package Crumple; Returns all schedules in a document, separated into key and non-key schedules.
name = Element.Name(element=schedulesbytype.schedules)
listview_data = Custom[Listview Data](InputName=code_block_3.out0, Keys=name, Values=schedulesbytype.schedules, Height_optionnal=code_block_3.out1, HilightInView_optionnal=code_block_3.out3, DisplayModeOnly_optionnal=code_block_3.out3, ShowElementCount_optionnal=code_block_3.out3, SortItems_optionnal=code_block_3.out2, ShowId_optionnal=code_block_3.out3)  # package Data-Shapes; Create data for ListView input in UI.MultiInputForm ++ . Check out www.data-shapes.net for more infos.
code_block_4 = CodeBlock { "FILE PATH"; "Select a file..."; }
ꟿ_document_centralpath = Custom[ꟿ Document.CentralPath]()  # package spring nodes; If the document is workshared, the node returns the path to the central document as a string. Otherwise a null value will be returned.
# note: Custom Node: Data-Shapes v.2021.2.94
filepath_data = Custom[FilePath Data](InputName=code_block_4.out0, DefaulPath=ꟿ_document_centralpath, ButtonText=code_block_4.out1)  # package Data-Shapes; Create filepath input for UI.MultipleInputForm ++ . Check out www.data-shapes.net for more infos !
list_create = List.Create(item0=listview_data, item1=filepath_data)
boolean = BoolSelector(true)
multipleinputform = Custom[MultipleInputForm ++](Description_optional=code_block_2.out0, Logo_optional=wwp_logo, ButtonText_optional=code_block_2.out1, Inputs=list_create, Toggle=boolean, CancelButtonText_optional=code_block_2.out2, MaxHeight_optional=code_block_2.out3, Width_optional=code_block_2.out4, LabelWidth_optional=code_block_2.out5)  # package Data-Shapes; Create a form with multiple inputs. see www.data-shapes.net for tutorials and infos!
code_block_5 = CodeBlock(out=multipleinputform.User_Inputs) { sched = out[0]; path  = out[1]; }
name_2 = Element.Name(element=code_block_5.sched)
string_from_array = FromArray(arr=name_2)
list_create_2 = List.Create(item0=code_block_5.path, item1=string_from_array)
setParameterByName = Element.SetParameterByName(element=all_elements_of_category, parameterName=code_block, value=list_create_2, lacing=Longest)
name_3 = Element.Name(element=code_block_5.sched)
code_block_6 = CodeBlock { 0; }
code_block_7 = CodeBlock { false; }
# note: Custom Node: BimorphNodes v.3.0.3
getData = Revit.Schedule.GetData(scheduleView=code_block_5.sched, refresh=code_block_7)
boolean_2 = BoolSelector(true)
exportExcel = Data.ExportExcel(filePath=code_block_5.path, sheetName=name_3, startRow=code_block_6, startCol=code_block_6, data=getData, overWrite=boolean_2)
