# Dynamo graph CreateMarketingPlanDictUI_old-script.dyn "CreateMarketingPlanDictUI-script" (Dynamo 2.6.2.15705)
# packages: Crumple 2022.2.13, Rhythm 2022.1.5, Data-Shapes 2022.2.103, archi-lab.net 2022.212.2722

boolean = BoolSelector(true)
currentselection = Custom[© CurrentSelection](refresh=boolean)  # package Crumple; Returns all elements currently selected by the user in the active document when this node ran.
string = StringInput("Areas: Municipal Number")
getParameterValueByName = Element.GetParameterValueByName(element=currentselection, parameterName=string)

# group: Make Dictionary
groupByKey = List.GroupByKey(list=currentselection, keys=getParameterValueByName)
string_2 = StringInput("Name")
getParameterValueByName_2 = Element.GetParameterValueByName(element=groupByKey.groups, parameterName=string_2)
string_3 = StringInput("Area")
getParameterValueByName_3 = Element.GetParameterValueByName(element=groupByKey.groups, parameterName=string_3)
id = Element.Id(element=groupByKey.groups)
list_create = List.Create(item0=groupByKey.unique_keys, item1=getParameterValueByName_2, item2=getParameterValueByName_3, item3=id)
transpose = List.Transpose(lists=list_create)
python_script = Python(IN[0]=transpose)
# ---------- python_script.python (31 lines) ----------
# Load the Python Standard and DesignScript Libraries
import sys
import clr
clr.AddReference('ProtoGeometry')
from Autodesk.DesignScript.Geometry import *

# The inputs to this node will be stored as a list in the IN variables.
dataEnteringNode = IN
unitList=IN[0]
resultList=[]

# Place your code below this line
for i in unitList:
	dictUnit={}
	dictUnit["MunicipalNumber"]=i[0]
	
	for (x,y,z) in zip(i[1],i[2],i[3]):
		
		if x == "Balcony" or x == "Terrace":
			dictUnit["OutsideArea"]=y
			dictUnit["OutsideID"]=z
			dictUnit["OutsideType"]=x
		else:
			dictUnit["SuiteArea"]=y
			dictUnit["SuiteID"]=z
			dictUnit["SuiteType"]=x
	resultList.append(dictUnit)


# Assign your output to the OUT variable.
OUT = resultList
# ----------------------------------------

# group: Current View/Level
boolean_2 = BoolSelector(true)
currentview = Custom[© CurrentView](refresh=boolean_2)  # package Crumple; Given the current document, return the active view.
level_name = Element.Name(element=currentview)

string_4 = StringInput("14-Marketing")
string_5 = StringInput("MunicipalNumber")

# group: Decode the Dictionary
string_6 = StringInput("OutsideID")
valueAtKey = DesignScript.Builtin.Dictionary.ValueAtKey(dictionary=python_script, key=string_6)
string_7 = StringInput("OutsideArea")
valueAtKey_2 = DesignScript.Builtin.Dictionary.ValueAtKey(dictionary=python_script, key=string_7)
string_8 = StringInput("OutsideType")
valueAtKey_3 = DesignScript.Builtin.Dictionary.ValueAtKey(dictionary=python_script, key=string_8)
python_script_2 = Python(IN[0]=valueAtKey, IN[1]=valueAtKey_2, IN[2]=valueAtKey_3)
# ---------- python_script_2.python (27 lines) ----------
# Load the Python Standard and DesignScript Libraries
import sys
import clr
clr.AddReference('ProtoGeometry')
from Autodesk.DesignScript.Geometry import *

# The inputs to this node will be stored as a list in the IN variables.
dataEnteringNode = IN
listD1=IN[0]
listD2=IN[1]
listD3=IN[2]
organizedL3=[]
organizedL1=[]
organizedL2=[]
# Place your code below this line
for (x,y,z) in zip(listD1,listD2,listD3):
	if x == None:
		x=""
	organizedL1.append(x)
	if y == None:
		y=""
	organizedL2.append(y)
	if z == None:
		z=""
	organizedL3.append(y)
# Assign your output to the OUT variable.
OUT = [organizedL3,organizedL1,organizedL2]
# ----------------------------------------
outsideArea = List.FirstItem(list=python_script_2)
outsideName = List.FirstItem(list=python_script_2)
valueAtKey_4 = DesignScript.Builtin.Dictionary.ValueAtKey(dictionary=python_script, key=string_5)
string_9 = StringInput("SuiteType")
valueAtKey_5 = DesignScript.Builtin.Dictionary.ValueAtKey(dictionary=python_script, key=string_9)
string_10 = StringInput("SuiteID")
valueAtKey_6 = DesignScript.Builtin.Dictionary.ValueAtKey(dictionary=python_script, key=string_10)
select_the_suite_area_element = ElementById(Id=valueAtKey_6)
outsideID = CodeBlock(lista=python_script_2) { i=lista[1]; }
select_the_outside_area_element = ElementById(Id=outsideID)
string_11 = StringInput("SuiteArea")
suite_area_metric = DesignScript.Builtin.Dictionary.ValueAtKey(dictionary=python_script, key=string_11)

# group: Get Boundary to crop views
ʳʰʸᵗʰᵐ_areas_suite = Rhythm.Revit.Elements.Areas.OuterBoundary(area=select_the_suite_area_element)
ʳʰʸᵗʰᵐ_areas_balcony_terrace = Rhythm.Revit.Elements.Areas.OuterBoundary(area=select_the_outside_area_element)
list_create_2 = List.Create(item0=ʳʰʸᵗʰᵐ_areas_suite, item1=ʳʰʸᵗʰᵐ_areas_balcony_terrace)
transpose_2 = List.Transpose(lists=list_create_2)
firstItem = List.FirstItem(list=transpose_2@L2)
byPatch = Surface.ByPatch(closedCurve=firstItem)
lastItem = List.LastItem(list=transpose_2@L2)
byPatch_2 = Surface.ByPatch(closedCurve=lastItem)
list_create_3 = List.Create(item0=byPatch, item1=byPatch_2)
transpose_3 = List.Transpose(lists=list_create_3)
simplify_list_for_null = Python(IN[0]=transpose_3)
# ---------- simplify_list_for_null.python (21 lines) ----------
# Load the Python Standard and DesignScript Libraries
import sys
import clr
clr.AddReference('ProtoGeometry')
from Autodesk.DesignScript.Geometry import *

# The inputs to this node will be stored as a list in the IN variables.
dataEnteringNode = IN
list1=IN[0]
items=[]
# Place your code below this line

for listx in list1:
	result=[]
	for i in listx:
		if i != None:
			result.append(i)
	items.append(result)

# Assign your output to the OUT variable.
OUT = items
# ----------------------------------------
byUnion = Surface.ByUnion(surfaces=simplify_list_for_null)
perimeterCurves = Surface.PerimeterCurves(surface=byUnion)

file_path = Filename("R:\Graphics\Logos\New Kirkor Logo\Images\New Logo-01.png")
code_block = CodeBlock()
# ---------- code_block.designscript (2 lines) ----------
["Choose Suite Plan Template",
"Choose Key Plan Template"];
# ----------------------------------------
viewtemplates = Custom[© ViewTemplates]()  # package Crumple; Returns all view templates in a document. Due to API/Dynamo limitations, 3D view templates are excluded from the list.
name = Element.Name(element=viewtemplates)
code_block_2 = CodeBlock { "14"; }
contains = String.Contains(str=name, searchFor=code_block_2)
filterByBoolMask = List.FilterByBoolMask(list=viewtemplates, mask=contains)
name_2 = Element.Name(element=filterByBoolMask.in)
dropdown_data = Custom[DropDown Data](InputName=code_block, Keys=name_2, Values=filterByBoolMask.in)  # package Data-Shapes; Create data for DropDown input in UI.MultiInputForm ++ . Check out www.data-shapes.net for more infos.
string_12 = StringInput("Filled Region Type")
element_types = ElementTypes("FilledRegionType")
all_elements_of_type = ElementsOfType(element_type=element_types)
name_3 = Element.Name(element=all_elements_of_type)
dropdown_data_2 = Custom[DropDown Data](InputName=string_12, Keys=name_3, Values=all_elements_of_type)
UI = List.Create(item0=dropdown_data, item1=dropdown_data_2)
inputgroup_data = Custom[InputGroup Data](Inputs=UI)  # package Data-Shapes; Creates a group of inputs for UI.MultipleInputForm ++ . Check out www.data-shapes.net for more infos !
boolean_3 = BoolSelector(true)
string_13 = StringInput("Cancel")
multipleinputform = Custom[MultipleInputForm ++](Logo_optional=file_path, Inputs=inputgroup_data, Toggle=boolean_3, CancelButtonText_optional=string_13)  # package Data-Shapes; Create a form with multiple inputs. see www.data-shapes.net for tutorials and infos!
code_block_3 = CodeBlock(i=multipleinputform.User_Inputs) { temSuite=i[0]; tempKey=i[1]; filledType=i[2]; }

# group: Modify Views
create_view_name = CodeBlock(preFix=string_4, level=level_name, munNumber=valueAtKey_4, viewName=valueAtKey_5)
# ---------- create_view_name.designscript (10 lines) ----------
nameSales=preFix+
" - "+level+
" - Suite "
+munNumber+
" ("+viewName+")";
namePurchaser=preFix+
" - "+level+
" - Suite "
+munNumber+
" ("+viewName+") - Purchaser";
# ----------------------------------------
string_14 = StringInput("Duplicate")
views_sales = archilab.Revit.Views.Views.Duplicate(view=currentview, name=create_view_name.nameSales, options=string_14)
setViewTemplate = archilab.Revit.Views.Views.SetViewTemplate(view=views_sales, viewTemplate=code_block_3.temSuite)
code_block_4 = CodeBlock(viewNumber=valueAtKey_4, viewName=valueAtKey_5)
# ---------- code_block_4.designscript (4 lines) ----------
numS="Suite "+viewNumber+
" ("+viewName+") Sales";
numP="Suite "+viewNumber+
" ("+viewName+") Purchaser";
# ----------------------------------------
views_purchaser = archilab.Revit.Views.Views.Duplicate(view=currentview, name=create_view_name.namePurchaser, options=string_14)
setViewTemplate_2 = archilab.Revit.Views.Views.SetViewTemplate(view=views_purchaser, viewTemplate=code_block_3.temSuite)

setCropRegion = Custom[SetCropRegion](view=views_sales, CurvesAsList=perimeterCurves)  # package Data-Shapes; Sets the crop region of a view to a closed polycurve.
string_15 = StringInput("Schedule C1")
family_types = FamilyTypes("KAP-Titleblock-Marketing-Schedule A-8.5x14*:Marketing Schedule A")

# group: Create Keyplan and Dependent Views
string_16 = StringInput("14-KeyPlan")
create_view_name_2 = CodeBlock(preFix=string_16, munNumber=valueAtKey_4, viewName=valueAtKey_5)
# ---------- create_view_name_2.designscript (4 lines) ----------
nameSales=preFix+
" - Suite "
+munNumber+
" ("+viewName+")";
# ----------------------------------------
string_17 = StringInput("Duplicate")
views_sales_2 = archilab.Revit.Views.Views.Duplicate(view=currentview, name=create_view_name_2, options=string_17)
code_block_5 = CodeBlock(name=create_view_name_2) { nameS=name+" Sales"; nameP=name+" Purchaser"; }
string_18 = StringInput("AsDependent")
views_sales_3 = archilab.Revit.Views.Views.Duplicate(view=views_sales_2, name=code_block_5.nameS, options=string_18)
views_purchaser_2 = archilab.Revit.Views.Views.Duplicate(view=views_sales_2, name=code_block_5.nameP, options=string_18)
setViewTemplate_3 = archilab.Revit.Views.Views.SetViewTemplate(view=views_sales_2, viewTemplate=code_block_3.tempKey)

# group: Sales Sheets
list_create_4 = List.Create(item0=views_sales, item1=views_sales_3)
transpose_4 = List.Transpose(lists=list_create_4)

byNameNumberTitleBlockAndViews = Sheet.ByNameNumberTitleBlockAndViews(sheetName=string_15, sheetNumber=code_block_4.numS, titleBlockFamilyType=family_types, views=transpose_4)  # frozen
string_19 = StringInput("Schedule C1")
family_types_2 = FamilyTypes("KAP-Titleblock-Marketing-Schedule A-8.5x14*:Marketing Schedule A")

# group: Purchaser Sheets
list_create_5 = List.Create(item0=views_purchaser, item1=views_purchaser_2)
transpose_5 = List.Transpose(lists=list_create_5)

byNameNumberTitleBlockAndViews_2 = Sheet.ByNameNumberTitleBlockAndViews(sheetName=string_19, sheetNumber=code_block_4.numP, titleBlockFamilyType=family_types_2, views=transpose_5)

# group: Area of Suite/Outside
areas_matric = List.Create(item0=suite_area_metric, item1=valueAtKey_2)
python_script_3 = Python(IN[0]=areas_matric)
# ---------- python_script_3.python (24 lines) ----------
# Load the Python Standard and DesignScript Libraries
import sys
import clr
clr.AddReference('ProtoGeometry')
from Autodesk.DesignScript.Geometry import *

# The inputs to this node will be stored as a list in the IN variables.
dataEnteringNode = IN
list1=IN[0]
resultList=[]

# Place your code below this line
for lists in list1:
	results=[]
	for i in lists:
		if i == None:
			result=0
		else:
			result=i
		results.append(result)
	resultList.append(results)
# Assign your output to the OUT variable.

OUT = resultList
# ----------------------------------------
transpose_6 = List.Transpose(lists=python_script_3)
code_block_6 = CodeBlock(area=transpose_6)
# ---------- code_block_6.designscript (4 lines) ----------
areaImp=Math.Ceiling
(area*10.7639);
areaMat=Math.Ceiling
(area);
# ----------------------------------------
suit_area_matric = List.FirstItem(list=code_block_6.areaMat@L2)
imperial_area = FromObject(obj=code_block_6.areaImp)
metric_area = FromObject(obj=code_block_6.areaImp)
suite_area = List.FirstItem(list=code_block_6.areaImp@L2)
code_block_7 = CodeBlock(a=suite_area, b=suit_area_matric) { suiteArea= a + " SQft/" +b+" SQM"; }
terrace_area_metric = List.LastItem(list=code_block_6.areaMat@L2)
terrace_area = List.LastItem(list=code_block_6.areaImp@L2)
code_block_8 = CodeBlock(a=terrace_area, b=terrace_area_metric) { outsideArea= a + " SQft/" +b+" SQM"; }

# group: Set Sheet Parameters
list_create_6 = List.Create(item0=byNameNumberTitleBlockAndViews, item1=byNameNumberTitleBlockAndViews_2)
code_block_9 = CodeBlock { "Sheets: Category"; "14 MARKETING"; "Sheets: Subcategory"; "C1 Sales"; "C1 Purchaser"; }
ʳʰʸᵗʰᵐ_sheets_category = Rhythm.Revit.Elements.Elements.SetParameterByNameTypeOrInstance(element=list_create_6@L2, parameterName=code_block_9.out0, value=code_block_9.out1)
ʳʰʸᵗʰᵐ_sheets_subcategory_sales = Rhythm.Revit.Elements.Elements.SetParameterByNameTypeOrInstance(element=byNameNumberTitleBlockAndViews@L2, parameterName=code_block_9.out2, value=code_block_9.out3)
ʳʰʸᵗʰᵐ_sheets_subcategory = Rhythm.Revit.Elements.Elements.SetParameterByNameTypeOrInstance(element=byNameNumberTitleBlockAndViews_2@L2, parameterName=code_block_9.out2, value=code_block_9.out4)  # "ʳʰʸᵗʰᵐ|Sheets SubCategory - Purchaser"
list_create_7 = List.Create(item0=byNameNumberTitleBlockAndViews, item1=byNameNumberTitleBlockAndViews_2)
string_20 = StringInput("Sheets: Marketing Suite Name")
list_create_8 = List.Create(item0=valueAtKey_4, item1=valueAtKey_4)
marketing_suite_name_mun_number = Rhythm.Revit.Elements.Elements.SetParameterByNameTypeOrInstance(element=list_create_7@L2, parameterName=string_20, value=list_create_8@L2)
list_create_9 = List.Create(item0=byNameNumberTitleBlockAndViews, item1=byNameNumberTitleBlockAndViews_2)
string_21 = StringInput("Sheets: Type of Suite")
list_create_10 = List.Create(item0=valueAtKey_5, item1=valueAtKey_5)
ʳʰʸᵗʰᵐ_suite_type = Rhythm.Revit.Elements.Elements.SetParameterByNameTypeOrInstance(element=list_create_9@L2, parameterName=string_21, value=list_create_10@L2)
sales_purchaser_list = List.Create(item0=byNameNumberTitleBlockAndViews, item1=byNameNumberTitleBlockAndViews_2)
string_22 = StringInput("Sheets: Suite Area")
list_create_11 = List.Create(item0=suit_area_matric, item1=suit_area_matric)
ʳʰʸᵗʰᵐ_sheets_area_suite = Rhythm.Revit.Elements.Elements.SetParameterByNameTypeOrInstance(element=sales_purchaser_list@L2, parameterName=string_22, value=list_create_11@L2)
sales_purchaser_list_2 = List.Create(item0=byNameNumberTitleBlockAndViews, item1=byNameNumberTitleBlockAndViews_2)
string_23 = StringInput("Sheets: Terrace Area")
list_create_12 = List.Create(item0=terrace_area_metric, item1=terrace_area_metric)
ʳʰʸᵗʰᵐ_sheets_area_outside = Rhythm.Revit.Elements.Elements.SetParameterByNameTypeOrInstance(element=sales_purchaser_list_2@L2, parameterName=string_23, value=list_create_12@L2)

setCropRegion_2 = Custom[SetCropRegion](view=setViewTemplate_2, CurvesAsList=perimeterCurves)
byCurves = FilledRegion.ByCurves(view=views_sales_3, boundary=perimeterCurves, regionType=code_block_3.filledType)
byCurves_2 = FilledRegion.ByCurves(view=views_purchaser_2, boundary=perimeterCurves, regionType=code_block_3.filledType)
