# Dynamo graph WWPPublish-script.dyn (Dynamo 2.19.3.6394)
# packages: Data-Shapes 2022.2.105, WWP Packages 0.0.1

# group: Get Data From Excel
file_path = Filename("..\..\..\..\..\..\..\Sample Files\stats\WWP_Area Masterfile.xlsx")
file_from_path = FileObject(path=file_path)
code_block = CodeBlock { ["ABOVE GRADE", "BELOW GRADE"]; }
code_block_2 = CodeBlock { false; }
importExcel = Data.ImportExcel(file=file_from_path, sheetName=code_block, showExcel=code_block_2)

# group: Interface A/G U/G
code_block_3 = CodeBlock(e=importExcel) { e[0]; }
code_block_4 = CodeBlock { 3; }
dropItems = List.DropItems(list=code_block_3, amount=code_block_4)
transpose = List.Transpose(lists=dropItems)
code_block_5 = CodeBlock { 0; 9; }
slice = List.Slice(list=transpose, start=code_block_5.out0, end=code_block_5.out1)
area_names_a_g = CodeBlock(l=slice) { unittype=l[0]; on=l[2]; bc=l[6]; }
wwp_logo = Custom[WWP - Logo]()  # package WWP Packages; Black and White Logo
code_block_6 = CodeBlock { ["ON","BC"]; [true,false]; }
radiobuttons_data = Custom[RadioButtons Data](Keys=code_block_6.out0, Values=code_block_6.out1)  # package Data-Shapes; Create radio buttons input for UI.MultipleInputForm ++ .
code_block_7 = CodeBlock { true; }
multipleinputform = Custom[MultipleInputForm ++](Logo_optional=wwp_logo, Inputs=radiobuttons_data, Toggle=code_block_7)  # package Data-Shapes; Create a form with multiple inputs. see www.data-shapes.net for tutorials and infos!
firstItem = List.FirstItem(list=multipleinputform.User_Inputs)
on = RefactoredIf(test=firstItem, true=area_names_a_g.on, false=area_names_a_g.bc)

# group: Get Areas from B/G
categories = Categories("OST_Areas")
all_elements_of_category = ElementsOfCategory(Category=categories)
string = StringInput("Unit Type")
getParameterValueByName = Element.GetParameterValueByName(element=all_elements_of_category, parameterName=string)
code_block_8 = CodeBlock(e=importExcel) { e[1]; }
transpose_2 = List.Transpose(lists=code_block_8)
area_names_u_g = CodeBlock(l=transpose_2) { unittype=l[0]; on=l[2]; bc=l[3]; }
wwp_list_contains_multiple = Custom[WWP - List Contains Multiple](list=getParameterValueByName, searchfor=area_names_u_g.unittype)  # package WWP Packages; get result of list containing elements from other list
filterByBoolMask = List.FilterByBoolMask(list=all_elements_of_category, mask=wwp_list_contains_multiple)
string_2 = StringInput("Level")
getParameterValueByName_2 = Element.GetParameterValueByName(element=filterByBoolMask.in, parameterName=string_2)
code_block_9 = CodeBlock { "P"; }
contains = String.Contains(string=getParameterValueByName_2, searchFor=code_block_9)
filterByBoolMask_2 = List.FilterByBoolMask(list=filterByBoolMask.in, mask=contains)
wwp_list_contains_multiple_2 = Custom[WWP - List Contains Multiple](list=all_elements_of_category, searchfor=filterByBoolMask_2.in)
filterByBoolMask_3 = List.FilterByBoolMask(list=all_elements_of_category, mask=wwp_list_contains_multiple_2)
on_2 = RefactoredIf(test=firstItem, true=area_names_u_g.on, false=area_names_u_g.bc)

# group: Above Grade
code_block_10 = CodeBlock(aGrade=filterByBoolMask_3.out) { aGrade; }
string_3 = StringInput("Unit Type")
getParameterValueByName_3 = Element.GetParameterValueByName(element=code_block_10, parameterName=string_3)
indexOf = List.IndexOf(list=area_names_a_g.unittype, element=getParameterValueByName_3)
code_block_11 = CodeBlock { 0; }
gt = indexOf > code_block_11
filterByBoolMask_4 = List.FilterByBoolMask(list=code_block_10, mask=gt)
string_4 = StringInput("WWP_Area Parameter")
string_5 = StringInput("Unit Type")
getParameterValueByName_4 = Element.GetParameterValueByName(element=filterByBoolMask_4.in, parameterName=string_5)
indexOf_2 = List.IndexOf(list=area_names_a_g.unittype, element=getParameterValueByName_4)
getItemAtIndex = List.GetItemAtIndex(list=on, index=indexOf_2)
aboveGrade = Element.SetParameterByName(element=filterByBoolMask_4.in, parameterName=string_4, value=getItemAtIndex)

# group: Below Grade
code_block_12 = CodeBlock(bGrade=filterByBoolMask_3.in) { bGrade; }
string_6 = StringInput("Unit Type")
getParameterValueByName_5 = Element.GetParameterValueByName(element=code_block_12, parameterName=string_6)
indexOf_3 = List.IndexOf(list=area_names_u_g.unittype, element=getParameterValueByName_5)
code_block_13 = CodeBlock { 0; }
gt_2 = indexOf_3 > code_block_13
filterByBoolMask_5 = List.FilterByBoolMask(list=code_block_12, mask=gt_2)
string_7 = StringInput("WWP_Area Parameter")
string_8 = StringInput("Unit Type")
getParameterValueByName_6 = Element.GetParameterValueByName(element=filterByBoolMask_5.in, parameterName=string_8)
indexOf_4 = List.IndexOf(list=area_names_u_g.unittype, element=getParameterValueByName_6)
getItemAtIndex_2 = List.GetItemAtIndex(list=on_2, index=indexOf_4)
belowGrade = Element.SetParameterByName(element=filterByBoolMask_5.in, parameterName=string_7, value=getItemAtIndex_2)
