# Dynamo graph DeleteViews-script.dyn (Dynamo 2.6.2.15705)
# packages: Genius Loci 2021.11.10, archi-lab.net 2022.212.2722, Clockwork for Dynamo 2.x 2.3.0, Data-Shapes 2022.2.103

collector_of_views = Custom[Collector of Views]()  # package Genius Loci; Collects all views in the active or given document.
boolean = BoolSelector(true)
boolean_2 = BoolSelector(false)
code_block = CodeBlock()
# ---------- code_block.designscript (6 lines) ----------
"Do you want to sync now? ";
"WARNING!\n\nPlease NEVER run this on Original Model";
true;
"Sync Now";
"Sync Later";
"    yes/no";
# ----------------------------------------
file_path = Filename("R:\Graphics\Logos\New Kirkor Logo\Images\New Logo-01.png")
boolean_input = Custom[Boolean input](InputName=code_block.out1, DefaultValue=code_block.out2)  # package Data-Shapes; Creates a boolean input for UI.MultipleInputForm ++ . Check out www.data-shapes.net for more infos!
multipleinputform = Custom[MultipleInputForm ++](Description_optional=code_block.out0, Logo_optional=file_path, ButtonText_optional=code_block.out3, Inputs=boolean_input, Toggle=code_block.out2, CancelButtonText_optional=code_block.out4)  # package Data-Shapes; Create a form with multiple inputs. see www.data-shapes.net for tutorials and infos!
not_ = Not(x=multipleinputform.Was_Cancelled)
synchronizeWithCentral = Custom[Document.SynchronizeWithCentral](relinquishProjectStandardWorksets=boolean, relinquishViewWorksets=boolean, relinquishFamilyWorksets=boolean, relinquishUserCreatedWorksets=boolean, relinquishBorrowedElements=boolean, compactCentralModel=boolean_2, saveLocalFileBeforeSync=boolean, saveLocalFileAfterSync=boolean_2, runMe=not_)  # package Clockwork for Dynamo 2.x; Synchronizes a workshared model with the central model.
passThrough = Custom[PassThrough](passThrough=collector_of_views.Sheet, waitFor=synchronizeWithCentral)  # package archi-lab.net; Ripped this off from Clockwork. Sorry Andy.
string = StringInput("Sheets: Category")
getParameterValueByName = Element.GetParameterValueByName(element=passThrough, parameterName=string)
string_2 = StringInput("Choose the Phase to KEEP")
uniqueItems = List.UniqueItems(list=getParameterValueByName)
flatten = List.Flatten(list=uniqueItems)
listview_data = Custom[Listview Data](InputName=string_2, Keys=flatten, Values=flatten)  # package Data-Shapes; Create data for ListView input in UI.MultiInputForm ++ . Check out www.data-shapes.net for more infos.
code_block_2 = CodeBlock { true; }
multipleinputform_2 = Custom[MultipleInputForm ++](Logo_optional=file_path, Inputs=listview_data, Toggle=code_block_2)
firstItem = List.FirstItem(list=multipleinputform_2.User_Inputs)
python_script = Python(IN[0]=getParameterValueByName, IN[1]=firstItem)
# ---------- python_script.python (18 lines) ----------
# Load the Python Standard and DesignScript Libraries
import sys
import clr
clr.AddReference('ProtoGeometry')
from Autodesk.DesignScript.Geometry import *

list1=IN[0]
list2=IN[1]
list3=[]

for i in list1:
    if i in list2:
        result=True
    else:
        result=False
    list3.append(result)

OUT = list3
# ----------------------------------------
flatten_2 = List.Flatten(list=python_script)
filterByBoolMask = List.FilterByBoolMask(list=passThrough, mask=flatten_2)
delete = archilab.Revit.Elements.Elements.Delete(element=filterByBoolMask.out)
passthrough = Custom[Passthrough](passThrough=collector_of_views.Without_Sheet_All_Views, waitFor=delete)  # package Clockwork for Dynamo 2.x; Forces a sequential order of execution. The node wired into the output of the Passthrough node will be executed *after* the node wired into the waitFor input (e.g. important for some Revit operations). The value of the passThrough input will be passed on to the node wired into the output port of the Passthrough node.
delete_2 = archilab.Revit.Elements.Elements.Delete(element=passthrough)
lastItem = List.LastItem()  # unwired: list
