# Dynamo graph DeleteSheetnView-script.dyn (Dynamo 2.6.2.15705)
# packages: archi-lab.net 2022.212.2722, Data-Shapes 2022.2.103, Genius Loci 2021.11.10, Crumple 2022.2.13

collector_of_views = Custom[Collector of Views]()  # package Genius Loci; Collects all views in the active or given document.
string = StringInput("Sheets: Category")
getParameterValueByName = Element.GetParameterValueByName(element=collector_of_views.Sheet, parameterName=string)
string_2 = StringInput("Select Sheet Phases to Delete")
file_path = Filename("R:\Graphics\Logos\New Kirkor Logo\Images\New Logo-01.png")
code_block = CodeBlock { true; "Confirm, Delete Selected"; "Cancel"; }
uniqueItems = List.UniqueItems(list=getParameterValueByName)
flatten = List.Flatten(list=uniqueItems)
python_script = Python(IN[0]=flatten)
# ---------- python_script.python (14 lines) ----------
# Load the Python Standard and DesignScript Libraries
import sys
import clr
clr.AddReference('ProtoGeometry')
from Autodesk.DesignScript.Geometry import *

name= IN[0]
list = []

for i in name:
	if i == "":
		i = "???"
	list.append(i)
OUT = list
# ----------------------------------------
listview_data = Custom[Listview Data](Keys=python_script, Values=flatten)  # package Data-Shapes; Create data for ListView input in UI.MultiInputForm ++ . Check out www.data-shapes.net for more infos.
multipleinputform = Custom[MultipleInputForm ++](Description_optional=string_2, Logo_optional=file_path, ButtonText_optional=code_block.out1, Inputs=listview_data, Toggle=code_block.out0, CancelButtonText_optional=code_block.out2)  # package Data-Shapes; Create a form with multiple inputs. see www.data-shapes.net for tutorials and infos!
firstItem = List.FirstItem(list=multipleinputform.User_Inputs)
python_script_2 = Python(IN[0]=getParameterValueByName, IN[1]=firstItem)
# ---------- python_script_2.python (18 lines) ----------
# Load the Python Standard and DesignScript Libraries
import sys
import clr
clr.AddReference('ProtoGeometry')
from Autodesk.DesignScript.Geometry import *

list1=IN[0]
list2=IN[1]
list3=[]

for i in list1:
    if i in list2:
        result=True
    else:
        result=False
    list3.append(result)

OUT = list3
# ----------------------------------------
flatten_2 = List.Flatten(list=python_script_2)
filterByBoolMask = List.FilterByBoolMask(list=collector_of_views.Sheet, mask=flatten_2)
delete = archilab.Revit.Elements.Elements.Delete(element=filterByBoolMask.in)
code_block_2 = CodeBlock { true; }
contains = List.Contains(list=delete, item=code_block_2)
waitfor = Custom[© WaitFor](data=collector_of_views.View, waitFor=contains)  # package Crumple; Tells the first input to wait for the second input to arrive, then passes on the first input. Really useful for scripts which have branching paths that rely on their outputs to carry each other forward. Quite a few custom packages have a 'passthrough' or 'waitfor' node. I use these all the time, so find it useful to have them contained in this package also.
flatten_3 = List.Flatten(list=waitfor)
string_3 = StringInput("Sheet Number")
getParameterValueByName_2 = Element.GetParameterValueByName(element=flatten_3, parameterName=string_3)
views_without_sheet = Python(IN[0]=getParameterValueByName_2)
# ---------- views_without_sheet.python (21 lines) ----------
# Enable Python support and load DesignScript library
import clr
clr.AddReference('ProtoGeometry')
from Autodesk.DesignScript.Geometry import *

# The inputs to this node will be stored as a list in the IN variables.
dataEnteringNode = IN


list1= IN[0]
list2= ["","--- "," ",None]
newlist=[]

for i in list1:
	if i in list2:
		returns=False
	else:
		returns=True
	newlist.append(returns)
print(list1)
OUT = newlist
# ----------------------------------------
filterByBoolMask_2 = List.FilterByBoolMask(list=flatten_3, mask=views_without_sheet)
delete_2 = archilab.Revit.Elements.Elements.Delete(element=filterByBoolMask_2.in)
