# Dynamo graph DetailLinefromCAD2020-script.dyn (Dynamo 2.3.2.15696)
# packages: Data-Shapes 2022.2.105, WWP Packages 0.0.1, bimorphNodes 4.2.4, Crumple 2022.5.27, Clockwork for Dynamo 2.x 2.4.0

boolean = BoolSelector(true)
revit_currentview = Custom[© Revit.CurrentView](refresh=boolean)  # package Crumple; Given the current document, return the active view.
wwp_logo = Custom[WWP - Logo]()  # package WWP Packages; Black and White Logo
string = StringInput("Confirm")
string_2 = StringInput("Select a CAD file")
boolean_2 = BoolSelector(true)
selectmodelelements_data = Custom[SelectModelElements Data](InputName=string_2, SelectSingleElement=boolean_2)  # package Data-Shapes; Creates a Revit element selection input for UI.MultipleInputForm++ . Check out www.data-shapes.net for more infos!
string_3 = StringInput("Cancel")
multipleinputform = Custom[MultipleInputForm ++](Logo_optional=wwp_logo, ButtonText_optional=string, Inputs=selectmodelelements_data, Toggle=boolean_2, CancelButtonText_optional=string_3)  # package Data-Shapes; Create a form with multiple inputs. see www.data-shapes.net for tutorials and infos!
firstItem = List.FirstItem(list=multipleinputform.User_Inputs)
wwp_logo_2 = Custom[WWP - Logo]()
string_4 = StringInput("Confirm Layer")
string_5 = StringInput("Select the layer")
layerNames = Revit.ImportInstance.LayerNames(importInstance=firstItem)
listview_data = Custom[Listview Data](InputName=string_5, Keys=layerNames, Values=layerNames)  # package Data-Shapes; Create data for ListView input in UI.MultiInputForm ++ . Check out www.data-shapes.net for more infos.
boolean_3 = BoolSelector(true)
multipleinputform_2 = Custom[MultipleInputForm ++](Logo_optional=wwp_logo_2, ButtonText_optional=string_4, Inputs=listview_data, Toggle=boolean_3)
firstItem_2 = List.FirstItem(list=multipleinputform_2.User_Inputs)
curvesFromCADLayers = CAD.CurvesFromCADLayers(importInstance=firstItem, layerNames=firstItem_2)
byCurve = DetailCurve.ByCurve(view=revit_currentview, curve=curvesFromCADLayers.Curve)
code_block = CodeBlock(n=curvesFromCADLayers.layerKeys) { "DetailGrp_"+n; }
fromElements = Custom[Group.FromElements](elements=byCurve, groupName=code_block, lacing=Shortest)  # package Clockwork for Dynamo 2.x; Creates a group from a list of Revit elements
