# Dynamo graph Fire Line-script.dyn (Dynamo 2.19.3.6394)
# packages: archi-lab.net 2020.23.13, Clockwork for Dynamo 2.x 2.4.0, Crumple 2022.5.27

all_elements_in_active_view = ElementsInView()
code_block = CodeBlock { "Walls"; }
getCategory = Element.GetCategory(element=all_elements_in_active_view)
code_block_2 = CodeBlock(e=getCategory) { e.Name; }
eq = code_block == code_block_2
filterByBoolMask = List.FilterByBoolMask(list=all_elements_in_active_view, mask=eq)
boolean = BoolSelector(true)
revit_currentview = Custom[© Revit.CurrentView](refresh=boolean)  # package Crumple; Given the current document, return the active view.

# group: FIRE LINE
getLocation = Element.GetLocation(element=filterByBoolMask.in)
fromCurve = Custom[DetailLine.FromCurve](curve=getLocation, view=revit_currentview)  # package Clockwork for Dynamo 2.x; Creates a detail line based on a given curve. Unlike the OOTB node it can also draw circles.
code_block_3 = CodeBlock { "Line Style"; }
line_styles = LineStyleUi("WWP - FRR - PH")  # graph input
setParameterByName = Element.SetParameterByName(element=fromCurve, parameterName=code_block_3, value=line_styles)
