# Dynamo graph Swap Detail Line to Component-script.dyn (Dynamo 2.19.3.6394)
# packages: Crumple 2024.4.3, Clockwork for Dynamo 2.x 2.6.0

categories = Categories("OST_Lines")
start = Revit.Transaction.Transaction.Start(input=categories)
revit_currentview = Custom[© Revit.CurrentView]()  # package Crumple; Given the current document, return the active view.
all_elements_of_category_in_view = ElementsOfCategoryInView(Category=start, View=revit_currentview)

# group: Filter 0H
code_block = CodeBlock { "Line Style"; }
getParameterValueByName = Element.GetParameterValueByName(element=all_elements_of_category_in_view, parameterName=code_block)
code_block_2 = CodeBlock(e=getParameterValueByName) { e.Name; }
code_block_3 = CodeBlock { "FRR - 0H"; }
contains = String.Contains(string=code_block_2, searchFor=code_block_3)
filterByBoolMask = List.FilterByBoolMask(list=all_elements_of_category_in_view, mask=contains)

curve = DetailCurve.Curve(detailCurve=filterByBoolMask.in)
family_types = FamilyTypes("WWP_FireRating_FRR Line Based:Textline 0min FRR")
byCurve = Custom[DetailComponent.ByCurve](curve=curve, familyType=family_types, view=revit_currentview)  # package Clockwork for Dynamo 2.x; Places a line-based detail component in a given view

# group: Filter 3/4H
code_block_4 = CodeBlock { "Line Style"; }
getParameterValueByName_2 = Element.GetParameterValueByName(element=all_elements_of_category_in_view, parameterName=code_block_4)
code_block_5 = CodeBlock(e=getParameterValueByName_2) { e.Name; }
code_block_6 = CodeBlock { "FRR - 3/4H"; }
contains_2 = String.Contains(string=code_block_5, searchFor=code_block_6)
filterByBoolMask_2 = List.FilterByBoolMask(list=all_elements_of_category_in_view, mask=contains_2)

curve_2 = DetailCurve.Curve(detailCurve=filterByBoolMask_2.in)
family_types_2 = FamilyTypes("WWP_FireRating_FRR Line Based:Textline 45min FRR")
byCurve_2 = Custom[DetailComponent.ByCurve](curve=curve_2, familyType=family_types_2, view=revit_currentview)

# group: Filter 1.5H
code_block_7 = CodeBlock { "Line Style"; }
getParameterValueByName_3 = Element.GetParameterValueByName(element=all_elements_of_category_in_view, parameterName=code_block_7)
code_block_8 = CodeBlock(e=getParameterValueByName_3) { e.Name; }
code_block_9 = CodeBlock { "FRR - 1.5H"; }
contains_3 = String.Contains(string=code_block_8, searchFor=code_block_9)
filterByBoolMask_3 = List.FilterByBoolMask(list=all_elements_of_category_in_view, mask=contains_3)

curve_3 = DetailCurve.Curve(detailCurve=filterByBoolMask_3.in)
family_types_3 = FamilyTypes("WWP_FireRating_FRR Line Based:Textline 90min FRR")
byCurve_3 = Custom[DetailComponent.ByCurve](curve=curve_3, familyType=family_types_3, view=revit_currentview)

# group: Filter 2H
code_block_10 = CodeBlock { "Line Style"; }
getParameterValueByName_4 = Element.GetParameterValueByName(element=all_elements_of_category_in_view, parameterName=code_block_10)
code_block_11 = CodeBlock(e=getParameterValueByName_4) { e.Name; }
code_block_12 = CodeBlock { "FRR - 2H"; }
contains_4 = String.Contains(string=code_block_11, searchFor=code_block_12)
filterByBoolMask_4 = List.FilterByBoolMask(list=all_elements_of_category_in_view, mask=contains_4)

curve_4 = DetailCurve.Curve(detailCurve=filterByBoolMask_4.in)
family_types_4 = FamilyTypes("WWP_FireRating_FRR Line Based:Textline 120min FRR")
byCurve_4 = Custom[DetailComponent.ByCurve](curve=curve_4, familyType=family_types_4, view=revit_currentview)

# group: Filter 3H
code_block_13 = CodeBlock { "Line Style"; }
getParameterValueByName_5 = Element.GetParameterValueByName(element=all_elements_of_category_in_view, parameterName=code_block_13)
code_block_14 = CodeBlock(e=getParameterValueByName_5) { e.Name; }
code_block_15 = CodeBlock { "FRR - 3H"; }
contains_5 = String.Contains(string=code_block_14, searchFor=code_block_15)
filterByBoolMask_5 = List.FilterByBoolMask(list=all_elements_of_category_in_view, mask=contains_5)

curve_5 = DetailCurve.Curve(detailCurve=filterByBoolMask_5.in)
family_types_5 = FamilyTypes("WWP_FireRating_FRR Line Based:Textline 180min FRR")
byCurve_5 = Custom[DetailComponent.ByCurve](curve=curve_5, familyType=family_types_5, view=revit_currentview)

# group: Filter 1H
code_block_16 = CodeBlock { "Line Style"; }
getParameterValueByName_6 = Element.GetParameterValueByName(element=all_elements_of_category_in_view, parameterName=code_block_16)
code_block_17 = CodeBlock(e=getParameterValueByName_6) { e.Name; }
code_block_18 = CodeBlock { "FRR - 1H"; }
contains_6 = String.Contains(string=code_block_17, searchFor=code_block_18)
filterByBoolMask_6 = List.FilterByBoolMask(list=all_elements_of_category_in_view, mask=contains_6)

curve_6 = DetailCurve.Curve(detailCurve=filterByBoolMask_6.in)
family_types_6 = FamilyTypes("WWP_FireRating_FRR Line Based:Textline 60min FRR")
byCurve_6 = Custom[DetailComponent.ByCurve](curve=curve_6, familyType=family_types_6, view=revit_currentview)
end = Revit.Transaction.Transaction.End(input=byCurve_6)
