# Dynamo graph Fire Rating All Views-script.dyn (Dynamo 2.19.3.6394)
# packages: Clockwork for Dynamo 2.x 2.4.0, archi-lab.net 2020.23.13, Crumple 2022.5.27, Data-Shapes 2022.2.105

categories = Categories("OST_Walls")

# group: All FRR Views
categories_2 = Categories("OST_Views")
all_elements_of_category = ElementsOfCategory(Category=categories_2)
code_block = CodeBlock(e=all_elements_of_category) { e.Name; }
string = StringInput("FRR")
contains = String.Contains(string=code_block, searchFor=string)
code_block_2 = CodeBlock { false; }
list_replacenulls = Custom[© List.ReplaceNulls](lst=contains, replace=code_block_2)  # package Crumple; Replaces all nulls with a given substitute.
filterByBoolMask = List.FilterByBoolMask(list=all_elements_of_category, mask=list_replacenulls)
code_block_3 = CodeBlock(e=filterByBoolMask.in) { e.Name; }
string_2 = StringInput("Dependent")
contains_2 = String.Contains(string=code_block_3, searchFor=string_2)
list_frr_views = List.FilterByBoolMask(list=filterByBoolMask.in, mask=contains_2)

all_elements_of_category_in_view = ElementsOfCategoryInView(Category=categories, View=list_frr_views.out)
isNotEmpty = Custom[List.IsNotEmpty](seq=all_elements_of_category_in_view@L2)  # package Clockwork for Dynamo 2.x; Just the inversion of the built-in Is Empty List node.
code_block_4 = CodeBlock { false; }
list_replacenulls_2 = Custom[© List.ReplaceNulls](lst=isNotEmpty, replace=code_block_4)
filter_elements_in_applicable = List.FilterByBoolMask(list=all_elements_of_category_in_view, mask=list_replacenulls_2)  # "Filter(Elements in Applicable Views)"
filter_applicable_views = List.FilterByBoolMask(list=list_frr_views.out, mask=list_replacenulls_2)

# group: Delete Existing
all_elements_in_view_s = Custom[All Elements In View(s)](Views=filter_applicable_views.in)  # package Data-Shapes; Retrieves all visible element in a view or a set of views
getCategory = Element.GetCategory(element=all_elements_in_view_s)
code_block_5 = CodeBlock(e=getCategory) { e.Name; }
code_block_6 = CodeBlock { "Lines"; }
eq = code_block_5 == code_block_6
filterByBoolMask_2 = List.FilterByBoolMask(list=all_elements_in_view_s, mask=eq)
code_block_7 = CodeBlock { "Line Style"; }
getParameterValueByName = Element.GetParameterValueByName(element=filterByBoolMask_2.in, parameterName=code_block_7)
code_block_8 = CodeBlock(e=getParameterValueByName) { e.Name; }
code_block_9 = CodeBlock { "FRR"; }
contains_3 = String.Contains(string=code_block_8, searchFor=code_block_9)
filterByBoolMask_3 = List.FilterByBoolMask(list=filterByBoolMask_2.in, mask=contains_3)
delete = archilab.Revit.Elements.Elements.Delete(element=filterByBoolMask_3.in)

frr_walls_input_prompt = Python()  # CPython3; unwired: IN[0]
# ---------- frr_walls_input_prompt.python (50 lines) ----------
import clr
clr.AddReference('System.Windows.Forms')
from System.Windows.Forms import Form, Label, TextBox, Button, DialogResult

# Create a custom input dialog box
class InputDialog(Form):
    def __init__(self, prompt="Enter value:", default_value="FRR Walls"):
        self.Text = "User Input"
        self.Width = 300
        self.Height = 150
        self.StartPosition = 1  # Center the form

        self.label = Label()
        self.label.Text = prompt
        self.label.Top = 10
        self.label.Left = 10
        self.label.Width = 260
        self.Controls.Add(self.label)

        self.textBox = TextBox()
        self.textBox.Text = default_value
        self.textBox.Top = 40
        self.textBox.Left = 10
        self.textBox.Width = 260
        self.Controls.Add(self.textBox)

        self.okButton = Button()
        self.okButton.Text = "OK"
        self.okButton.DialogResult = DialogResult.OK
        self.okButton.Top = 70
        self.okButton.Left = 100
        self.Controls.Add(self.okButton)

        self.AcceptButton = self.okButton  # Pressing Enter will confirm the input

    def get_value(self):
        return self.textBox.Text

# Run the dialog and get user input
dialog = InputDialog("What is the name of the Instance Parameter associated with your walls?")
result = dialog.ShowDialog()

# Output the value if OK was clicked
if result == DialogResult.OK:
    output = dialog.get_value()
else:
    output = None  # If the user cancels, return None

# Dynamo Output
OUT = output
# ----------------------------------------

# group: Get All Fire Ratings
flow_waitfor = Custom[© Flow.WaitFor](data=filter_elements_in_applicable.in, waitFor=delete)  # package Crumple; Tells the first input to wait for the second input to arrive, then passes on the first input. Really useful for scripts which have branching paths that rely on their outputs to carry each other forward. Quite a few custom packages have a 'passthrough' or 'waitfor' node. I use these all the time, so find it useful to have them contained in this package also.
getParameterValueByName_2 = Element.GetParameterValueByName(element=flow_waitfor, parameterName=frr_walls_input_prompt)

# group: 1 HR FIRE RATING
string_3 = StringInput("1HR")  # graph input
contains_4 = String.Contains(string=getParameterValueByName_2, searchFor=string_3)
filterByBoolMask_4 = List.FilterByBoolMask(list=filter_elements_in_applicable.in, mask=contains_4)
getLocation = Element.GetLocation(element=filterByBoolMask_4.in@L2)
fromCurve = Custom[DetailLine.FromCurve](curve=getLocation, view=filter_applicable_views.in, lacing=Longest)  # package Clockwork for Dynamo 2.x; Creates a detail line based on a given curve. Unlike the OOTB node it can also draw circles.
code_block_10 = CodeBlock { "Line Style"; }
line_styles = LineStyleUi("WWP - FRR - 1H")  # graph input
setParameterByName = Element.SetParameterByName(element=fromCurve@L2, parameterName=code_block_10, value=line_styles)

# group: 1.5 HR FIRE RATING
string_4 = StringInput("1.5HR")  # graph input
contains_5 = String.Contains(string=getParameterValueByName_2, searchFor=string_4)
filterByBoolMask_5 = List.FilterByBoolMask(list=filter_elements_in_applicable.in, mask=contains_5)
getLocation_2 = Element.GetLocation(element=filterByBoolMask_5.in@L2)
fromCurve_2 = Custom[DetailLine.FromCurve](curve=getLocation_2, view=filter_applicable_views.in, lacing=Longest)
code_block_11 = CodeBlock { "Line Style"; }
line_styles_2 = LineStyleUi("WWP - FRR - 1.5H")  # graph input
setParameterByName_2 = Element.SetParameterByName(element=fromCurve_2@L2, parameterName=code_block_11, value=line_styles_2)

# group: 0 HR FIRE RATING
string_5 = StringInput("0HR")  # graph input
contains_6 = String.Contains(string=getParameterValueByName_2, searchFor=string_5)
filterByBoolMask_6 = List.FilterByBoolMask(list=filter_elements_in_applicable.in, mask=contains_6)
getLocation_3 = Element.GetLocation(element=filterByBoolMask_6.in@L2)
fromCurve_3 = Custom[DetailLine.FromCurve](curve=getLocation_3, view=filter_applicable_views.in, lacing=Longest)
code_block_12 = CodeBlock { "Line Style"; }
line_styles_3 = LineStyleUi("WWP - FRR - 0H")  # graph input
setParameterByName_3 = Element.SetParameterByName(element=fromCurve_3, parameterName=code_block_12, value=line_styles_3)

# group: 2 HR FIRE RATING
string_6 = StringInput("2HR")  # graph input
contains_7 = String.Contains(string=getParameterValueByName_2, searchFor=string_6)
filterByBoolMask_7 = List.FilterByBoolMask(list=filter_elements_in_applicable.in, mask=contains_7)
getLocation_4 = Element.GetLocation(element=filterByBoolMask_7.in@L2)
fromCurve_4 = Custom[DetailLine.FromCurve](curve=getLocation_4, view=filter_applicable_views.in, lacing=Longest)
code_block_13 = CodeBlock { "Line Style"; }
line_styles_4 = LineStyleUi("WWP - FRR - 2H")  # graph input
setParameterByName_4 = Element.SetParameterByName(element=fromCurve_4@L2, parameterName=code_block_13, value=line_styles_4)

# group: 3 HR FIRE RATING
string_7 = StringInput("3HR")  # graph input
contains_8 = String.Contains(string=getParameterValueByName_2, searchFor=string_7)
filterByBoolMask_8 = List.FilterByBoolMask(list=filter_elements_in_applicable.in, mask=contains_8)
getLocation_5 = Element.GetLocation(element=filterByBoolMask_8.in@L2)
fromCurve_5 = Custom[DetailLine.FromCurve](curve=getLocation_5, view=filter_applicable_views.in, lacing=Longest)
code_block_14 = CodeBlock { "Line Style"; }
line_styles_5 = LineStyleUi("WWP - FRR - 3H")  # graph input
setParameterByName_5 = Element.SetParameterByName(element=fromCurve_5@L2, parameterName=code_block_14, value=line_styles_5)

# group: 3/4 HR FIRE RATING
string_8 = StringInput(".75HR")  # graph input
contains_9 = String.Contains(string=getParameterValueByName_2, searchFor=string_8)
filterByBoolMask_9 = List.FilterByBoolMask(list=filter_elements_in_applicable.in, mask=contains_9)
getLocation_6 = Element.GetLocation(element=filterByBoolMask_9.in@L2)
fromCurve_6 = Custom[DetailLine.FromCurve](curve=getLocation_6, view=filter_applicable_views.in, lacing=Longest)
code_block_15 = CodeBlock { "Line Style"; }
line_styles_6 = LineStyleUi("WWP - FRR - 3/4H")  # graph input
setParameterByName_6 = Element.SetParameterByName(element=fromCurve_6@L2, parameterName=code_block_15, value=line_styles_6)
