# Dynamo graph parking2room-script.dyn (Dynamo 2.19.3.6394)
# packages: Genius Loci 2023.2.21, archi-lab.net 2020.23.13, Crumple 2024.4.3

categories = Categories("OST_Rooms")
boolean = BoolSelector(false)
revit_currentview = Custom[© Revit.CurrentView](refresh=boolean)  # package Crumple; Given the current document, return the active view.
all_elements_of_category_in_view = ElementsOfCategoryInView(Category=categories, View=revit_currentview)
code_block = CodeBlock { "Occupancy"; }
room_toelement = Custom[Room ToElement](room=all_elements_of_category_in_view)  # package Genius Loci; Reports the elements of the current or linked model that are inside the given room of the current document.
code_block_2 = CodeBlock { "Parking"; }
getCategory = Element.GetCategory(element=room_toelement)
string_from_object = FromObject(obj=getCategory)
eq = code_block_2 == string_from_object
filterByBoolMask = List.FilterByBoolMask(list=room_toelement, mask=eq)
type = archilab.Revit.Elements.Elements.Type(element=filterByBoolMask.in)
code_block_3 = CodeBlock { "Stall Type"; }
getParameterValueByName = Element.GetParameterValueByName(element=filterByBoolMask.in, parameterName=code_block_3, lacing=Longest)
groupByKey = List.GroupByKey(list=type, keys=getParameterValueByName, lacing=Longest)
code_block_4 = CodeBlock { "Parking Count"; }
getParameterValueByName_2 = Element.GetParameterValueByName(element=groupByKey.groups, parameterName=code_block_4, lacing=Longest)
python_script = Python(IN[0]=getParameterValueByName_2, IN[1]=groupByKey.uniqueKeys)  # CPython3
# ---------- python_script.python (21 lines) ----------
# Get inputs from Dynamo
input_list = IN[0]
input_list_2 = IN[1]

# Process each sublist in the input_list
output_list = []

for sublist, sublist_2 in zip(input_list, input_list_2): # iterate over input_list and input_list_2 in parallel
    if sublist: # iterate all parkings in each room
        type_list = []
        for e, f in zip(sublist, sublist_2): # iterate all parking types in parking group
            sum_of_elements = sum(int(element) for element in e)
            type_list.append(f + ":" + str(sum_of_elements))
        type_list.sort()  # Sort the type_list
        joined_type_list = " \n".join(type_list)  # Join the string elements of type_list
        output_list.append(joined_type_list)
    else:
        output_list.append("N/A")

# Output the modified list
OUT = output_list
# ----------------------------------------
setParameterByName = Element.SetParameterByName(element=all_elements_of_category_in_view, parameterName=code_block, value=python_script)
isEmpty = List.IsEmpty(list=getParameterValueByName_2, lacing=Longest)  # frozen
filterByBoolMask_2 = List.FilterByBoolMask(list=setParameterByName, mask=isEmpty)  # frozen
