# Dynamo graph ProjectSetup-script.dyn (Dynamo 2.19.3.6394)
# packages: SvN Packages 0.0.1, Crumple 2024.4.3, Data-Shapes 2025.3.118, spring nodes 210.1.1

code_block = CodeBlock { "EXPORT SCHEDULE"; "EXPORT"; "CANCEL"; 900; 600; 200; }
svn_logo = Custom[SvN - Logo]()  # package SvN Packages; Black and White Logo
code_block_2 = CodeBlock { "SCHEDULES"; 400; true; false; }
# note: Custom Node: Crumple v.2021.5.27
schedulesbytype = Custom[© SchedulesByType]()  # package Crumple; Returns all schedules in a document, separated into key and non-key schedules.
name = Element.Name(element=schedulesbytype.schedules)
listview_data = Custom[Listview Data](InputName=code_block_2.out0, Keys=name, Values=schedulesbytype.schedules, Height_optionnal=code_block_2.out1, HilightInView_optionnal=code_block_2.out3, DisplayModeOnly_optionnal=code_block_2.out3, ShowElementCount_optionnal=code_block_2.out3, SortItems_optionnal=code_block_2.out2, ShowId_optionnal=code_block_2.out3)  # package Data-Shapes; Create data for ListView input in UI.MultiInputForm ++ . Check out www.data-shapes.net for more infos.
code_block_3 = CodeBlock { "FILE PATH"; "Select a folder..."; }
# note: Custom Node: Data-Shapes v.2021.2.94
directorypath_data = Custom[DirectoryPath Data](InputName=code_block_3.out0, ButtonText=code_block_3.out1)  # package Data-Shapes; Creates a DirectoryPath input for UI.MultipleInputForm ++ . Check out www.data-shapes.net for more infos!
list_create = List.Create(item0=listview_data, item1=directorypath_data)
boolean = BoolSelector(true)
multipleinputform = Custom[MultipleInputForm ++](Description_optional=code_block.out0, Logo_optional=svn_logo, ButtonText_optional=code_block.out1, Inputs=list_create, Toggle=boolean, CancelButtonText_optional=code_block.out2, MaxHeight_optional=code_block.out3, Width_optional=code_block.out4, LabelWidth_optional=code_block.out5)  # package Data-Shapes; Create a form with multiple inputs. see www.data-shapes.net for tutorials and infos!
code_block_4 = CodeBlock(out=multipleinputform.User_Inputs) { sched = out[0]; path  = out[1]; }
string = StringInput("\")
name_2 = Element.Name(element=code_block_4.sched)
code_block_5 = CodeBlock(fileFolder=code_block_4.path, append=string, name=name_2) { filePath=fileFolder+append+name+".csv"; }
export_column_headers = ExportColumnHeaders("MultipleRows")
byProperties = Revit.Schedules.ScheduleExportOptions.ByProperties(columnHeaders=export_column_headers, headersFootersBlanks=export_column_headers, title=export_column_headers)
export = ScheduleView.Export(scheduleView=code_block_4.sched, path=code_block_5, exportOptions=byProperties)
categories = Categories("OST_ProjectInformation")
all_elements_of_category = ElementsOfCategory(Category=categories)
code_block_6 = CodeBlock { ["Stat Path","Schedule List"]; ""; }
if_ = RefactoredIf(test=multipleinputform.Was_Cancelled, true=code_block_6.out1, false=code_block_6.out0)
ꟿ_list_tostring = Custom[ꟿ List.ToString](list=name_2)  # package spring nodes; Serializes a (nested) list or dictionary of basic objects into a valid design script syntax string.
list_create_2 = List.Create(item0=code_block_4.path, item1=ꟿ_list_tostring)
setParameterByName = Element.SetParameterByName(element=all_elements_of_category, parameterName=if_, value=list_create_2, lacing=Longest)
