# Dynamo graph ProjectUpdat-script.dyn "ProjectUpdat-script2" (Dynamo 2.19.3.6394)
# packages: Crumple 2024.4.3, WWP Packages 0.0.1

schedulesbytype = Custom[© SchedulesByType]()  # package Crumple; Returns all schedules in a document, separated into key and non-key schedules.
name = Element.Name(element=schedulesbytype.schedules)
element_types = ElementTypes("ProjectInfo")
all_elements_of_type = ElementsOfType(element_class=element_types)
code_block = CodeBlock { ["Stat Path","Schedule List"]; }
getParameterValueByName = Element.GetParameterValueByName(element=all_elements_of_type, parameterName=code_block, lacing=Longest)
code_block_2 = CodeBlock(l=getParameterValueByName) { l[0]; l[1]; }
code_block_3 = CodeBlock(filepath=code_block_2.out0)
# ---------- code_block_3.designscript (2 lines) ----------
"Are you sure to run script and save csv to \n"
+filepath + " ?";
# ----------------------------------------
wwp_popup_w_buttons = Custom[WWP - Popup w/ Buttons](content=code_block_3)  # package WWP Packages; Pop - up Dialog for boolean
code_block_4 = CodeBlock { ""; }
if_ = If(test=wwp_popup_w_buttons, true=code_block_2.out1, false=code_block_4)
firstItem = List.FirstItem(list=if_)
python_script = Python(IN[0]=firstItem)  # IronPython2
# ---------- python_script.python (8 lines) ----------
import sys

parameter_string = IN[0]  

cleaned_string = parameter_string.replace("[", "").replace("]", "").replace('"', "").replace("'", "")
text_list = [item.strip() for item in cleaned_string.split(",")]

OUT = text_list
# ----------------------------------------
indexOf = List.IndexOf(list=name, element=python_script)
getItemAtIndex = List.GetItemAtIndex(list=schedulesbytype.schedules, index=indexOf)
string = StringInput("\")
name_2 = Element.Name(element=getItemAtIndex)
code_block_5 = CodeBlock(fileFolder=code_block_2.out0, append=string, name=name_2) { filePath=fileFolder+append+name+".csv"; }
export_column_headers = ExportColumnHeaders("MultipleRows")
byProperties = Revit.Schedules.ScheduleExportOptions.ByProperties(columnHeaders=export_column_headers, headersFootersBlanks=export_column_headers, title=export_column_headers)
export = ScheduleView.Export(scheduleView=getItemAtIndex, path=code_block_5, exportOptions=byProperties)
