# Dynamo graph ProjectUpdat-script2.dyn "ProjectUpdat-script" (Dynamo 2.3.2.15696)
# packages: WWP Packages 0.0.1, bimorphNodes 4.2.4, Crumple 2022.5.27

element_types = ElementTypes("ProjectInfo")
all_elements_of_type = ElementsOfType(element_type=element_types)
code_block = CodeBlock { ["Stat Path","Schedule List"]; }
getParameterValueByName = Element.GetParameterValueByName(element=all_elements_of_type, parameterName=code_block, lacing=Longest)
code_block_2 = CodeBlock(l=getParameterValueByName) { l[0]; l[1]; }
code_block_3 = CodeBlock(filepath=code_block_2.out0)
# ---------- code_block_3.designscript (2 lines) ----------
"Are you sure you closed the file under\n"
+filepath;
# ----------------------------------------
wwp_popup_w_buttons = Custom[WWP - Popup w/ Buttons](content=code_block_3)  # package WWP Packages; Pop - up Dialog for boolean
code_block_4 = CodeBlock { ""; }
if_ = If(test=wwp_popup_w_buttons, true=code_block_2.out0, false=code_block_4)
# note: Custom Node: Crumple v.2021.5.27
schedulesbytype = Custom[© SchedulesByType]()  # package Crumple; Returns all schedules in a document, separated into key and non-key schedules.
name = Element.Name(element=schedulesbytype.schedules)
wwp_string_to_list = Custom[WWP - String to List](str=code_block_2.out1)  # package WWP Packages; Make string list elements to list of strings
indexOf = List.IndexOf(list=name, element=wwp_string_to_list)
getItemAtIndex = List.GetItemAtIndex(list=schedulesbytype.schedules, index=indexOf)
name_2 = Element.Name(element=getItemAtIndex)
# note: Custom Node: BimorphNodes v.3.0.3
code_block_5 = CodeBlock { 0; }
code_block_6 = CodeBlock { false; }
getData = Revit.Schedule.GetData(scheduleView=getItemAtIndex, refresh=code_block_6)
boolean = BoolSelector(true)
exportExcel = Data.ExportExcel(filePath=if_, sheetName=name_2, startRow=code_block_5, startCol=code_block_5, data=getData, overWrite=boolean, lacing=Longest)
