# Dynamo graph KeyPlan-script.dyn (Dynamo 2.6.2.15705)
# packages: Crumple 2022.2.13, Rhythm 2022.1.5, Data-Shapes 2022.2.103, spring nodes 210.1.1, archi-lab.net 2022.212.2722

# group: Select Areas
boolean = BoolSelector(true)
ꟿ_collect_currentselection = Custom[ꟿ Collect.CurrentSelection](refresh=boolean)  # package spring nodes; Gets the currently selected elements. Connect a boolean switch to refresh the selection.
string = StringInput("Number")
getParameterValueByName = Element.GetParameterValueByName(element=ꟿ_collect_currentselection, parameterName=string)

# group: Make Dictionary/ sort by Parameter: number
groupByKey = List.GroupByKey(list=ꟿ_collect_currentselection, keys=getParameterValueByName)
string_2 = StringInput("Name")
getParameterValueByName_2 = Element.GetParameterValueByName(element=groupByKey.groups, parameterName=string_2)
string_3 = StringInput("Area")
getParameterValueByName_3 = Element.GetParameterValueByName(element=groupByKey.groups, parameterName=string_3)
id = Element.Id(element=groupByKey.groups)
string_4 = StringInput("Areas: Municipal Number")
getParameterValueByName_4 = Element.GetParameterValueByName(element=groupByKey.groups, parameterName=string_4)
string_5 = StringInput("Areas: Area Use")
getParameterValueByName_5 = Element.GetParameterValueByName(element=groupByKey.groups, parameterName=string_5)
list_create = List.Create(item0=groupByKey.unique_keys, item1=getParameterValueByName_2, item2=getParameterValueByName_3, item3=id, item4=getParameterValueByName_4, item5=getParameterValueByName_5)
transpose = List.Transpose(lists=list_create)
create_suite_dictionary = Python(IN[0]=transpose)
# ---------- create_suite_dictionary.python (37 lines) ----------
# Load the Python Standard and DesignScript Libraries
import sys
import clr
clr.AddReference('ProtoGeometry')
from Autodesk.DesignScript.Geometry import *

# The inputs to this node will be stored as a list in the IN variables.
dataEnteringNode = IN
unitList=IN[0]
resultList=[]

# Place your code below this line
for i in unitList:
	dictUnit={}
	dictUnit["AreaNumber"]=i[0]
	
	for (x,y,z,m,ar) in zip(i[1],i[2],i[3],i[4],i[5]):
		
		if x == "Balcony" or x == "BALCONY":
			dictUnit["BalconyArea"]=y
			dictUnit["BalconyID"]=z
			dictUnit["BalconyType"]=x
		elif x == "Terrace" or x == "TERRACE":
			dictUnit["TerraceArea"]=y
			dictUnit["TerraceID"]=z
			dictUnit["TerraceType"]=x
		else:
			dictUnit["SuiteArea"]=y
			dictUnit["SuiteID"]=z
			dictUnit["SuiteType"]=x
			dictUnit["ManicipalNumber"]=m
			dictUnit["AreaUse"]=ar
	resultList.append(dictUnit)


# Assign your output to the OUT variable.
OUT = resultList
# ----------------------------------------

# group: Get Value from Dictionary
string_6 = StringInput("SuiteArea")
suite_area_metric = DesignScript.Builtin.Dictionary.ValueAtKey(dictionary=create_suite_dictionary, key=string_6)
string_7 = StringInput("SuiteType")
suite_types = DesignScript.Builtin.Dictionary.ValueAtKey(dictionary=create_suite_dictionary, key=string_7)
string_8 = StringInput("TerraceID")
outside_id = DesignScript.Builtin.Dictionary.ValueAtKey(dictionary=create_suite_dictionary, key=string_8)
string_9 = StringInput("TerraceArea")
outside_area = DesignScript.Builtin.Dictionary.ValueAtKey(dictionary=create_suite_dictionary, key=string_9)
string_10 = StringInput("TerraceType")
outside_area_type = DesignScript.Builtin.Dictionary.ValueAtKey(dictionary=create_suite_dictionary, key=string_10)
python_script = Python(IN[0]=outside_id, IN[1]=outside_area, IN[2]=outside_area_type)
# ---------- python_script.python (27 lines) ----------
# Load the Python Standard and DesignScript Libraries
import sys
import clr
clr.AddReference('ProtoGeometry')
from Autodesk.DesignScript.Geometry import *

# The inputs to this node will be stored as a list in the IN variables.
dataEnteringNode = IN
listD1=IN[0]
listD2=IN[1]
listD3=IN[2]
organizedL3=[]
organizedL1=[]
organizedL2=[]
# Place your code below this line
for (x,y,z) in zip(listD1,listD2,listD3):
	if x == None:
		x=""
	organizedL1.append(x)
	if y == None:
		y=""
	organizedL2.append(y)
	if z == None:
		z=""
	organizedL3.append(y)
# Assign your output to the OUT variable.
OUT = [organizedL3,organizedL1,organizedL2]
# ----------------------------------------
terraceArea = List.FirstItem(list=python_script)
string_11 = StringInput("ManicipalNumber")
municipal_number = DesignScript.Builtin.Dictionary.ValueAtKey(dictionary=create_suite_dictionary, key=string_11)
string_12 = StringInput("SuiteID")
valueAtKey = DesignScript.Builtin.Dictionary.ValueAtKey(dictionary=create_suite_dictionary, key=string_12)
select_the_suite_area_element = ElementById(Id=valueAtKey)
outsideID = CodeBlock(lista=python_script) { i=lista[1]; }
terrace_area_element = ElementById(Id=outsideID)
string_13 = StringInput("BalconyID")
balcony_id = DesignScript.Builtin.Dictionary.ValueAtKey(dictionary=create_suite_dictionary, key=string_13)
string_14 = StringInput("BalconyArea")
balcony_area = DesignScript.Builtin.Dictionary.ValueAtKey(dictionary=create_suite_dictionary, key=string_14)
string_15 = StringInput("BalconyType")
balcony_area_type = DesignScript.Builtin.Dictionary.ValueAtKey(dictionary=create_suite_dictionary, key=string_15)
python_script_2 = Python(IN[0]=balcony_id, IN[1]=balcony_area, IN[2]=balcony_area_type)  # same code as python_script
outsideID_2 = CodeBlock(lista=python_script_2) { i=lista[1]; }
terrace_area_element_2 = ElementById(Id=outsideID_2)
balconyArea = List.FirstItem(list=python_script_2)

# group: Current Level and Views
boolean_2 = BoolSelector(false)
currentview = Custom[© CurrentView](refresh=boolean_2)  # package Crumple; Given the current document, return the active view.

string_16 = StringInput("Associated Level")
getParameterValueByName_6 = Element.GetParameterValueByName(element=currentview, parameterName=string_16)
string_17 = StringInput("AreaUse")
municipal_number_2 = DesignScript.Builtin.Dictionary.ValueAtKey(dictionary=create_suite_dictionary, key=string_17)
python_script_3 = Python(IN[0]=ꟿ_collect_currentselection)
# ---------- python_script_3.python (11 lines) ----------
import clr
clr.AddReference('RevitAPIUI')
from Autodesk.Revit.UI import TaskDialog, TaskDialogCommonButtons, TaskDialogResult, TaskDialogCommandLinkId

list1=IN[0]

if list1 == []:
	TaskDialog.Show("Warming","Please pick areas first.")
	OUT = False
else:
	OUT = True
# ----------------------------------------

# group: UI
file_path = Filename("R:\Graphics\Logos\New Kirkor Logo\Images\New Logo-01.png")
code_block = CodeBlock { "Confirm"; "Cancel"; }
code_block_2 = CodeBlock { "Choose \nKeyplan Template"; }
viewtemplates = Custom[© ViewTemplates]()  # package Crumple; Returns all view templates in a document. Due to API/Dynamo limitations, 3D view templates are excluded from the list.
name = Element.Name(element=viewtemplates)
code_block_3 = CodeBlock { "14"; }
contains = String.Contains(str=name, searchFor=code_block_3)
filterByBoolMask = List.FilterByBoolMask(list=viewtemplates, mask=contains)
name_2 = Element.Name(element=filterByBoolMask.in)
dropdown_data = Custom[DropDown Data](InputName=code_block_2, Keys=name_2, Values=filterByBoolMask.in)  # package Data-Shapes; Create data for DropDown input in UI.MultiInputForm ++ . Check out www.data-shapes.net for more infos.
multipleinputform = Custom[MultipleInputForm ++](Logo_optional=file_path, ButtonText_optional=code_block.out0, Inputs=dropdown_data, Toggle=python_script_3, CancelButtonText_optional=code_block.out1)  # package Data-Shapes; Create a form with multiple inputs. see www.data-shapes.net for tutorials and infos!
code_block_4 = CodeBlock { "Choose \nSuite Template"; }

# group: Make KeyPlan
create_view_name = CodeBlock(level=getParameterValueByName_6, areaUse=municipal_number_2, mulNum=municipal_number)
# ---------- create_view_name.designscript (2 lines) ----------
nameSales="14-dyn-KeyPlan-Suite"
+level+" ("+areaUse+")-"+mulNum;
# ----------------------------------------
string_18 = StringInput("Duplicate")
views_keyplan = archilab.Revit.Views.Views.Duplicate(view=currentview, name=create_view_name, options=string_18)
setViewTemplate = archilab.Revit.Views.Views.SetViewTemplate(view=views_keyplan, viewTemplate=multipleinputform.User_Inputs)

# group: get boundary
ʳʰʸᵗʰᵐ_areas_suite = Rhythm.Revit.Elements.Areas.OuterBoundary(area=select_the_suite_area_element)
ʳʰʸᵗʰᵐ_areas_terrace = Rhythm.Revit.Elements.Areas.OuterBoundary(area=terrace_area_element)
ʳʰʸᵗʰᵐ_areas_balcony = Rhythm.Revit.Elements.Areas.OuterBoundary(area=terrace_area_element_2)
list_create_2 = List.Create(item0=ʳʰʸᵗʰᵐ_areas_suite, item1=ʳʰʸᵗʰᵐ_areas_terrace, item2=ʳʰʸᵗʰᵐ_areas_balcony)
transpose_2 = List.Transpose(lists=list_create_2)
firstItem = List.FirstItem(list=transpose_2@L2)
byPatch = Surface.ByPatch(closedCurve=firstItem)

code_block_5 = CodeBlock { 1; 2; }
getItemAtIndex = List.GetItemAtIndex(list=transpose_2@L2, index=code_block_5.out0)

# group (continued): get boundary
byPatch_2 = Surface.ByPatch(closedCurve=getItemAtIndex)

getItemAtIndex_2 = List.GetItemAtIndex(list=transpose_2@L2, index=code_block_5.out1)
byPatch_3 = Surface.ByPatch(closedCurve=getItemAtIndex_2)

# group (continued): get boundary
list_create_3 = List.Create(item0=byPatch, item1=byPatch_2, item2=byPatch_3)
transpose_3 = List.Transpose(lists=list_create_3)
simplify_list_for_null = Python(IN[0]=transpose_3)
# ---------- simplify_list_for_null.python (21 lines) ----------
# Load the Python Standard and DesignScript Libraries
import sys
import clr
clr.AddReference('ProtoGeometry')
from Autodesk.DesignScript.Geometry import *

# The inputs to this node will be stored as a list in the IN variables.
dataEnteringNode = IN
list1=IN[0]
items=[]
# Place your code below this line

for listx in list1:
	result=[]
	for i in listx:
		if i != None:
			result.append(i)
	items.append(result)

# Assign your output to the OUT variable.
OUT = items
# ----------------------------------------
byUnion = Surface.ByUnion(surfaces=simplify_list_for_null)
perimeterCurves = Surface.PerimeterCurves(surface=byUnion)

# group: Filled Region for Keyplans
element_types = ElementTypes("FilledRegionType")
all_elements_of_type = ElementsOfType(element_type=element_types)
name_3 = Element.Name(element=all_elements_of_type)
string_19 = StringInput("Solid Grey 1")
eq = name_3 == string_19
filterByBoolMask_2 = List.FilterByBoolMask(list=all_elements_of_type, mask=eq)
firstItem_2 = List.FirstItem(list=filterByBoolMask_2.in)
byCurves = FilledRegion.ByCurves(view=setViewTemplate, boundary=perimeterCurves, regionType=firstItem_2)

string_20 = StringInput("AreaNumber")
municipal_number_3 = DesignScript.Builtin.Dictionary.ValueAtKey(dictionary=create_suite_dictionary, key=string_20)
