# Dynamo graph CreateMarketingPlan-script.dyn (Dynamo 2.6.2.15705)
# packages: Crumple 2022.2.13, Rhythm 2022.1.5, archi-lab.net 2022.212.2722, Data-Shapes 2022.2.103, spring nodes 210.1.1

boolean = BoolSelector(true)
currentview = Custom[© CurrentView](refresh=boolean)  # package Crumple; Given the current document, return the active view.

# group: Apply Template
viewtemplates = Custom[© ViewTemplates]()  # package Crumple; Returns all view templates in a document. Due to API/Dynamo limitations, 3D view templates are excluded from the list.
name = Element.Name(element=viewtemplates)
code_block = CodeBlock { "Marketing"; }
contains = String.Contains(str=name, searchFor=code_block)
filterByBoolMask = List.FilterByBoolMask(list=viewtemplates, mask=contains)
ꟿ_list_dropdown = Custom[ꟿ List.DropDown](list=filterByBoolMask.in)  # package spring nodes; Selects one list item by a drop-down combo box. The optional names input will override the object representation.

# group: Select Areas Only
currentselection = Custom[© CurrentSelection](refresh=boolean)  # package Crumple; Returns all elements currently selected by the user in the active document when this node ran.
getCategory = Element.GetCategory(element=currentselection)
string_from_object = FromObject(obj=getCategory)
code_block_2 = CodeBlock { "Areas"; }
eq = string_from_object == code_block_2
filterByBoolMask_2 = List.FilterByBoolMask(list=currentselection, mask=eq)

string = StringInput("Areas: Municipal Number")
getParameterValueByName = Element.GetParameterValueByName(element=filterByBoolMask_2.in, parameterName=string)
string_2 = StringInput("Name")

# group: Duplicate Views
name_2 = Element.Name(element=ꟿ_list_dropdown)
level_name = Element.Name(element=currentview)
getParameterValueByName_2 = Element.GetParameterValueByName(element=filterByBoolMask_2.in, parameterName=string_2)
code_block_3 = CodeBlock(preFix=name_2, level=level_name, viewNumber=getParameterValueByName, viewName=getParameterValueByName_2)
# ---------- code_block_3.designscript (10 lines) ----------
nameSales=preFix+
" - "+level+
" - Suite "
+viewNumber+
" ("+viewName+")";
namePurchaser=preFix+
" - "+level+
" - Suite "
+viewNumber+
" ("+viewName+") - Purchaser";
# ----------------------------------------
string_3 = StringInput("Duplicate")
duplicate = archilab.Revit.Views.Views.Duplicate(view=currentview, name=code_block_3.nameSales, options=string_3)
boolean_2 = BoolSelector(true)
cropView = archilab.Revit.Views.Views.CropView(view=duplicate, crop=boolean_2)

setViewTemplate = archilab.Revit.Views.Views.SetViewTemplate(view=cropView, viewTemplate=ꟿ_list_dropdown)
ʳʰʸᵗʰᵐ_areas_outerboundary = Rhythm.Revit.Elements.Areas.OuterBoundary(area=filterByBoolMask_2.in)
curves = PolyCurve.Curves(polyCurve=ʳʰʸᵗʰᵐ_areas_outerboundary)
setCropRegion = Custom[SetCropRegion](view=setViewTemplate, CurvesAsList=curves)  # package Data-Shapes; Sets the crop region of a view to a closed polycurve.
string_4 = StringInput("Schedule C1")
code_block_4 = CodeBlock(viewNumber=getParameterValueByName, viewName=getParameterValueByName_2)
# ---------- code_block_4.designscript (4 lines) ----------
nameSales="Suite "+viewNumber+
" ("+viewName+")";
namePurchaser="Suite "+viewNumber+
" ("+viewName+") Purchaser";
# ----------------------------------------
family_types = FamilyTypes("KAP-Titleblock-Marketing-Schedule A-8.5x14*:Marketing Schedule A")
byNameNumberTitleBlockAndView = Sheet.ByNameNumberTitleBlockAndView(sheetName=string_4, sheetNumber=code_block_4.nameSales, titleBlockFamilyType=family_types, view=setViewTemplate)
duplicate_2 = archilab.Revit.Views.Views.Duplicate(view=currentview, name=code_block_3.namePurchaser, options=string_3)
cropView_2 = archilab.Revit.Views.Views.CropView(view=duplicate_2, crop=boolean_2)
setViewTemplate_2 = archilab.Revit.Views.Views.SetViewTemplate(view=cropView_2, viewTemplate=ꟿ_list_dropdown)
byNameNumberTitleBlockAndView_2 = Sheet.ByNameNumberTitleBlockAndView(sheetName=string_4, sheetNumber=code_block_4.namePurchaser, titleBlockFamilyType=family_types, view=setViewTemplate_2)
list_create = List.Create(item0=byNameNumberTitleBlockAndView, item1=byNameNumberTitleBlockAndView_2)
code_block_5 = CodeBlock { "Sheets: Category"; "14 MARKETING"; "Sheets: Subcategory"; "C1 Sales"; "C1 Purchaser"; }
ʳʰʸᵗʰᵐ_elements = Rhythm.Revit.Elements.Elements.SetParameterByNameTypeOrInstance(element=list_create, parameterName=code_block_5.out0, value=code_block_5.out1)
ʳʰʸᵗʰᵐ_elements_2 = Rhythm.Revit.Elements.Elements.SetParameterByNameTypeOrInstance(element=byNameNumberTitleBlockAndView, parameterName=code_block_5.out2, value=code_block_5.out3)
ʳʰʸᵗʰᵐ_elements_3 = Rhythm.Revit.Elements.Elements.SetParameterByNameTypeOrInstance(element=byNameNumberTitleBlockAndView_2, parameterName=code_block_5.out2, value=code_block_5.out4)
setCropRegion_2 = Custom[SetCropRegion](view=setViewTemplate_2, CurvesAsList=curves)
string_5 = StringInput("Sheets: Marketing Suite Name")
ʳʰʸᵗʰᵐ_elements_4 = Rhythm.Revit.Elements.Elements.SetParameterByNameTypeOrInstance(element=byNameNumberTitleBlockAndView_2, parameterName=string_5, value=getParameterValueByName)
string_6 = StringInput("Sheets: Type of Suite")
ʳʰʸᵗʰᵐ_elements_5 = Rhythm.Revit.Elements.Elements.SetParameterByNameTypeOrInstance(element=byNameNumberTitleBlockAndView_2, parameterName=string_6, value=getParameterValueByName_2)
ʳʰʸᵗʰᵐ_elements_6 = Rhythm.Revit.Elements.Elements.SetParameterByNameTypeOrInstance(element=byNameNumberTitleBlockAndView, parameterName=string_5, value=getParameterValueByName)
ʳʰʸᵗʰᵐ_elements_7 = Rhythm.Revit.Elements.Elements.SetParameterByNameTypeOrInstance(element=byNameNumberTitleBlockAndView, parameterName=string_6, value=getParameterValueByName_2)
sortByKey = List.SortByKey(list=filterByBoolMask_2.in, keys=getParameterValueByName)  # frozen
transpose = List.Transpose(lists=sortByKey.sorted_list)
