# Dynamo graph DeleteView-script.dyn (Dynamo 2.19.3.6394)
# packages: Genius Loci 2021.11.10, archi-lab.net 2022.212.2722, Data-Shapes 2024.2.114, SvN Packages 0.0.1

code_block = CodeBlock { "Views not on Sheet"; }
svn_logo = Custom[SvN - Logo]()  # package SvN Packages; Black and White Logo
code_block_2 = CodeBlock { "Confirm"; "Cancel"; }
collector_of_views = Custom[Collector of Views]()  # package Genius Loci
string_from_object = FromObject(object=collector_of_views.Without_Sheet_All_Views)
listview_data = Custom[Listview Data](Keys=string_from_object, Values=collector_of_views.Without_Sheet_All_Views)  # package Data-Shapes; Create data for ListView input in UI.MultiInputForm ++ . Check out www.data-shapes.net for more infos.
boolean = BoolSelector(true)
multipleinputform = Custom[MultipleInputForm ++](Description_optional=code_block, Logo_optional=svn_logo, ButtonText_optional=code_block_2.out0, Inputs=listview_data, Toggle=boolean, CancelButtonText_optional=code_block_2.out1)  # package Data-Shapes; Create a form with multiple inputs. see www.data-shapes.net for tutorials and infos!
string_from_object_2 = FromObject(obj=multipleinputform.User_Inputs)
delete = archilab.Revit.Elements.Elements.Delete(element=multipleinputform.User_Inputs)
python_script = Python(IN[0]=string_from_object_2, IN[1]=delete)  # CPython3
# ---------- python_script.python (26 lines) ----------
import clr

clr.AddReference("System.Windows.Forms")
from System.Windows.Forms import Form,Label
results=[]

def popup(text):
        form = Form()
        form.Width = 300
        form.Height = 100
        label = Label()
        label.Text = text
        label.Width = 280
        label.Height = 100
        label.Parent = form
        form.ShowDialog()

for (x,y) in zip(IN[0],IN[1]):
        if y == True:
                result= x + "is deleted"
        else:
                result= x + "is failed to be deleted"
        results.append(result)
finalcount=str(len(IN[0]))+ " unreferenced views are processed"
popup(finalcount)
OUT=results
# ----------------------------------------
