# Dynamo graph ExportSchedule-script.dyn "ABG_210719_ExportSchedule" (Dynamo 2.3.2.15696)
# packages: Data-Shapes 2021.2.94, Crumple 2021.5.27, bimorphNodes 3.0.3, SvN Packages 0.0.1

code_block = CodeBlock { "SCRIPT COMPLETE"; }
code_block_2 = CodeBlock { "EXPORT SCHEDULE"; "EXPORT"; "CANCEL"; 900; 600; 200; }
svn_logo = Custom[SvN - Logo]()  # package SvN Packages; Black and White Logo
code_block_3 = CodeBlock { "SCHEDULE"; true; }
# note: Custom Node: Crumple v.2021.5.27
schedulesbytype = Custom[© SchedulesByType]()  # package Crumple; Returns all schedules in a document, separated into key and non-key schedules.
name = Element.Name(element=schedulesbytype.schedules)
code_block_4 = CodeBlock { " Internal"; false; }
contains = String.Contains(str=name, searchFor=code_block_4.out0, ignoreCase=code_block_4.out1)
filterByBoolMask = List.FilterByBoolMask(list=schedulesbytype.schedules, mask=contains)
name_2 = Element.Name(element=filterByBoolMask.out)
# note: Custom Node: Data-Shapes v.2021.2.94
dropdown_data = Custom[DropDown Data](InputName=code_block_3.out0, Keys=name_2, Values=filterByBoolMask.out, Sorted_optional=code_block_3.out1)  # package Data-Shapes; Create data for DropDown input in UI.MultiInputForm ++ . Check out www.data-shapes.net for more infos.
code_block_5 = CodeBlock { "FILE PATH"; "Select a file..."; }
filepath_data = Custom[FilePath Data](InputName=code_block_5.out0, ButtonText=code_block_5.out1)  # package Data-Shapes; Create filepath input for UI.MultipleInputForm ++ . Check out www.data-shapes.net for more infos !
code_block_6 = CodeBlock { "SHEET NAME"; "Sheet1"; false; }
textbox_data = Custom[TextBox Data](InputName=code_block_6.out0, DefaultText=code_block_6.out1, IsNumberEntry=code_block_6.out2)  # package Data-Shapes; Create Data for TextBox input in UI.MultipleInputForm ++ . Check out www.data-shapes.net for more informations
list_create = List.Create(item0=dropdown_data, item1=filepath_data, item2=textbox_data)
boolean = BoolSelector(true)
multipleinputform = Custom[MultipleInputForm ++](Description_optional=code_block_2.out0, Logo_optional=svn_logo, ButtonText_optional=code_block_2.out1, Inputs=list_create, Toggle=boolean, CancelButtonText_optional=code_block_2.out2, MaxHeight_optional=code_block_2.out3, Width_optional=code_block_2.out4, LabelWidth_optional=code_block_2.out5)  # package Data-Shapes; Create a form with multiple inputs. see www.data-shapes.net for tutorials and infos!
code_block_7 = CodeBlock { "Run completed."; "Run cancelled."; }
if_ = If(test=multipleinputform.Was_Run, true=code_block_7.out0, false=code_block_7.out1)
code_block_8 = CodeBlock(out=multipleinputform.User_Inputs) { sched = out[0]; path  = out[1]; sheet = out[2]; }
code_block_9 = CodeBlock { 0; true; }
code_block_10 = CodeBlock { false; }
# note: Custom Node: BimorphNodes v.3.0.3
getData = Revit.Schedule.GetData(scheduleView=code_block_8.sched, refresh=code_block_10)
exportExcel = Data.ExportExcel(filePath=code_block_8.path, sheetName=code_block_8.sheet, startRow=code_block_9.out0, startCol=code_block_9.out0, data=getData, overWrite=code_block_9.out1)
waitfor = Custom[© WaitFor](data=if_, waitFor=exportExcel)  # package Crumple; Tells the first input to wait for the second input to arrive, then passes on the first input. Really useful for scripts which have branching paths that rely on their outputs to carry each other forward. Quite a few custom packages have a 'passthrough' or 'waitfor' node. I use these all the time, so find it useful to have them contained in this package also.
uimessenger = Custom[© UIMessenger](title=code_block, body=waitfor)  # package Crumple; Displays a message box with a title/body and OK/cancel button. If OK is selected, the third input's data will be passed through.
