# Dynamo graph DuplicateSheets-script.dyn (Dynamo 2.3.2.15696)
# packages: Data-Shapes 2022.2.103, bimorphNodes 4.2.4, WWP Packages 0.0.1

code_block = CodeBlock { "Sheet Duplicator"; 800; "Confirm Selected"; }
# note: WWP Package
WWPLogo = Custom[WWPLogo]()  # package WWP Packages; Black and White Logo
categories = Categories("OST_Sheets")
all_elements_of_category = ElementsOfCategory(Category=categories)
sheetNumber = Sheet.SheetNumber(sheet=all_elements_of_category)
sheetName = Sheet.SheetName(sheet=all_elements_of_category)
code_block_2 = CodeBlock(sNum=sheetNumber, sName=sheetName) { "Select the sheets\nto duplicate"; sNum+"-"+sName; 400; }
# note: Data-shape Package
listview_data = Custom[Listview Data](InputName=code_block_2.out0, Keys=code_block_2.out1, Values=all_elements_of_category, Height_optionnal=code_block_2.out2)  # package Data-Shapes; Create data for ListView input in UI.MultiInputForm ++ . Check out www.data-shapes.net for more infos.
code_block_3 = CodeBlock { "Views included"; true; "Duplicate with Views"; }
boolean_input = Custom[Boolean input](InputName=code_block_3.out0, DefaultValue=code_block_3.out1, SideText=code_block_3.out2)  # package Data-Shapes; Creates a boolean input for UI.MultipleInputForm ++ . Check out www.data-shapes.net for more infos!
code_block_4 = CodeBlock()
# ---------- code_block_4.designscript (6 lines) ----------
"Duplicate Options";
["Duplicate Views",
"Duplicate Views w/Details",
"Duplicate Views AsDependent"];
[0,1,2];
2;
# ----------------------------------------
radiobuttons_data = Custom[RadioButtons Data](InputName=code_block_4.out0, Keys=code_block_4.out1, Values=code_block_4.out2, DefaultValueIndex=code_block_4.out3)  # package Data-Shapes; Create radio buttons input for UI.MultipleInputForm ++ .
list_create = List.Create(item0=listview_data, item1=boolean_input, item2=radiobuttons_data)
boolean = BoolSelector(true)
multipleinputform = Custom[MultipleInputForm ++](Description_optional=code_block.out0, Logo_optional=WWPLogo, ButtonText_optional=code_block.out2, Inputs=list_create, Toggle=boolean, Width_optional=code_block.out1)  # package Data-Shapes; Create a form with multiple inputs. see www.data-shapes.net for tutorials and infos!
code_block_5 = CodeBlock(l=multipleinputform.User_Inputs) { l[0]; l[1]; l[2]; " copy"; }
boolean_2 = BoolSelector(true)
# note: Bimorph Package
duplicate = Revit.Sheet.Duplicate(sheets=code_block_5.out0, run=boolean_2, duplicateWithViews=code_block_5.out1, duplicateOption=code_block_5.out2, suffix=code_block_5.out3)
string = StringInput("Sheet Category")
getParameterValueByName = Element.GetParameterValueByName(element=code_block_5.out0, parameterName=string)
setParameterByName = Element.SetParameterByName(element=duplicate.Sheet, parameterName=string, value=getParameterValueByName)
