# Dynamo graph RenumberSheets-script.dyn (Dynamo 2.19.3.6394)
# packages: Data-Shapes 2025.3.118, WWP Packages 0.0.1, Genius Loci 2024.5.29

# group: Get All sheets
categories = Categories("OST_Sheets")
all_elements_of_category = ElementsOfCategory(Category=categories)
code_block = CodeBlock { "Sheet Category"; }
getParameterValueByName = Element.GetParameterValueByName(element=all_elements_of_category, parameterName=code_block)
uniqueItems = List.UniqueItems(list=getParameterValueByName)
code_block_2 = CodeBlock { "Print Set"; }
getParameterValueByName_2 = Element.GetParameterValueByName(element=all_elements_of_category, parameterName=code_block_2)
uniqueItems_2 = List.UniqueItems(list=getParameterValueByName_2)

list_clean = Custom[List Clean](list=uniqueItems)  # package Genius Loci; Removes all Null, Empty and Blank from a list or nested list of lists.
list_clean_2 = Custom[List Clean](list=uniqueItems_2)

# group: Inputs
wwp_logo = Custom[WWP - Logo]()  # package WWP Packages; Black and White Logo
code_block_3 = CodeBlock { "Choose Sheet Category"; }
dropdown_data = Custom[DropDown Data](InputName=code_block_3, Keys=list_clean, Values=list_clean)  # package Data-Shapes; Create data for DropDown input in UI.MultiInputForm ++ . Check out www.data-shapes.net for more infos.
code_block_4 = CodeBlock { "Choose Print Set"; }
dropdown_data_2 = Custom[DropDown Data](InputName=code_block_4, Keys=list_clean_2, Values=list_clean_2)
code_block_5 = CodeBlock { "Starting Number"; false; }
textbox_data = Custom[TextBox Data](InputName=code_block_5.out0, IsNumberEntry=code_block_5.out1)  # package Data-Shapes; Create Data for TextBox input in UI.MultipleInputForm ++ . Check out www.data-shapes.net for more informations
list_create = List.Create(item0=dropdown_data, item1=dropdown_data_2, item2=textbox_data)
code_block_6 = CodeBlock { true; "Cancel"; }
multipleinputform = Custom[MultipleInputForm ++](Logo_optional=wwp_logo, Inputs=list_create, Toggle=code_block_6.out0, CancelButtonText_optional=code_block_6.out1)  # package Data-Shapes; Create a form with multiple inputs. see www.data-shapes.net for tutorials and infos!
code_block_7 = CodeBlock(l=multipleinputform.User_Inputs) { category=l[0]; }
code_block_8 = CodeBlock(l=multipleinputform.User_Inputs) { printset=l[1]; }

contains = String.Contains(string=getParameterValueByName, searchFor=code_block_7)
contains_2 = String.Contains(string=getParameterValueByName_2, searchFor=code_block_8)
and_ = And(bool0=contains, bool1=contains_2)
filterByBoolMask = List.FilterByBoolMask(list=all_elements_of_category, mask=and_)
sheetNumber = Sheet.SheetNumber(sheet=filterByBoolMask.in)
sortByKey = List.SortByKey(list=filterByBoolMask.in, keys=sheetNumber)
start = Revit.Transaction.Transaction.Start(input=sortByKey.sortedList)
code_block_9 = CodeBlock { "Sheet Number"; }
code_block_10 = CodeBlock { 0; "t"; }
insert = String.Insert(string=sortByKey.sortedKeys, index=code_block_10.out0, toInsert=code_block_10.out1)
setParameterByName = Element.SetParameterByName(element=start, parameterName=code_block_9, value=insert)
code_block_11 = CodeBlock { "Sheet Number"; }
code_block_12 = CodeBlock(l=multipleinputform.User_Inputs) { startingnumber=l[2]; }
count = List.Count(list=sortByKey.sortedList)
python_script = Python(IN[0]=code_block_12, IN[1]=count, IN[2]=sortByKey.sortedKeys)  # CPython3
# ---------- python_script.python (21 lines) ----------
startingStr = IN[0] 
count = IN[1]    
listRef = IN[2] 
startingNumber = int(startingStr)

firstItem = str(listRef[0])


prefix = ""
numeric_part = ""

for c in firstItem:
    if c.isdigit():
        numeric_part += c
    else:
        prefix += c

width = len(numeric_part)


OUT = [prefix + str(i).zfill(width) for i in range(startingNumber, startingNumber + count)]
# ----------------------------------------
setParameterByName_2 = Element.SetParameterByName(element=setParameterByName, parameterName=code_block_11, value=python_script)
