# Dynamo graph osm-Roads-script.dyn (Dynamo 2.3.2.15696)
# packages: Elk 1.1.0, Data-Shapes 2022.2.103, SvN Packages 0.0.1, spring nodes 210.1.1, Data-Shapes 2022.2.105

svn_logo = Custom[SvN - Logo]()  # package SvN Packages; Black and White Logo
code_block = CodeBlock { "Choose the \nOSM File"; }
osm_file = Filename("C:\Users\jtian\Desktop\test\map (1).osm")  # graph input
filepath_data = Custom[FilePath Data](InputName=code_block, DefaulPath=osm_file)  # package Data-Shapes; Create filepath input for UI.MultipleInputForm ++ . Check out www.data-shapes.net for more infos !
code_block_2 = CodeBlock { "Highway Width(m)"; "12"; "Road Width(m)"; "6"; "Residential Width(m)"; "3"; "Scale Factor"; "1000"; "Scale Plan?"; }
boolean = BoolSelector(true)
textbox_data = Custom[TextBox Data](InputName=code_block_2.out0, DefaultText=code_block_2.out1, IsNumberEntry=boolean)  # package Data-Shapes; Create Data for TextBox input in UI.MultipleInputForm ++ . Check out www.data-shapes.net for more informations
textbox_data_2 = Custom[TextBox Data](InputName=code_block_2.out2, DefaultText=code_block_2.out3, IsNumberEntry=boolean)
textbox_data_3 = Custom[TextBox Data](InputName=code_block_2.out4, DefaultText=code_block_2.out5, IsNumberEntry=boolean)
textbox_data_4 = Custom[TextBox Data](InputName=code_block_2.out6, DefaultText=code_block_2.out7, IsNumberEntry=boolean)
boolean_input = Custom[Boolean input](InputName=code_block_2.out8)  # package Data-Shapes; Creates a boolean input for UI.MultipleInputForm ++ . Check out www.data-shapes.net for more infos!
list_create = List.Create(item0=filepath_data, item1=textbox_data, item2=textbox_data_2, item3=textbox_data_3, item4=textbox_data_4, item5=boolean_input)
boolean_2 = BoolSelector(true)
multipleinputform = Custom[MultipleInputForm ++](Logo_optional=svn_logo, Inputs=list_create, Toggle=boolean_2)  # package Data-Shapes; Create a form with multiple inputs. see www.data-shapes.net for tutorials and infos!
firstItem = List.FirstItem(list=multipleinputform.User_Inputs)
location = Elk.OSM.Location(filePath=firstItem)
features = Elk.OSM.Features()
code_block_3 = CodeBlock { 2; None; }  # unwired: None
getItemAtIndex = List.GetItemAtIndex(list=features, index=code_block_3.out0)
subFeatures = Elk.OSM.SubFeatures(feature=getItemAtIndex, subIndexes=code_block_3.None)
OSMData = Elk.OSM.OSMData(OSM=location.OSM@L2, File=location.XML, featureType=getItemAtIndex, subTypes=subFeatures.selected, lacing=Longest)
byPoints = PolyCurve.ByPoints(points=OSMData.Points)
flatten = List.Flatten(list=byPoints)
ZAxis = Vector.ZAxis()
code_block_4 = CodeBlock { 200; }
extrudeAsSolid = Curve.ExtrudeAsSolid(curve=flatten, direction=ZAxis, distance=code_block_4)
ꟿ_form_bygeometry = Custom[ꟿ Form.ByGeometry](geometry=extrudeAsSolid)  # package spring nodes; Convert the input geometry to a Revit Form object. Forms can exist only in the family environment. You can convert complicated solids or surfaces directly into forms. A form can act as a void. Provide either one true boolean value to convert a form into a void. The node's lacing is set to longest by default.
code_block_5 = CodeBlock(l=multipleinputform.User_Inputs) { l[4]; l[5]; }
code_block_6 = CodeBlock { 5; 9; "*"; [14,40,21,27,28,36,42,25,24]; 10; }
getItemAtIndex_2 = List.GetItemAtIndex(list=features, index=code_block_6.out1)
subFeatures_2 = Elk.OSM.SubFeatures(feature=getItemAtIndex_2, subIndexes=code_block_6.out3)
string = StringInput(",")

# group: Filter for Roads
# note: Get Street/Roads
OSMData_2 = Elk.OSM.OSMData(OSM=location.OSM@L2, File=location.XML, featureType=getItemAtIndex_2, subTypes=subFeatures_2.selected, lacing=Longest)
code_block_7 = CodeBlock { -1; }
code_block_8 = CodeBlock { None; }  # unwired: None
# note: Cleanup OSM data
join = String.Join(separator=string, string0=OSMData_2.Keys)
string_2 = StringInput("est_width:")

scale = Geometry.Scale(geometry=OSMData_2.Points, amount=code_block_5.out0)
if_ = If(test=code_block_5.out1, true=scale, false=OSMData_2.Points)

# group (continued): Filter for Roads
# note: OSM Geometry
byPoints_2 = PolyCurve.ByPoints(points=if_)
count = List.Count(list=byPoints_2)
cycle = List.Cycle(list=code_block_7, amount=count)
flatten_2 = List.Flatten(list=byPoints_2, amt=cycle, lacing=Shortest)
eq = code_block_8 == flatten_2
filterByBoolMask = List.FilterByBoolMask(list=flatten_2, mask=eq)
flatten_3 = List.Flatten(list=join, amt=cycle)
contains = String.Contains(str=flatten_3, searchFor=string_2)
filterByBoolMask_2 = List.FilterByBoolMask(list=flatten_3, mask=eq)

filterByBoolMask_3 = List.FilterByBoolMask(list=filterByBoolMask.out, mask=contains)
code_block_9 = CodeBlock(l=multipleinputform.User_Inputs) { l[4]; }
code_block_10 = CodeBlock(l=multipleinputform.User_Inputs, scale=code_block_9) { l[1]*scale; l[2]*scale; l[3]*scale; }

# group: Make Roads
code_block_11 = CodeBlock(scale=code_block_9) { residential=3*scale; }
list_create_2 = List.Create(item0=code_block_10.out2, item1=code_block_10.out1, item2=code_block_10.out0, item3=code_block_10.out1, item4=code_block_10.out1, item5=code_block_10.out1, item6=code_block_10.out1, item7=code_block_11, item8=code_block_10.out0)
normal = Curve.Normal(curve=filterByBoolMask_3.out)
byThickeningCurve = PolyCurve.ByThickeningCurve(curve=filterByBoolMask_3.out, thickness=list_create_2, nor=normal)
ZAxis_2 = Vector.ZAxis()
code_block_12 = CodeBlock { 200; }
extrudeAsSolid_2 = Curve.ExtrudeAsSolid(curve=byThickeningCurve, direction=ZAxis_2, distance=code_block_12, lacing=Longest)
flatten_4 = List.Flatten(list=extrudeAsSolid_2)
code_block_13 = CodeBlock { None; }  # unwired: None
ne = flatten_4 != code_block_13
filterByBoolMask_4 = List.FilterByBoolMask(list=flatten_4, mask=ne)

byUnion = Solid.ByUnion(solids=filterByBoolMask_4.in)

# group (continued): Make Roads
ꟿ_form_bygeometry_2 = Custom[ꟿ Form.ByGeometry](geometry=byUnion)

filterByBoolMask_5 = List.FilterByBoolMask(list=filterByBoolMask_2.out, mask=contains)
string_3 = StringInput("est_width:")

# group: Check if there is width
split = String.Split(str=filterByBoolMask_5.in@L2, separator0=string_3)
lastItem = List.LastItem(list=split, lacing=Longest)
code_block_14 = CodeBlock { 1; ","; }
split_2 = String.Split(str=lastItem, separator0=code_block_14.out1)
firstItem_2 = List.FirstItem(list=split_2, lacing=Longest)
toNumber = String.ToNumber(str=firstItem_2)
normal_2 = Curve.Normal(curve=filterByBoolMask_3.in)
byThickeningCurve_2 = PolyCurve.ByThickeningCurve(curve=filterByBoolMask_3.in, thickness=toNumber, nor=normal_2)
extrudeAsSolid_3 = Curve.ExtrudeAsSolid(curve=byThickeningCurve_2)
ꟿ_form_bygeometry_3 = Custom[ꟿ Form.ByGeometry](geometry=extrudeAsSolid_3)
