# Dynamo graph SetMasstoFloorProperty-script.dyn (Dynamo 2.19.3.6394)

# group: Get Data From Mass Floor
categories = Categories("OST_MassFloor")
all_elements_of_category = ElementsOfCategory(Category=categories)
string = StringInput("Mass: Family")
getParameterValueByName = Element.GetParameterValueByName(element=all_elements_of_category, parameterName=string)

# group: Get Data From Mass
categories_2 = Categories("OST_Mass")
all_elements_of_category_2 = ElementsOfCategory(Category=categories_2)
string_2 = StringInput("Family")
getParameterValueByName_2 = Element.GetParameterValueByName(element=all_elements_of_category_2, parameterName=string_2)
family = FamilyType.Family(familyType=getParameterValueByName_2)
name = Element.Name(element=family)

indexOf = List.IndexOf(list=name, element=getParameterValueByName)
getItemAtIndex = List.GetItemAtIndex(list=all_elements_of_category_2, index=indexOf)

# group: Get Data From the Hosted Mass
string_3 = StringInput("*Mass Type")
getParameterValueByName_3 = Element.GetParameterValueByName(element=getItemAtIndex, parameterName=string_3)
string_4 = StringInput("*Unit Type")
getParameterValueByName_4 = Element.GetParameterValueByName(element=getItemAtIndex, parameterName=string_4)

code_block = CodeBlock(name=getParameterValueByName_3) { n="BLOCK "+name; }

# group: Pour Data to the Mass Floors
setParameterByName = Element.SetParameterByName(element=all_elements_of_category, parameterName=string_3, value=code_block)
setParameterByName_2 = Element.SetParameterByName(element=all_elements_of_category, parameterName=string_4, value=getParameterValueByName_4)
