# Dynamo graph copycolorscheme-script.dyn (Dynamo 2.16.1.2727)
# packages: Clockwork for Dynamo 2.x 2.4.0, Data-Shapes 2022.2.105, SvN Packages 0.0.1, Genius Loci 2023.2.21

code_block = CodeBlock { "Source\nColor Scheme"; "Target\nColor Scheme"; }
code_block_2 = CodeBlock { "ColorFillScheme"; }
byName = Custom[ElementType.ByName](name=code_block_2)  # package Clockwork for Dynamo 2.x; Retrieves an element type by its name - to be used with the OOTB node "All Elements of Type".
all_elements_of_type = Custom[All Elements of Type+](elementType=byName)  # package Clockwork for Dynamo 2.x; Gets all placed elements of a given element type in the model. Unlike the OOTB node, it works for virtually all element types.
listview_data = Custom[Listview Data](InputName=code_block.out1, Values=all_elements_of_type)  # frozen; package Data-Shapes; Create data for ListView input in UI.MultiInputForm ++ . Check out www.data-shapes.net for more infos.; unwired: Keys
code_block_3 = CodeBlock { "Copy Color Scheme"; }
svn_logo = Custom[SvN - Logo]()  # package SvN Packages; Black and White Logo
code_block_4 = CodeBlock(e=all_elements_of_type) { e.Name; }
dropdown_data = Custom[DropDown Data](InputName=code_block.out0, Keys=code_block_4, Values=all_elements_of_type)  # package Data-Shapes; Create data for DropDown input in UI.MultiInputForm ++ . Check out www.data-shapes.net for more infos.
dropdown_data_2 = Custom[DropDown Data](InputName=code_block.out1, Keys=code_block_4, Values=all_elements_of_type)
list_create = List.Create(item0=dropdown_data, item1=dropdown_data_2)
boolean = BoolSelector(true)
multipleinputform = Custom[MultipleInputForm ++](Description_optional=code_block_3, Logo_optional=svn_logo, Inputs=list_create, Toggle=boolean)  # package Data-Shapes; Create a form with multiple inputs. see www.data-shapes.net for tutorials and infos!
code_block_5 = CodeBlock(l=multipleinputform.User_Inputs) { l[0]; l[1]; }
get_colorfill_scheme_properties = Custom[Get ColorFill Scheme Properties](colorFillScheme=code_block_5.out0)  # package Genius Loci; Works only in Revit 2022 and later. Gets the category, values, colors and fill patterns of the given Color Scheme.
set_colorfill_scheme_properties = Custom[Set ColorFill Scheme Properties](colorFillScheme=code_block_5.out1, ParameterName=get_colorfill_scheme_properties.ParameterName, Title=get_colorfill_scheme_properties.Title, ElementsFromLinks=get_colorfill_scheme_properties.ElementsFromLinks, value=get_colorfill_scheme_properties.Values, color=get_colorfill_scheme_properties.Colors, fillPatternElement=get_colorfill_scheme_properties.FillPatternElement, IsVisible=get_colorfill_scheme_properties.IsVisible)  # package Genius Loci; Works only in Revit 2022 and later. Sets the name, values, colors and fill patterns of the given Color Scheme. (All inputs are optional)
