# Dynamo graph DetailLinefromCAD2023-script.dyn "DetailLinefromCAD-script" (Dynamo 2.16.1.2727)
# packages: Data-Shapes 2022.2.105, SvN Packages 0.0.1, bimorphNodes 4.2.4, Crumple 2022.5.27

boolean = BoolSelector(true)
revit_currentview = Custom[© Revit.CurrentView](refresh=boolean)  # package Crumple; Given the current document, return the active view.
svn_logo = Custom[SvN - Logo]()  # package SvN Packages; Black and White Logo
string = StringInput("Confirm")
string_2 = StringInput("Select a CAD file")
boolean_2 = BoolSelector(true)
selectmodelelements_data = Custom[SelectModelElements Data](InputName=string_2, SelectSingleElement=boolean_2)  # package Data-Shapes; Creates a Revit element selection input for UI.MultipleInputForm++ . Check out www.data-shapes.net for more infos!
string_3 = StringInput("Cancel")
multipleinputform = Custom[MultipleInputForm ++](Logo_optional=svn_logo, ButtonText_optional=string, Inputs=selectmodelelements_data, Toggle=boolean_2, CancelButtonText_optional=string_3)  # package Data-Shapes; Create a form with multiple inputs. see www.data-shapes.net for tutorials and infos!
firstItem = List.FirstItem(list=multipleinputform.User_Inputs)
svn_logo_2 = Custom[SvN - Logo]()
string_4 = StringInput("Confirm Layer")
string_5 = StringInput("Select the layer")
layerNames = Revit.ImportInstance.LayerNames(importInstance=firstItem)
listview_data = Custom[Listview Data](InputName=string_5, Keys=layerNames, Values=layerNames)  # package Data-Shapes; Create data for ListView input in UI.MultiInputForm ++ . Check out www.data-shapes.net for more infos.
boolean_3 = BoolSelector(true)
multipleinputform_2 = Custom[MultipleInputForm ++](Logo_optional=svn_logo_2, ButtonText_optional=string_4, Inputs=listview_data, Toggle=boolean_3)
firstItem_2 = List.FirstItem(list=multipleinputform_2.User_Inputs)
curvesFromCADLayers = CAD.CurvesFromCADLayers(importInstance=firstItem, layerNames=firstItem_2)
byCurve = DetailCurve.ByCurve(view=revit_currentview, curve=curvesFromCADLayers.Curve)
byElements = Group.ByElements(elements=byCurve)
end = Revit.Transaction.Transaction.End(input=byElements)
code_block = CodeBlock { None; }  # unwired: None
eq = code_block == end
filterByBoolMask = List.FilterByBoolMask(list=end, mask=eq)
code_block_2 = CodeBlock { "Family and Type"; }
getParameterValueByName = Element.GetParameterValueByName(element=filterByBoolMask.out, parameterName=code_block_2)
filterByBoolMask_2 = List.FilterByBoolMask(list=curvesFromCADLayers.layerKeys, mask=eq)
code_block_3 = CodeBlock(n=filterByBoolMask_2.out) { "DetailGrp_"+n; }
python_script = Python(IN[0]=getParameterValueByName, IN[1]=code_block_3)  # IronPython2
# ---------- python_script.python (31 lines) ----------
# Load the Python Standard and DesignScript Libraries
import sys
import clr
clr.AddReference('ProtoGeometry')
from Autodesk.DesignScript.Geometry import *
clr.AddReference('RevitAPI')
from Autodesk.Revit.DB import *
clr.AddReference('RevitServices')
from RevitServices.Persistence import DocumentManager

# The inputs to this node will be stored as a list in the IN variables.
dataEnteringNode = IN

# Define the input variables
elements = UnwrapElement(IN[0])  # Assuming IN[0] contains a list of elements
names = IN[1]

# Create an empty list to store the modified group names
namelist=[]
# Start a new transaction
doc = DocumentManager.Instance.CurrentDBDocument
transaction = Transaction(doc, "Rename Group Types")
transaction.Start()
# Modify the group names
for group, name in zip(elements, names):
	group.Name = name
	namelist.append(name)
    # Commit the transaction
transaction.Commit()
OUT= namelist
    # Assign the modified group names to the output
# ----------------------------------------
