# Dynamo graph Door Type Duplicater-script.dyn (Dynamo 2.3.2.15696)
# packages: Clockwork for Dynamo 2.x 2.4.0, spring nodes 210.1.1, Data-Shapes 2022.2.103

# group: Set Door Size from list
boolean = BoolSelector(true)
ꟿ_collect_currentselection = Custom[ꟿ Collect.CurrentSelection](refresh=boolean)  # package spring nodes; Gets the currently selected elements. Connect a boolean switch to refresh the selection.
getCategory = Element.GetCategory(element=ꟿ_collect_currentselection)
string_from_object = FromObject(obj=getCategory)
string = StringInput("Doors")
eq = string_from_object == string
filterByBoolMask = List.FilterByBoolMask(list=ꟿ_collect_currentselection, mask=eq)
elementType = Element.ElementType(element=filterByBoolMask.in)
string_2 = StringInput("Doors: Panel Type")
getParameterValueByName = Element.GetParameterValueByName(element=elementType, parameterName=string_2)
string_3 = StringInput("Width")
code_block = CodeBlock()
# ---------- code_block.designscript (6 lines) ----------
["38 in - 965mm","36 in - 915mm","34 in - 865mm",
"32 in - 810mm","30 in - 760mm","28 in - 710mm",
"24 in - 610mm","22 in - 560mm","20 in - 510mm",
"18 in - 460mm","16 in - 410mm","Custom"];
[965,915,865,810,760,710,
610,560,510,460,410,"Custom"];
# ----------------------------------------
radiobuttons_data = Custom[RadioButtons Data](InputName=string_3, Keys=code_block.out0, Values=code_block.out1)  # package Data-Shapes; Create radio buttons input for UI.MultipleInputForm ++ .
string_4 = StringInput("Height")
code_block_2 = CodeBlock { ["6'8(2035mm)","7'(2130mm)","8'(2440mm)"]; [2035,2130,2440]; }
radiobuttons_data_2 = Custom[RadioButtons Data](InputName=string_4, Keys=code_block_2.out0, Values=code_block_2.out1)
list_create = List.Create(item0=radiobuttons_data, item1=radiobuttons_data_2)
check_if_empty = Python(IN[0]=filterByBoolMask.in, IN[1]=string)
# ---------- check_if_empty.python (12 lines) ----------
import clr
clr.AddReference('RevitAPIUI')
from Autodesk.Revit.UI import TaskDialog, TaskDialogCommonButtons, TaskDialogResult, TaskDialogCommandLinkId

list1=IN[0]
category=IN[1]

if list1 == []:
	TaskDialog.Show("Warning","Please pick a <" + IN[1] + "> Category first.")
	OUT = False
else:
	OUT = True
# ----------------------------------------
multipleinputform = Custom[MultipleInputForm ++](Inputs=list_create, Toggle=check_if_empty)  # package Data-Shapes; Create a form with multiple inputs. see www.data-shapes.net for tutorials and infos!
code_block_3 = CodeBlock { 0; 1; }
getItemAtIndex = List.GetItemAtIndex(list=multipleinputform.User_Inputs, index=code_block_3.out0)
getItemAtIndex_2 = List.GetItemAtIndex(list=multipleinputform.User_Inputs, index=code_block_3.out1)

# group: Custom Size
code_block_4 = CodeBlock { "Custom"; }
eq_2 = code_block_4 == getItemAtIndex
code_block_5 = CodeBlock { ["Width","Height"]; }
boolean_2 = BoolSelector(true)
textbox_data = Custom[TextBox Data](InputName=code_block_5, IsNumberEntry=boolean_2)  # package Data-Shapes; Create Data for TextBox input in UI.MultipleInputForm ++ . Check out www.data-shapes.net for more informations
multipleinputform_2 = Custom[MultipleInputForm ++](Inputs=textbox_data, Toggle=eq_2)
code_block_6 = CodeBlock { 0; 1; }
getItemAtIndex_3 = List.GetItemAtIndex(list=multipleinputform_2.User_Inputs, index=code_block_6.out0)
getItemAtIndex_4 = List.GetItemAtIndex(list=multipleinputform_2.User_Inputs, index=code_block_6.out1)

width = If(test=eq_2, true=getItemAtIndex_3, false=getItemAtIndex)
height = If(test=eq_2, true=getItemAtIndex_4, false=getItemAtIndex_2)
python_script = Python(IN[0]=getParameterValueByName, IN[1]=width, IN[2]=height)
# ---------- python_script.python (21 lines) ----------
# Load the Python Standard and DesignScript Libraries
import sys
import clr
clr.AddReference('ProtoGeometry')
from Autodesk.DesignScript.Geometry import *

# The inputs to this node will be stored as a list in the IN variables.
dataEnteringNode = IN
list1=IN[0]
width=IN[1]
height=IN[2]
result=[]
# Place your code below this line
if isinstance(list1,list):
	for i in list1:
		name=i+" - "+str(int(width))+" x "+str(int(height))+"mm"
		result.append(name)
else:
	result=list1+" - "+str(int(width))+" x "+str(int(height))+"mm"
# Assign your output to the OUT variable.
OUT = result
# ----------------------------------------
duplicate = Custom[FamilyType.Duplicate](elementType=elementType, name=python_script)  # package Clockwork for Dynamo 2.x; Duplicates a family type
string_5 = StringInput("Width")
setParameterByName = Element.SetParameterByName(element=duplicate, parameterName=string_5, value=width)
string_6 = StringInput("Height")
setParameterByName_2 = Element.SetParameterByName(element=duplicate, parameterName=string_6, value=height)
