# Dynamo graph SelectDoors-script.dyn "Doors-Select All Doors" (Dynamo 2.3.2.15696)
# packages: spring nodes 210.1.1

all_elements_in_active_view = ElementsInView()
getCategory = Element.GetCategory(element=all_elements_in_active_view)
string_from_object = FromObject(obj=getCategory)
string = StringInput("Doors")
eq = string_from_object == string
filterByBoolMask = List.FilterByBoolMask(list=all_elements_in_active_view, mask=eq)
list_create = List.Create(item0=filterByBoolMask.in)
ꟿ_selectinrevit = Custom[ꟿ SelectInRevit](element=list_create)  # package spring nodes; Selects the input elements inside the Revit UI.
