# Dynamo graph Fire RatingClear-script.dyn (Dynamo 2.19.3.6394)
# packages: Data-Shapes 2022.2.105, Genius Loci 2024.5.29

all_elements_in_active_view = ElementsInView()
getCategory = Element.GetCategory(element=all_elements_in_active_view)
code_block = CodeBlock(e=getCategory) { e.Name; }
code_block_2 = CodeBlock { "Lines"; }
eq = code_block == code_block_2
filterByBoolMask = List.FilterByBoolMask(list=all_elements_in_active_view, mask=eq)
line_linestyle = Custom[Line LineStyle](Lines=filterByBoolMask.in)  # package Data-Shapes; Gives LineStyle name and element of Lines
code_block_3 = CodeBlock { "FRR"; }
contains = String.Contains(string=line_linestyle.LineStyle_name, searchFor=code_block_3)
filterByBoolMask_2 = List.FilterByBoolMask(list=filterByBoolMask.in, mask=contains)
start = Revit.Transaction.Transaction.Start(input=filterByBoolMask_2.in)
delete_elements = Custom[Delete Elements](element=start)  # package Genius Loci; Delete the input list of elements from the given Revit document. The node returns the number of successfully deleted elements and their Ids as a string. Based on a Springs node
end = Revit.Transaction.Transaction.End(input=delete_elements.deletedIds_str)
