# Dynamo graph Fire Rating_Select-script.dyn (Dynamo 2.19.3.6394)
# packages: Clockwork for Dynamo 2.x 2.4.0, archi-lab.net 2020.23.13, Crumple 2022.5.27, SvN Packages 0.0.1

svn_currentselection = Custom[SvN - CurrentSelection]()  # package SvN Packages; Return current selected elements
string = StringInput("Walls")
getCategory = Element.GetCategory(element=svn_currentselection)
code_block = CodeBlock(e=getCategory) { e.Name; }
eq = string == code_block
filterByBoolMask = List.FilterByBoolMask(list=svn_currentselection, mask=eq)
frr_input = Python()  # CPython3; unwired: IN[0]
# ---------- frr_input.python (50 lines) ----------
import clr
clr.AddReference('System.Windows.Forms')
from System.Windows.Forms import Form, Label, TextBox, Button, DialogResult

# Create a custom input dialog box
class InputDialog(Form):
    def __init__(self, prompt="Enter value:", default_value="FRR Walls"):
        self.Text = "User Input"
        self.Width = 300
        self.Height = 150
        self.StartPosition = 1  # Center the form

        self.label = Label()
        self.label.Text = prompt
        self.label.Top = 10
        self.label.Left = 10
        self.label.Width = 260
        self.Controls.Add(self.label)

        self.textBox = TextBox()
        self.textBox.Text = default_value
        self.textBox.Top = 40
        self.textBox.Left = 10
        self.textBox.Width = 260
        self.Controls.Add(self.textBox)

        self.okButton = Button()
        self.okButton.Text = "OK"
        self.okButton.DialogResult = DialogResult.OK
        self.okButton.Top = 70
        self.okButton.Left = 100
        self.Controls.Add(self.okButton)

        self.AcceptButton = self.okButton  # Pressing Enter will confirm the input

    def get_value(self):
        return self.textBox.Text

# Run the dialog and get user input
dialog = InputDialog("What is the name of the Instance Parameter associated with your walls?")
result = dialog.ShowDialog()

# Output the value if OK was clicked
if result == DialogResult.OK:
    output = dialog.get_value()
else:
    output = None  # If the user cancels, return None

# Dynamo Output
OUT = output
# ----------------------------------------
getParameterValueByName = Element.GetParameterValueByName(element=filterByBoolMask.in, parameterName=frr_input)
boolean = BoolSelector(true)
revit_currentview = Custom[© Revit.CurrentView](refresh=boolean)  # package Crumple; Given the current document, return the active view.

# group: 1 HR FIRE RATING
string_from_object = FromObject(obj=getParameterValueByName)
string_2 = StringInput("1HR")  # graph input
contains = String.Contains(string=string_from_object, searchFor=string_2)
filterByBoolMask_2 = List.FilterByBoolMask(list=filterByBoolMask.in, mask=contains)
watch = Watch(filterByBoolMask_2.in)
getLocation = Element.GetLocation(element=watch)
fromCurve = Custom[DetailLine.FromCurve](curve=getLocation, view=revit_currentview)  # package Clockwork for Dynamo 2.x; Creates a detail line based on a given curve. Unlike the OOTB node it can also draw circles.
code_block_2 = CodeBlock { "Line Style"; }
line_styles = LineStyleUi("SvN - FRR - 1H")  # graph input
setParameterByName = Element.SetParameterByName(element=fromCurve, parameterName=code_block_2, value=line_styles)

# group: 1.5 HR FIRE RATING
string_from_object_2 = FromObject(obj=getParameterValueByName)
string_3 = StringInput("1.5HR")  # graph input
contains_2 = String.Contains(string=string_from_object_2, searchFor=string_3)
filterByBoolMask_3 = List.FilterByBoolMask(list=filterByBoolMask.in, mask=contains_2)
watch_2 = Watch(filterByBoolMask_3.in)
getLocation_2 = Element.GetLocation(element=watch_2)
fromCurve_2 = Custom[DetailLine.FromCurve](curve=getLocation_2, view=revit_currentview)
code_block_3 = CodeBlock { "Line Style"; }
line_styles_2 = LineStyleUi("SvN - FRR - 1.5H")  # graph input
setParameterByName_2 = Element.SetParameterByName(element=fromCurve_2, parameterName=code_block_3, value=line_styles_2)

# group: 0 HR FIRE RATING
string_from_object_3 = FromObject(obj=getParameterValueByName)
string_4 = StringInput("0HR")  # graph input
contains_3 = String.Contains(string=string_from_object_3, searchFor=string_4)
filterByBoolMask_4 = List.FilterByBoolMask(list=filterByBoolMask.in, mask=contains_3)
watch_3 = Watch(filterByBoolMask_4.in)
getLocation_3 = Element.GetLocation(element=watch_3)
fromCurve_3 = Custom[DetailLine.FromCurve](curve=getLocation_3, view=revit_currentview)
code_block_4 = CodeBlock { "Line Style"; }
line_styles_3 = LineStyleUi("SvN - FRR - 0H")  # graph input
setParameterByName_3 = Element.SetParameterByName(element=fromCurve_3, parameterName=code_block_4, value=line_styles_3)

# group: 2 HR FIRE RATING
string_from_object_4 = FromObject(obj=getParameterValueByName)
string_5 = StringInput("2HR")  # graph input
contains_4 = String.Contains(string=string_from_object_4, searchFor=string_5)
filterByBoolMask_5 = List.FilterByBoolMask(list=filterByBoolMask.in, mask=contains_4)
watch_4 = Watch(filterByBoolMask_5.in)
getLocation_4 = Element.GetLocation(element=watch_4)
fromCurve_4 = Custom[DetailLine.FromCurve](curve=getLocation_4, view=revit_currentview)
code_block_5 = CodeBlock { "Line Style"; }
line_styles_4 = LineStyleUi("SvN - FRR - 2H")  # graph input
setParameterByName_4 = Element.SetParameterByName(element=fromCurve_4, parameterName=code_block_5, value=line_styles_4)

# group: 3 HR FIRE RATING
string_from_object_5 = FromObject(obj=getParameterValueByName)
string_6 = StringInput("3HR")  # graph input
contains_5 = String.Contains(string=string_from_object_5, searchFor=string_6)
filterByBoolMask_6 = List.FilterByBoolMask(list=filterByBoolMask.in, mask=contains_5)
watch_5 = Watch(filterByBoolMask_6.in)
getLocation_5 = Element.GetLocation(element=watch_5)
fromCurve_5 = Custom[DetailLine.FromCurve](curve=getLocation_5, view=revit_currentview)
code_block_6 = CodeBlock { "Line Style"; }
line_styles_5 = LineStyleUi("SvN - FRR - 3H")  # graph input
setParameterByName_5 = Element.SetParameterByName(element=fromCurve_5, parameterName=code_block_6, value=line_styles_5)

# group: 3/4 HR FIRE RATING
string_from_object_6 = FromObject(obj=getParameterValueByName)
string_7 = StringInput(".75HR")  # graph input
contains_6 = String.Contains(string=string_from_object_6, searchFor=string_7)
filterByBoolMask_7 = List.FilterByBoolMask(list=filterByBoolMask.in, mask=contains_6)
watch_6 = Watch(filterByBoolMask_7.in)
getLocation_6 = Element.GetLocation(element=watch_6)
fromCurve_6 = Custom[DetailLine.FromCurve](curve=getLocation_6, view=revit_currentview)
code_block_7 = CodeBlock { "Line Style"; }
line_styles_6 = LineStyleUi("SvN - FRR - 3/4H")  # graph input
setParameterByName_6 = Element.SetParameterByName(element=fromCurve_6, parameterName=code_block_7, value=line_styles_6)
