# Dynamo graph allview-script.dyn (Dynamo 2.6.2.15705)
# packages: Crumple 2022.2.13, Rhythm 2022.1.5, archi-lab.net 2022.212.2722, Data-Shapes 2022.2.103, Clockwork for Dynamo 2.x 2.3.0, KAP Packages 0.0.1, Genius Loci 2021.11.10

categories = Categories("OST_Areas")

# group: Current Level and Views
boolean = BoolSelector(false)
currentview = Custom[© CurrentView](refresh=boolean)  # package Crumple; Given the current document, return the active view.

all_elements_of_category_in_view = ElementsOfCategoryInView(Category=categories, View=currentview)
string = StringInput("Areas: Municipal Number")
getParameterValueByName = Element.GetParameterValueByName(element=all_elements_of_category_in_view, parameterName=string)

# group: Make Dictionary
groupByKey = List.GroupByKey(list=all_elements_of_category_in_view, keys=getParameterValueByName)
string_2 = StringInput("Name")
getParameterValueByName_2 = Element.GetParameterValueByName(element=groupByKey.groups, parameterName=string_2)
string_3 = StringInput("Area")
getParameterValueByName_3 = Element.GetParameterValueByName(element=groupByKey.groups, parameterName=string_3)
id = Element.Id(element=groupByKey.groups)
list_create = List.Create(item0=groupByKey.unique_keys, item1=getParameterValueByName_2, item2=getParameterValueByName_3, item3=id)
transpose = List.Transpose(lists=list_create)
python_script = Python(IN[0]=transpose)
# ---------- python_script.python (31 lines) ----------
# Load the Python Standard and DesignScript Libraries
import sys
import clr
clr.AddReference('ProtoGeometry')
from Autodesk.DesignScript.Geometry import *

# The inputs to this node will be stored as a list in the IN variables.
dataEnteringNode = IN
unitList=IN[0]
resultList=[]

# Place your code below this line
for i in unitList:
	dictUnit={}
	dictUnit["MunicipalNumber"]=i[0]
	
	for (x,y,z) in zip(i[1],i[2],i[3]):
		
		if x == "Balcony" or x == "Terrace":
			dictUnit["OutsideArea"]=y
			dictUnit["OutsideID"]=z
			dictUnit["OutsideType"]=x
		else:
			dictUnit["SuiteArea"]=y
			dictUnit["SuiteID"]=z
			dictUnit["SuiteType"]=x
	resultList.append(dictUnit)


# Assign your output to the OUT variable.
OUT = resultList
# ----------------------------------------

string_4 = StringInput("Duplicate")
string_5 = StringInput("Associated Level")
getParameterValueByName_4 = Element.GetParameterValueByName(element=currentview, parameterName=string_5)
string_6 = StringInput("MunicipalNumber")

# group: Decode the Dictionary
string_7 = StringInput("OutsideID")
outside_id = DesignScript.Builtin.Dictionary.ValueAtKey(dictionary=python_script, key=string_7)
string_8 = StringInput("OutsideArea")
outside_area = DesignScript.Builtin.Dictionary.ValueAtKey(dictionary=python_script, key=string_8)
string_9 = StringInput("OutsideType")
outside_area_type = DesignScript.Builtin.Dictionary.ValueAtKey(dictionary=python_script, key=string_9)
python_script_2 = Python(IN[0]=outside_id, IN[1]=outside_area, IN[2]=outside_area_type)
# ---------- python_script_2.python (27 lines) ----------
# Load the Python Standard and DesignScript Libraries
import sys
import clr
clr.AddReference('ProtoGeometry')
from Autodesk.DesignScript.Geometry import *

# The inputs to this node will be stored as a list in the IN variables.
dataEnteringNode = IN
listD1=IN[0]
listD2=IN[1]
listD3=IN[2]
organizedL3=[]
organizedL1=[]
organizedL2=[]
# Place your code below this line
for (x,y,z) in zip(listD1,listD2,listD3):
	if x == None:
		x=""
	organizedL1.append(x)
	if y == None:
		y=""
	organizedL2.append(y)
	if z == None:
		z=""
	organizedL3.append(y)
# Assign your output to the OUT variable.
OUT = [organizedL3,organizedL1,organizedL2]
# ----------------------------------------
outsideArea = List.FirstItem(list=python_script_2)
outsideName = List.FirstItem(list=python_script_2)
municipal_number = DesignScript.Builtin.Dictionary.ValueAtKey(dictionary=python_script, key=string_6)
string_10 = StringInput("SuiteType")
suite_types = DesignScript.Builtin.Dictionary.ValueAtKey(dictionary=python_script, key=string_10)
string_11 = StringInput("SuiteID")
valueAtKey = DesignScript.Builtin.Dictionary.ValueAtKey(dictionary=python_script, key=string_11)
select_the_suite_area_element = ElementById(Id=valueAtKey)
outsideID = CodeBlock(lista=python_script_2) { i=lista[1]; }
outside_area_element = ElementById(Id=outsideID)
string_12 = StringInput("SuiteArea")
suite_area_metric = DesignScript.Builtin.Dictionary.ValueAtKey(dictionary=python_script, key=string_12)

create_view_name = CodeBlock(level=getParameterValueByName_4, munNumber=municipal_number, viewName=suite_types)
# ---------- create_view_name.designscript (4 lines) ----------
namePurchaser="14-"+level+
" - Suite "
+munNumber+
" ("+viewName+") - Purchaser";
# ----------------------------------------
collector_of_views = Custom[Collector of Views]()  # package Genius Loci; Collects all views in the active or given document.
name = Element.Name(element=collector_of_views.View)
contains_multiple = Custom[Contains_multiple](list=create_view_name, searchfor=name)  # package KAP Packages; get result of list containing elements from other list
python_script_3 = Python(IN[0]=contains_multiple, IN[1]=create_view_name)
# ---------- python_script_3.python (12 lines) ----------
import clr
clr.AddReference('RevitAPIUI')
from Autodesk.Revit.UI import TaskDialog, TaskDialogCommonButtons, TaskDialogResult, TaskDialogCommandLinkId

list1=IN[0]
list2=IN[1]

for i,p in zip(list1,list2):
	if i is True:
		TaskDialog.Show("Warming","view "+ p + " Already Exists, Please Delete first.")

OUT = list1
# ----------------------------------------
code_block = CodeBlock { Null; }  # unwired: Null
if_ = If(test=python_script_3, true=code_block, false=currentview)
create_view_name_2 = CodeBlock(level=getParameterValueByName_4, munNumber=municipal_number, viewName=suite_types)
# ---------- create_view_name_2.designscript (3 lines) ----------
nameSales="14-KeyPlan-Suite"
+level+munNumber +
" ("+viewName+")";
# ----------------------------------------
list_create_2 = List.Create(item0=create_view_name, item1=create_view_name_2)
string_13 = StringInput("Duplicate")
views_purchaser = archilab.Revit.Views.Views.Duplicate(view=if_, name=list_create_2, options=string_13)
firstItem = List.FirstItem(list=views_purchaser)
boolean_2 = BoolSelector(true)

# group: Input Group
file_path = Filename("R:\Graphics\Logos\New Kirkor Logo\Images\New Logo-01.png")
code_block_2 = CodeBlock { "Confirm"; "Cancel"; }
code_block_3 = CodeBlock { "Choose \nSuite Template"; }
viewtemplates = Custom[© ViewTemplates]()  # package Crumple; Returns all view templates in a document. Due to API/Dynamo limitations, 3D view templates are excluded from the list.
name_2 = Element.Name(element=viewtemplates)
code_block_4 = CodeBlock { "14"; }
contains = String.Contains(str=name_2, searchFor=code_block_4)
filterByBoolMask = List.FilterByBoolMask(list=viewtemplates, mask=contains)
name_3 = Element.Name(element=filterByBoolMask.in)
dropdown_data = Custom[DropDown Data](InputName=code_block_3, Keys=name_3, Values=filterByBoolMask.in)  # package Data-Shapes; Create data for DropDown input in UI.MultiInputForm ++ . Check out www.data-shapes.net for more infos.
code_block_5 = CodeBlock { "Choose \nKeyplan Template"; }
viewtemplates_2 = Custom[© ViewTemplates]()
name_4 = Element.Name(element=viewtemplates_2)
code_block_6 = CodeBlock { "Key Plan"; }
contains_2 = String.Contains(str=name_4, searchFor=code_block_6)
filterByBoolMask_2 = List.FilterByBoolMask(list=viewtemplates_2, mask=contains_2)
name_5 = Element.Name(element=filterByBoolMask_2.in)
dropdown_data_2 = Custom[DropDown Data](InputName=code_block_5, Keys=name_5, Values=filterByBoolMask_2.in)
code_block_7 = CodeBlock { "Choose \nTitleblock"; }
categories_2 = Categories("OST_TitleBlocks")
all_family_types_of_category = Custom[All Family Types Of Category](category=categories_2)  # package Clockwork for Dynamo 2.x; Gets all family types/symbols of a given category in the model.
name_6 = Element.Name(element=all_family_types_of_category)
code_block_8 = CodeBlock { ["C1","Titleblock"]; }
string_Contains_Multiple = Custom[String_Contains_Multiple](listStr=name_6, searchfor=code_block_8)  # package KAP Packages; search for if multiple strings are contained in other list
filterByBoolMask_3 = List.FilterByBoolMask(list=all_family_types_of_category, mask=string_Contains_Multiple)
name_7 = Element.Name(element=filterByBoolMask_3.in)
dropdown_data_3 = Custom[DropDown Data](InputName=code_block_7, Keys=name_7, Values=filterByBoolMask_3.in)
list_create_3 = List.Create(item0=dropdown_data, item1=dropdown_data_2, item2=dropdown_data_3)
multipleinputform = Custom[MultipleInputForm ++](Logo_optional=file_path, ButtonText_optional=code_block_2.out0, Inputs=list_create_3, Toggle=boolean_2, CancelButtonText_optional=code_block_2.out1)  # package Data-Shapes; Create a form with multiple inputs. see www.data-shapes.net for tutorials and infos!
code_block_9 = CodeBlock(l=multipleinputform.User_Inputs) { a=l[0]; b=l[1]; c=l[2]; }

setViewTemplate = archilab.Revit.Views.Views.SetViewTemplate(view=firstItem, viewTemplate=code_block_9.a)

# group: Get Boundary to crop views
ʳʰʸᵗʰᵐ_areas_suite = Rhythm.Revit.Elements.Areas.OuterBoundary(area=select_the_suite_area_element)
ʳʰʸᵗʰᵐ_areas_balcony_terrace = Rhythm.Revit.Elements.Areas.OuterBoundary(area=outside_area_element)
list_create_4 = List.Create(item0=ʳʰʸᵗʰᵐ_areas_suite, item1=ʳʰʸᵗʰᵐ_areas_balcony_terrace)
transpose_2 = List.Transpose(lists=list_create_4)
firstItem_2 = List.FirstItem(list=transpose_2@L2)
byPatch = Surface.ByPatch(closedCurve=firstItem_2)
lastItem = List.LastItem(list=transpose_2@L2)
byPatch_2 = Surface.ByPatch(closedCurve=lastItem)
list_create_5 = List.Create(item0=byPatch, item1=byPatch_2)
transpose_3 = List.Transpose(lists=list_create_5)
simplify_list_for_null = Python(IN[0]=transpose_3)
# ---------- simplify_list_for_null.python (21 lines) ----------
# Load the Python Standard and DesignScript Libraries
import sys
import clr
clr.AddReference('ProtoGeometry')
from Autodesk.DesignScript.Geometry import *

# The inputs to this node will be stored as a list in the IN variables.
dataEnteringNode = IN
list1=IN[0]
items=[]
# Place your code below this line

for listx in list1:
	result=[]
	for i in listx:
		if i != None:
			result.append(i)
	items.append(result)

# Assign your output to the OUT variable.
OUT = items
# ----------------------------------------
byUnion = Surface.ByUnion(surfaces=simplify_list_for_null)
perimeterCurves = Surface.PerimeterCurves(surface=byUnion)

setCropRegion = Custom[SetCropRegion](view=setViewTemplate, CurvesAsList=perimeterCurves)  # package Data-Shapes; Sets the crop region of a view to a closed polycurve.

# group: Area of Suite/Outside
areas_matric = List.Create(item0=suite_area_metric, item1=outside_area)
python_script_4 = Python(IN[0]=areas_matric)
# ---------- python_script_4.python (24 lines) ----------
# Load the Python Standard and DesignScript Libraries
import sys
import clr
clr.AddReference('ProtoGeometry')
from Autodesk.DesignScript.Geometry import *

# The inputs to this node will be stored as a list in the IN variables.
dataEnteringNode = IN
list1=IN[0]
resultList=[]

# Place your code below this line
for lists in list1:
	results=[]
	for i in lists:
		if i == None:
			result=0
		else:
			result=i
		results.append(result)
	resultList.append(results)
# Assign your output to the OUT variable.

OUT = resultList
# ----------------------------------------
transpose_4 = List.Transpose(lists=python_script_4)
code_block_10 = CodeBlock(area=transpose_4)
# ---------- code_block_10.designscript (4 lines) ----------
areaImp=Math.Ceiling
(area*10.7639);
areaMat=Math.Ceiling
(area);
# ----------------------------------------
terrace_area = List.LastItem(list=code_block_10.areaImp@L2)
terrace_area_metric = List.LastItem(list=code_block_10.areaMat@L2)
code_block_11 = CodeBlock(a=terrace_area, b=terrace_area_metric) { outsideArea= a + " SQft/" +b+" SQM"; }
suit_area_matric = List.FirstItem(list=code_block_10.areaMat@L2)
suite_area = List.FirstItem(list=code_block_10.areaImp@L2)
code_block_12 = CodeBlock(a=suite_area, b=suit_area_matric) { suiteArea= a + " SQft/" +b+" SQM"; }

lastItem_2 = List.LastItem(list=views_purchaser)
setViewTemplate_2 = archilab.Revit.Views.Views.SetViewTemplate(view=lastItem_2, viewTemplate=code_block_9.b)

# group: Filled Region for Keyplans
element_types = ElementTypes("FilledRegionType")
all_elements_of_type = ElementsOfType(element_type=element_types)
name_8 = Element.Name(element=all_elements_of_type)
string_14 = StringInput("Solid Grey 1")
eq = name_8 == string_14
filterByBoolMask_4 = List.FilterByBoolMask(list=all_elements_of_type, mask=eq)
firstItem_3 = List.FirstItem(list=filterByBoolMask_4.in)
byCurves = FilledRegion.ByCurves(view=setViewTemplate_2, boundary=perimeterCurves, regionType=firstItem_3)

string_15 = StringInput("Schedule C1")
code_block_13 = CodeBlock(viewNumber=municipal_number, viewName=suite_types)
# ---------- code_block_13.designscript (2 lines) ----------
numP="Suite "+viewNumber+
" ("+viewName+") Purchaser";
# ----------------------------------------
byNameNumberTitleBlock = Sheet.ByNameNumberTitleBlock(sheetName=string_15, sheetNumber=code_block_13, titleBlockFamilyType=code_block_9.c)

# group: Sheet Create
list_create_6 = List.Create(item0=setViewTemplate, item1=setViewTemplate_2)
transpose_5 = List.Transpose(lists=list_create_6)
code_block_14 = CodeBlock { -51; 305; 0; }
view_location = Point.ByCoordinates(x=code_block_14.out0, y=code_block_14.out1, z=code_block_14.out2)
code_block_15 = CodeBlock { 53; 45; 0; }
keyplan_location = Point.ByCoordinates(x=code_block_15.out0, y=code_block_15.out1, z=code_block_15.out2)
list_create_7 = List.Create(item0=view_location, item1=keyplan_location)
set_sheet_with_views_and = Python(IN[0]=byNameNumberTitleBlock, IN[1]=transpose_5, IN[2]=list_create_7)  # "Set Sheet with Views and location"
# ---------- set_sheet_with_views_and.python (51 lines) ----------
#python nodes in dynamo 1.2
#edited by Jason Tian

import clr
clr.AddReference('ProtoGeometry')
from Autodesk.DesignScript.Geometry import *
# Import ToDSType(bool) extension method
clr.AddReference("RevitNodes")
import Revit
clr.ImportExtensions(Revit.Elements)
# Import geometry conversion extension methods
clr.ImportExtensions(Revit.GeometryConversion)
# Import DocumentManager and TransactionManager
clr.AddReference("RevitServices")
import RevitServices
from RevitServices.Persistence import DocumentManager
from RevitServices.Transactions import TransactionManager
from System.Collections.Generic import *
# Import RevitAPI
clr.AddReference("RevitAPI")
import Autodesk
from Autodesk.Revit.DB import *

doc = DocumentManager.Instance.CurrentDBDocument
uiapp = DocumentManager.Instance.CurrentUIApplication
app = uiapp.Application
uidoc=DocumentManager.Instance.CurrentUIApplication.ActiveUIDocument

sheets = []
for i in IN[0]:
	sheets.append(UnwrapElement(i))
views=[]	
for i in IN[1]:
	views.append(UnwrapElement(i))
points=IN[2]

# Start Transaction
TransactionManager.Instance.EnsureInTransaction(doc)
viewport=[]

for (s,view) in zip(sheets,views):
    results=[]
    for (v,p) in zip(view,points):
	    result=Viewport.Create(doc, s.Id, v.Id, p.ToXyz())
	    results.append(result)
    viewport.append(results)

# End Transaction
TransactionManager.Instance.TransactionTaskDone()

OUT=viewport
# ----------------------------------------

string_16 = StringInput("Sheets: Terrace Area")
ʳʰʸᵗʰᵐ_sheets_area_outside = Rhythm.Revit.Elements.Elements.SetParameterByNameTypeOrInstance(element=byNameNumberTitleBlock@L2, parameterName=string_16, value=terrace_area_metric@L2)
string_17 = StringInput("Sheets: Suite Area")
ʳʰʸᵗʰᵐ_sheets_area_suite = Rhythm.Revit.Elements.Elements.SetParameterByNameTypeOrInstance(element=byNameNumberTitleBlock@L2, parameterName=string_17, value=suit_area_matric@L2)
string_18 = StringInput("Sheets: Type of Suite")
ʳʰʸᵗʰᵐ_suite_type = Rhythm.Revit.Elements.Elements.SetParameterByNameTypeOrInstance(element=byNameNumberTitleBlock@L2, parameterName=string_18, value=suite_types@L2)
string_19 = StringInput("Sheets: Marketing Suite Name")
ʳʰʸᵗʰᵐ_marketing_suite_name_mun = Rhythm.Revit.Elements.Elements.SetParameterByNameTypeOrInstance(element=byNameNumberTitleBlock@L2, parameterName=string_19, value=municipal_number@L2)  # "ʳʰʸᵗʰᵐ|Marketing Suite Name(Mun Number)"
code_block_16 = CodeBlock { "Sheets: Category"; "14 MARKETING"; "Sheets: Subcategory"; "C1 Purchaser"; }
ʳʰʸᵗʰᵐ_sheets_subcategory = Rhythm.Revit.Elements.Elements.SetParameterByNameTypeOrInstance(element=byNameNumberTitleBlock@L2, parameterName=code_block_16.out2, value=code_block_16.out3)  # "ʳʰʸᵗʰᵐ|Sheets SubCategory - Purchaser"
ʳʰʸᵗʰᵐ_sheets_category = Rhythm.Revit.Elements.Elements.SetParameterByNameTypeOrInstance(element=byNameNumberTitleBlock@L2, parameterName=code_block_16.out0, value=code_block_16.out1)
string_20 = StringInput("Sheets: Marketing Suite Area")
ʳʰʸᵗʰᵐ_suite_type_2 = Rhythm.Revit.Elements.Elements.SetParameterByNameTypeOrInstance(element=byNameNumberTitleBlock@L2, parameterName=string_20, value=code_block_12@L2)
