# Dynamo graph Add Line Type-script.dyn (Dynamo 2.19.3.6394)
# packages: bimorphNodes 4.2.4, Crumple 2022.5.27, Genius Loci 2023.2.21

file_path = Filename("N:\Library\Design Software\Autodesk\Revit\Standards\Line Type\Linetypes.xlsx")
file_from_path = FileObject(path=file_path)
code_block = CodeBlock { "Line Types"; "Line Patterns"; false; }

# group: Create Line Pattern if Missing
openXMLImportExcel = Data.OpenXMLImportExcel(filePath=file_path, sheetName=code_block.out1)
code_block_2 = CodeBlock { 2; }
dropItems = List.DropItems(list=openXMLImportExcel, amount=code_block_2)
transpose = List.Transpose(lists=dropItems)
code_block_3 = CodeBlock(list=transpose) { name = list[0]; type = list[1]; value= list[2]; }
code_block_4 = CodeBlock { -1; }
collect_linepatterns = Custom[© Collect.LinePatterns]()  # package Crumple; Returns all line patterns in a document.
indexOf = List.IndexOf(list=collect_linepatterns.names, element=code_block_3.name)
eq = code_block_4 == indexOf
filterByBoolMask = List.FilterByBoolMask(list=code_block_3.name, mask=eq)
code_block_5 = CodeBlock(types=code_block_3.type) { types; }
string = StringInput(",")
split = String.Split(string=code_block_5, separator0=string)
filterByBoolMask_2 = List.FilterByBoolMask(list=split, mask=eq)
code_block_6 = CodeBlock(values=code_block_3.value) { values; }
split_2 = String.Split(string=code_block_6, separator0=string)
toNumber = String.ToNumber(string=split_2@L2)
filterByBoolMask_3 = List.FilterByBoolMask(list=toNumber, mask=eq)
create_line_pattern = Custom[Create Line Pattern](Name=filterByBoolMask.in, types=filterByBoolMask_2.in, values=filterByBoolMask_3.in, lacing=Longest)  # package Genius Loci; Creates a new LinePatternElement. A line pattern is made of dashes, dots alternating with spaces. A space must end the sequence.

# group: Create Line Style
openXMLImportExcel_2 = Data.OpenXMLImportExcel(filePath=file_path, sheetName=code_block.out0)
code_block_7 = CodeBlock { 2; [0,2,3,4,5,6]; }
dropItems_2 = List.DropItems(list=openXMLImportExcel_2, amount=code_block_7.out0)
getItemAtIndex = List.GetItemAtIndex(list=dropItems_2@L2, index=code_block_7.out1)
list_clean = Custom[List Clean](list=getItemAtIndex)  # package Genius Loci; Removes all Null, Empty and Blank from a list or nested list of lists.
transpose_2 = List.Transpose(lists=list_clean)
code_block_8 = CodeBlock(list=transpose_2) { name=list[0]; weight=list[1]; linepattern=list[2]; r=list[3]; g=list[4]; b=list[5]; }
code_block_9 = CodeBlock(name=code_block_8.name) { name; }
code_block_10 = CodeBlock(weight=code_block_8.weight) { weight; }
flow_waitfor = Custom[© Flow.WaitFor](data=code_block_8.linepattern, waitFor=create_line_pattern)  # package Crumple; Tells the first input to wait for the second input to arrive, then passes on the first input. Really useful for scripts which have branching paths that rely on their outputs to carry each other forward. Quite a few custom packages have a 'passthrough' or 'waitfor' node. I use these all the time, so find it useful to have them contained in this package also.
getByName = LinePatternElement.GetByName(name=flow_waitfor)
byARGB = Color.ByARGB(red=code_block_8.r, green=code_block_8.g, blue=code_block_8.b)
# note: BirmophNodes
create = Revit.LineStyle.Create(name=code_block_9, weight=code_block_10, linePattern=getByName, color=byARGB, lacing=Longest)
