# Dynamo graph DeleteView-script.dyn (Dynamo 2.6.2.15705)
# packages: archi-lab.net 2022.212.2722

categories = Categories("OST_Views")
all_elements_of_category = ElementsOfCategory(Category=categories)
string = StringInput("Sheet Number")
getParameterValueByName = Element.GetParameterValueByName(element=all_elements_of_category, parameterName=string)
views_without_sheet = Python(IN[0]=getParameterValueByName)
# ---------- views_without_sheet.python (21 lines) ----------
# Enable Python support and load DesignScript library
import clr
clr.AddReference('ProtoGeometry')
from Autodesk.DesignScript.Geometry import *

# The inputs to this node will be stored as a list in the IN variables.
dataEnteringNode = IN


list1= IN[0]
list2= ["","--- "," ",None]
newlist=[]

for i in list1:
	if i in list2:
		returns=False
	else:
		returns=True
	newlist.append(returns)
print(list1)
OUT = newlist
# ----------------------------------------
filterByBoolMask = List.FilterByBoolMask(list=all_elements_of_category, mask=views_without_sheet)
delete = archilab.Revit.Elements.Elements.Delete(element=filterByBoolMask.in)
