# Dynamo graph DeleteViewsandsave-script.dyn (Dynamo 2.6.2.15705)
# packages: Genius Loci 2021.11.10, archi-lab.net 2022.212.2722, Clockwork for Dynamo 2.x 2.3.0, Data-Shapes 2022.2.103

collector_of_views = Custom[Collector of Views]()  # package Genius Loci; Collects all views in the active or given document.
string = StringInput("Sheets: Category")
getParameterValueByName = Element.GetParameterValueByName(element=collector_of_views.Sheet, parameterName=string)
file_path = Filename("R:\Graphics\Logos\New Kirkor Logo\Images\New Logo-01.png")
string_2 = StringInput("Choose the Phase to KEEP")
uniqueItems = List.UniqueItems(list=getParameterValueByName)
flatten = List.Flatten(list=uniqueItems)
python_script = Python(IN[0]=flatten)
# ---------- python_script.python (14 lines) ----------
# Load the Python Standard and DesignScript Libraries
import sys
import clr
clr.AddReference('ProtoGeometry')
from Autodesk.DesignScript.Geometry import *

name= IN[0]
list = []

for i in name:
	if i == "":
		i = "???"
	list.append(i)
OUT = list
# ----------------------------------------
listview_data = Custom[Listview Data](InputName=string_2, Keys=python_script, Values=flatten)  # package Data-Shapes; Create data for ListView input in UI.MultiInputForm ++ . Check out www.data-shapes.net for more infos.
code_block = CodeBlock { true; }
multipleinputform = Custom[MultipleInputForm ++](Logo_optional=file_path, Inputs=listview_data, Toggle=code_block)  # package Data-Shapes; Create a form with multiple inputs. see www.data-shapes.net for tutorials and infos!
firstItem = List.FirstItem(list=multipleinputform.User_Inputs)
python_script_2 = Python(IN[0]=getParameterValueByName, IN[1]=firstItem)
# ---------- python_script_2.python (18 lines) ----------
# Load the Python Standard and DesignScript Libraries
import sys
import clr
clr.AddReference('ProtoGeometry')
from Autodesk.DesignScript.Geometry import *

list1=IN[0]
list2=IN[1]
list3=[]

for i in list1:
    if i in list2:
        result=True
    else:
        result=False
    list3.append(result)

OUT = list3
# ----------------------------------------
flatten_2 = List.Flatten(list=python_script_2)
filterByBoolMask = List.FilterByBoolMask(list=collector_of_views.Sheet, mask=flatten_2)
delete = archilab.Revit.Elements.Elements.Delete(element=filterByBoolMask.out)
passthrough = Custom[Passthrough](passThrough=collector_of_views.Without_Sheet_All_Views, waitFor=delete)  # package Clockwork for Dynamo 2.x; Forces a sequential order of execution. The node wired into the output of the Passthrough node will be executed *after* the node wired into the waitFor input (e.g. important for some Revit operations). The value of the passThrough input will be passed on to the node wired into the output port of the Passthrough node.
delete_2 = archilab.Revit.Elements.Elements.Delete(element=passthrough)
