# Dynamo graph DeleteCurrentSheet-script.dyn (Dynamo 2.16.2.5624)
# packages: archi-lab.net 2022.212.2722, archi-lab.net 2023.213.1722, Crumple 2022.5.27, SvN Packages 0.0.1

svn_currentselection = Custom[SvN - CurrentSelection]()  # package SvN Packages; Return current selected elements
svn_popup_w_buttons = Custom[SvN - Popup w/ Buttons]()  # package SvN Packages; Pop - up Dialog for boolean; unwired: content
code_block = CodeBlock { Null; }  # unwired: Null
if_ = RefactoredIf(test=svn_popup_w_buttons, true=svn_currentselection, false=code_block)
views = Sheet.Views(sheet=if_)
delete = archilab.Revit.Elements.Elements.Delete(element=views)
flow_waitfor = Custom[© Flow.WaitFor](data=svn_currentselection, waitFor=delete)  # package Crumple; Tells the first input to wait for the second input to arrive, then passes on the first input. Really useful for scripts which have branching paths that rely on their outputs to carry each other forward. Quite a few custom packages have a 'passthrough' or 'waitfor' node. I use these all the time, so find it useful to have them contained in this package also.
delete_2 = archilab.Revit.Elements.Elements.Delete(element=flow_waitfor)
