# Dynamo graph DeleteViewsfromSheet-script.dyn (Dynamo 2.3.2.15696)
# packages: SvN Packages 0.0.1, archi-lab.net 2023.213.1722, Data-Shapes 2022.2.103, Crumple 2022.5.27

string = StringInput("The following Views:\n\n")
string_2 = StringInput(",\n")
svNLogo = Custom[SvNLogo]()  # package SvN Packages; Black and White Logo
revit_currentview = Custom[© Revit.CurrentView]()  # package Crumple; Given the current document, return the active view.
categories = Categories("OST_Sheets")
filterElementbyCategory = Custom[FilterElementbyCategory](list=revit_currentview, category=categories)  # package SvN Packages; Filter listed elements by assigned categories
string_3 = StringInput("""Current view is not a SHEET View

Please make current view to a SHEET first""")
# note: SvN Tool
popupDialog = Custom[PopupDialog](list=filterElementbyCategory.elements_of_category, content=string_3)  # package SvN Packages; Dialog box for information
code_block = CodeBlock { "Empty"; }
if_ = If(test=popupDialog, true=filterElementbyCategory.elements_of_category, false=code_block)
firstItem = List.FirstItem(list=if_)
views = Sheet.Views(sheet=firstItem)
name = Element.Name(element=views)
code_block_2 = CodeBlock { "NONE"; }
list_replacenulls = Custom[© List.ReplaceNulls](lst=name, replace=code_block_2)  # package Crumple; Replaces all nulls with a given substitute.
listview_data = Custom[Listview Data](Keys=list_replacenulls, Values=views)  # package Data-Shapes; Create data for ListView input in UI.MultiInputForm ++ . Check out www.data-shapes.net for more infos.
multipleinputform = Custom[MultipleInputForm ++](Logo_optional=svNLogo, Inputs=listview_data, Toggle=popupDialog)  # package Data-Shapes; Create a form with multiple inputs. see www.data-shapes.net for tutorials and infos!
firstItem_2 = List.FirstItem(list=multipleinputform.User_Inputs)
name_2 = Element.Name(element=firstItem_2)
join = String.Join(separator=string_2, string0=name_2)
string_4 = StringInput("\n\non Current Sheet:\n\n")
sheetNumber = Sheet.SheetNumber(sheet=if_)
name_3 = Element.Name(element=if_)
code_block_3 = CodeBlock(sNum=sheetNumber, sName=name_3) { sNum+"-"+sName; }
string_5 = StringInput("""

Will be Deleted, 
Confirm?""")
code_block_4 = CodeBlock(s1=string, s2=join, s3=string_4, s4=code_block_3, s5=string_5) { l=s1+s2+s3+s4[0]+s5; s=l[0]; }
python_script = Python(IN[0]=code_block_4.s)
# ---------- python_script.python (19 lines) ----------
import clr

clr.AddReference("RevitAPIUI")
from  Autodesk.Revit.UI import *

content=IN[0]

buttons = TaskDialogCommonButtons.Yes | TaskDialogCommonButtons.No

#assigning this to a dialog result variable allows us to check what the user selected
dialogResult = TaskDialog.Show("warning:",content,buttons)

#if the user clicks yes, return true to continue
if dialogResult == TaskDialogResult.Yes:
	returnValue = True
else:
	returnValue = False

OUT = returnValue
# ----------------------------------------
code_block_5 = CodeBlock { ""; }
if_2 = If(test=python_script, true=firstItem_2, false=code_block_5)
delete = archilab.Revit.Elements.Elements.Delete(element=if_2)
